# Dynamo custom node Annual Solar Exposure.dyf (Dynamo 1.2.0.2690)
# category: Honeybee.04 :: Daylight :: Daylight
# Calculate annual solar exposure (ASE). As per IES-LM-83-12 ASE is the percent of sensors that are found to be exposed to more than 1000lux of direct sunlight for more than 250hrs per year. For LEED credits no more than 10% of the points in the grid should fail this measure. -

input_python_script = CodeBlock { "Honeybee"; "ase_node.py"; }
import_and_prepare_py_code = Python(IN[0]=input_python_script.out0, IN[1]=input_python_script.out1)
# ---------- import_and_prepare_py_code.python (88 lines) ----------
        
"""Find packages from Dynamo folder and prepare the code."""
import clr
from System import AppDomain, Environment, IO

def tryGetPluginPath(plugin):
    """Try to get path to plugin folder."""
    clr.AddReference('ProtoGeometry')
    _loc = tuple(a.Location
                 for a in AppDomain.CurrentDomain.GetAssemblies()
                 if 'ProtoGeometry' in a.FullName)

    try:
        _ver = float(_loc[0].split('\\')[-2])
    except:
        _ver = float(_loc[0].split('\\')[-2].split(' ')[-1])

    assert _ver >= 1.2, 'You need Dynamo 1.2 or higher to use this plugin!'

    _appdata = Environment.GetFolderPath(Environment.SpecialFolder.ApplicationData)
    _dynamoPath = '%s\\%.1f' % (('\\').join(_loc[0].split('\\')[-4:-2]), float(_loc[0].split('\\')[-2]))
    # if the assembly is cached put Revit folder first, and then try to load it from core
    _dynamoPaths = (_dynamoPath.replace('Dynamo Core', 'Dynamo Revit'),
                    _dynamoPath.replace('Dynamo Revit', 'Dynamo Core'))
    _settingsFilename = 'DynamoSettings.xml'

    pkf = []
    for path in _dynamoPaths:
        settingsFile = IO.Path.Combine(_appdata, path, _settingsFilename)
        if IO.File.Exists(settingsFile):
            with open(settingsFile, 'rb') as outf:
                for line in outf:
                    if line.strip().startswith('<CustomPackageFolders>'):
                        for l in outf:
                            if l.strip().startswith('</CustomPackageFolders>'):
                                break
                            else:
                                pkf.append(l.replace('</string>', '').replace('<string>', '').strip())

    for p in pkf:
        pp = IO.Path.Combine(p, 'packages', plugin, 'extra')
        # In case of custom folders user may put honeybee under the root folder
        ppp = IO.Path.Combine(p, plugin, 'extra')
        if IO.Directory.Exists(pp):
            return pp
        elif IO.Directory.Exists(ppp):
            return ppp


try:
    plugin, filename = IN

    p = tryGetPluginPath(plugin)

    if not p:
        raise ImportError('{} is not installed! Install it from package manager.'.format(plugin))

	# import the file and wrap it into sys.append
    f = IO.Path.Combine(p, 'nodesrc', filename)
    with open(f, 'rb') as inf:
        source = '    '.join(inf.readlines())

    header = 'try:\n    import sys\n' + \
        '    sys.path.append(r\'{}\')\n\n'.format(p) + \
        '    sys.path.append(r\'C:\Program Files (x86)\IronPython 2.7\Lib\')\n\n' + \
        '    '

    footer = '\nexcept Exception, e:\n' + \
        '    import traceback\n' + \
        '    OUT = "ERROR:\\n\\t{}".format(str(e)) + \\\n' + \
        '    "\\n\\nIf you think this is a bug submit an issue on github.\\n" + \\\n' + \
        '    "https://github.com/ladybug-tools/honeybee-dynamo/issues\\n" +  \\\n' + \
        '    "and include below error message:\\n\\n" + \\\n' + \
        '    "{}".format(traceback.format_exc())\n'

    OUT = header + source + footer

except Exception, e:
    import sys
    sys.path.append(r'C:\Program Files (x86)\IronPython 2.7\Lib')
    import traceback
    OUT = "ERROR:\n\t{}".format(str(e)) + \
        "\n\nIf you think this is a bug submit an issue on github.\n" + \
        "https://github.com/ladybug-tools/honeybee-dynamo/issues\n" +  \
        "and include below error message:\n\n" + \
        "{}".format(traceback.format_exc())

      
# ----------------------------------------
analysisGrid = Input(_analysisGrid: var)  # An analysis grid output from run Radiance analysis.
blindStates = Input(blindStates_: var[] = {})  # List of state ids for all the sources for input hoys. If you want a source to be removed set the state to -1. ASE must be calculated without dynamic blinds but you can use this option to study the effect of different blind states.
occSchedule = Input(_occSchedule_: var = null)  # An annual occupancy schedule.
threshold = Input(_threshold_: int = 1000)  # Threshhold for solar exposure in lux (default: 1000).
targetHrs = Input(_targetHrs_: int = 250)  # Minimum targe hours for each point (default: 250).
targetArea = Input(_targetArea_: int = 10)  # Minimum target area percentage for this grid (default: 10)
core = PythonStringNode(script=import_and_prepare_py_code, IN[0]=analysisGrid, IN[1]=blindStates, IN[2]=occSchedule, IN[3]=threshold, IN[4]=targetHrs, IN[5]=targetArea)
decompose_outputs = CodeBlock(out=core) { out[0]; out[1]; out[2]; out[3]; out[4]; out[5]; }
success = Output(decompose_outputs.out0)  # Script variable ASE
ASE = Output(decompose_outputs.out1)  # Number of hours of annual solar exposure for each test point.
perArea = Output(decompose_outputs.out2)  # Percentage area that doesn't meet the target.
prblmPts = Output(decompose_outputs.out3)  # A list of problematic test points.
prblmHrs = Output(decompose_outputs.out4)  # Problematic hours for each point.
legendPar = Output(decompose_outputs.out5)  # Script variable ASE
error_report = Python(IN[0]=import_and_prepare_py_code, IN[1]=core)
# ---------- error_report.python (17 lines) ----------
        
"""Report errors"""
importErr, runErr = IN
errors = []

if importErr and str(importErr).startswith("ERROR:"):
    errors.append(importErr)

if runErr and str(runErr).startswith("ERROR:"):
    errors.append(runErr)

if len(errors)==0:
    OUT = "All good! Vvizzzz."
else:
    OUT = "\n".join(errors)

      
# ----------------------------------------
ERRReport = Output(error_report)  # Report
