# Dynamo custom node Dynamic Blinds Schedule.dyf (Dynamo 1.2.0.2690)
# category: Honeybee.04 :: Daylight :: Daylight
# Dynamic Blinds Schedule -

input_python_script = CodeBlock { "Honeybee"; "dynblindschd_node.py"; }
import_and_prepare_py_code = Python(IN[0]=input_python_script.out0, IN[1]=input_python_script.out1)
# ---------- import_and_prepare_py_code.python (88 lines) ----------
        
"""Find packages from Dynamo folder and prepare the code."""
import clr
from System import AppDomain, Environment, IO

def tryGetPluginPath(plugin):
    """Try to get path to plugin folder."""
    clr.AddReference('ProtoGeometry')
    _loc = tuple(a.Location
                 for a in AppDomain.CurrentDomain.GetAssemblies()
                 if 'ProtoGeometry' in a.FullName)

    try:
        _ver = float(_loc[0].split('\\')[-2])
    except:
        _ver = float(_loc[0].split('\\')[-2].split(' ')[-1])

    assert _ver >= 1.2, 'You need Dynamo 1.2 or higher to use this plugin!'

    _appdata = Environment.GetFolderPath(Environment.SpecialFolder.ApplicationData)
    _dynamoPath = '%s\\%.1f' % (('\\').join(_loc[0].split('\\')[-4:-2]), float(_loc[0].split('\\')[-2]))
    # if the assembly is cached put Revit folder first, and then try to load it from core
    _dynamoPaths = (_dynamoPath.replace('Dynamo Core', 'Dynamo Revit'),
                    _dynamoPath.replace('Dynamo Revit', 'Dynamo Core'))
    _settingsFilename = 'DynamoSettings.xml'

    pkf = []
    for path in _dynamoPaths:
        settingsFile = IO.Path.Combine(_appdata, path, _settingsFilename)
        if IO.File.Exists(settingsFile):
            with open(settingsFile, 'rb') as outf:
                for line in outf:
                    if line.strip().startswith('<CustomPackageFolders>'):
                        for l in outf:
                            if l.strip().startswith('</CustomPackageFolders>'):
                                break
                            else:
                                pkf.append(l.replace('</string>', '').replace('<string>', '').strip())

    for p in pkf:
        pp = IO.Path.Combine(p, 'packages', plugin, 'extra')
        # In case of custom folders user may put honeybee under the root folder
        ppp = IO.Path.Combine(p, plugin, 'extra')
        if IO.Directory.Exists(pp):
            return pp
        elif IO.Directory.Exists(ppp):
            return ppp


try:
    plugin, filename = IN

    p = tryGetPluginPath(plugin)

    if not p:
        raise ImportError('{} is not installed! Install it from package manager.'.format(plugin))

	# import the file and wrap it into sys.append
    f = IO.Path.Combine(p, 'nodesrc', filename)
    with open(f, 'rb') as inf:
        source = '    '.join(inf.readlines())

    header = 'try:\n    import sys\n' + \
        '    sys.path.append(r\'{}\')\n\n'.format(p) + \
        '    sys.path.append(r\'C:\Program Files (x86)\IronPython 2.7\Lib\')\n\n' + \
        '    '

    footer = '\nexcept Exception, e:\n' + \
        '    import traceback\n' + \
        '    OUT = "ERROR:\\n\\t{}".format(str(e)) + \\\n' + \
        '    "\\n\\nIf you think this is a bug submit an issue on github.\\n" + \\\n' + \
        '    "https://github.com/ladybug-tools/honeybee-dynamo/issues\\n" +  \\\n' + \
        '    "and include below error message:\\n\\n" + \\\n' + \
        '    "{}".format(traceback.format_exc())\n'

    OUT = header + source + footer

except Exception, e:
    import sys
    sys.path.append(r'C:\Program Files (x86)\IronPython 2.7\Lib')
    import traceback
    OUT = "ERROR:\n\t{}".format(str(e)) + \
        "\n\nIf you think this is a bug submit an issue on github.\n" + \
        "https://github.com/ladybug-tools/honeybee-dynamo/issues\n" +  \
        "and include below error message:\n\n" + \
        "{}".format(traceback.format_exc())

      
# ----------------------------------------
sensor = Input(_sensor: var)  # A single sensor from the analsysi Grid.
blindCombs = Input(_blindCombs_: var[] = {})  # Suggested blind state combinations of window groups for meeting the logic. States can be one of the following: -1 = No light from window source (opaque) 0 = Normal window state (typically transparent) 1 = The first shade state (assuming one has been assigned) 2 = the second shade state (assuming one has been assigned) ... etc. Put each state as a tuple that has a length equal to the number of window groups in the model (check the report output of this component to see the order of the window groups). For instance (0, 0, 1) indicates that the first and second window groups are at state 0 and the third window group is at state 1. If you plug in a list of tuples, honeybee will try to meet the logic by first using the first tuple in the list.  If that doesn't work, the second tuple will be used, etc. The default is the longest combination of all window groups. For example if you have 3 window groups. The first with 1 state, the second with 3 states and the last with 2 states. The combinations are (0,0,0), (0,1,1) and (0,2,1). State -1 will never be assigned by default.
logic = Input(_logic_: string = null)  # Blinds logic. You can use ill, ill_dir and h(our) as input values. Default is ill > 3000. You can also overwrite the logic by opening the components and edit 'checkLogic' function.
data = Input(data_: var[] = {})  # optional data to pass along side the values which can be used to set-up the logic. This input yet needs to be tested.
core = PythonStringNode(script=import_and_prepare_py_code, IN[0]=sensor, IN[1]=blindCombs, IN[2]=logic, IN[3]=data)
decompose_outputs = CodeBlock(out=core) { out[0]; out[1]; out[2]; out[3]; out[4]; }
blindStates = Output(decompose_outputs.out0)  # Selected blind states based on input logic.
blindStIndex = Output(decompose_outputs.out1)  # Index of selected blind state from input _blindStates_.
illumTotal = Output(decompose_outputs.out2)  # Sensor total illuminance values.
illumDirect = Output(decompose_outputs.out3)  # Sensor direct illuminance values. This value won't be available for 3-Phase recipe.
success = Output(decompose_outputs.out4)  # A boolean that shows if the logic is satisfied by using the current combinations of shadings.
error_report = Python(IN[0]=import_and_prepare_py_code, IN[1]=core)
# ---------- error_report.python (17 lines) ----------
        
"""Report errors"""
importErr, runErr = IN
errors = []

if importErr and str(importErr).startswith("ERROR:"):
    errors.append(importErr)

if runErr and str(runErr).startswith("ERROR:"):
    errors.append(runErr)

if len(errors)==0:
    OUT = "All good! Vvizzzz."
else:
    OUT = "\n".join(errors)

      
# ----------------------------------------
ERRReport = Output(error_report)  # Report
