# Dynamo custom node Radiance Parameters Grid-based.dyf (Dynamo 1.2.0.2690)
# category: Honeybee.03 :: Daylight :: Recipe
# Radiance parameters library for analysis recipes. Check here for more details: http://radsite.lbl.gov/radiance/refer/Notes/rpict_options.html Read more about the parameters at: http://daysim.ning.com/ Here is my favorite presentation by John Mardaljevic: http://radiance-online.org/community/workshops/2011-berkeley-ca/presentations/day1/JM_AmbientCalculation.pdf -

input_python_script = CodeBlock { "Honeybee"; "radpargridbased_node.py"; }
import_and_prepare_py_code = Python(IN[0]=input_python_script.out0, IN[1]=input_python_script.out1)
# ---------- import_and_prepare_py_code.python (88 lines) ----------
        
"""Find packages from Dynamo folder and prepare the code."""
import clr
from System import AppDomain, Environment, IO

def tryGetPluginPath(plugin):
    """Try to get path to plugin folder."""
    clr.AddReference('ProtoGeometry')
    _loc = tuple(a.Location
                 for a in AppDomain.CurrentDomain.GetAssemblies()
                 if 'ProtoGeometry' in a.FullName)

    try:
        _ver = float(_loc[0].split('\\')[-2])
    except:
        _ver = float(_loc[0].split('\\')[-2].split(' ')[-1])

    assert _ver >= 1.2, 'You need Dynamo 1.2 or higher to use this plugin!'

    _appdata = Environment.GetFolderPath(Environment.SpecialFolder.ApplicationData)
    _dynamoPath = ('\\').join(_loc[0].split('\\')[-4:-1])
    # if the assembly is cached put Revit folder first, and then try to load it from core
    _dynamoPaths = (_dynamoPath.replace('Dynamo Core', 'Dynamo Revit'),
                    _dynamoPath.replace('Dynamo Revit', 'Dynamo Core'))
    _settingsFilename = 'DynamoSettings.xml'

    pkf = []
    for path in _dynamoPaths:
        settingsFile = IO.Path.Combine(_appdata, path, _settingsFilename)
        if IO.File.Exists(settingsFile):
            with open(settingsFile, 'rb') as outf:
                for line in outf:
                    if line.strip().startswith('<CustomPackageFolders>'):
                        for l in outf:
                            if l.strip().startswith('</CustomPackageFolders>'):
                                break
                            else:
                                pkf.append(l.replace('</string>', '').replace('<string>', '').strip())

    for p in pkf:
        pp = IO.Path.Combine(p, 'packages', plugin, 'extra')
        # In case of custom folders user may put honeybee under the root folder
        ppp = IO.Path.Combine(p, plugin, 'extra')
        if IO.Directory.Exists(pp):
            return pp
        elif IO.Directory.Exists(ppp):
            return ppp


try:
    plugin, filename = IN

    p = tryGetPluginPath(plugin)

    if not p:
        raise ImportError('{} is not installed! Install it from package manager.'.format(plugin))

	# import the file and wrap it into sys.append
    f = IO.Path.Combine(p, 'nodesrc', filename)
    with open(f, 'rb') as inf:
        source = '    '.join(inf.readlines())

    header = 'try:\n    import sys\n' + \
        '    sys.path.append(r\'{}\')\n\n'.format(p) + \
        '    sys.path.append(r\'C:\Program Files (x86)\IronPython 2.7\Lib\')\n\n' + \
        '    '

    footer = '\nexcept Exception, e:\n' + \
        '    import traceback\n' + \
        '    OUT = "ERROR:\\n\\t{}".format(str(e)) + \\\n' + \
        '    "\\n\\nIf you think this is a bug submit an issue on github.\\n" + \\\n' + \
        '    "https://github.com/ladybug-tools/honeybee-dynamo/issues\\n" +  \\\n' + \
        '    "and include below error message:\\n\\n" + \\\n' + \
        '    "{}".format(traceback.format_exc())\n'

    OUT = header + source + footer

except Exception, e:
    import sys
    sys.path.append(r'C:\Program Files (x86)\IronPython 2.7\Lib')
    import traceback
    OUT = "ERROR:\n\t{}".format(str(e)) + \
        "\n\nIf you think this is a bug submit an issue on github.\n" + \
        "https://github.com/ladybug-tools/honeybee-dynamo/issues\n" +  \
        "and include below error message:\n\n" + \
        "{}".format(traceback.format_exc())

      
# ----------------------------------------
complexity = Input(_complexity_: int = 0)  # 0 > low, 1 > Medium, 2 > High (default: 0).
recipeType = Input(_recipeType_: int = 0)  # 0 > Point-in-time, 1 > Daylight Coeff., 2 > 3Phase, 3 > 5Phase
radOptPar = Input(radOptPar_: string = null)  # Use this input to set other Radiance parameters as needed. You must follow Radiance's standard syntax (e.g. -ps 1 -lw 0.01)
vmtxOptPar = Input(vmtxOptPar_: string = null)  # Use this input to set other Radiance parameters for view matrix calculation as needed. You must follow Radiance's standard syntax (e.g. -ps 1 -lw 0.01).
dmtxOptPar = Input(dmtxOptPar_: string = null)  # Use this input to set other Radiance parameters for daylight matrix calculation as needed. You must follow Radiance's standard syntax (e.g. -ps 1 -lw 0.01).
smtxOptPar = Input(smtxOptPar_: string = null)  # Use this input to set other Radiance parameters for sun matrix calculation as needed. You must follow Radiance's standard syntax (e.g. -ps 1 -lw 0.01).
core = PythonStringNode(script=import_and_prepare_py_code, IN[0]=complexity, IN[1]=recipeType, IN[2]=radOptPar, IN[3]=vmtxOptPar, IN[4]=dmtxOptPar, IN[5]=smtxOptPar)
decompose_outputs = CodeBlock(out=core) { out[0]; out[1]; out[2]; out[3]; }
radPar = Output(decompose_outputs.out0)  # Radiance parameters.
vmtxPar = Output(decompose_outputs.out1)  # Radiance parameters for view matrix calculation.
dmtxPar = Output(decompose_outputs.out2)  # Radiance parameters for daylight matrix calculation.
smtxPar = Output(decompose_outputs.out3)  # Radiance parameters for direct sun matrix calculation.
error_report = Python(IN[0]=import_and_prepare_py_code, IN[1]=core)
# ---------- error_report.python (17 lines) ----------
        
"""Report errors"""
importErr, runErr = IN
errors = []

if importErr and str(importErr).startswith("ERROR:"):
    errors.append(importErr)

if runErr and str(runErr).startswith("ERROR:"):
    errors.append(runErr)

if len(errors)==0:
    OUT = "All good! Vvizzzz."
else:
    OUT = "\n".join(errors)

      
# ----------------------------------------
ERRReport = Output(error_report)  # Report
