# Dynamo custom node View.dyf (Dynamo 1.2.0.2690)
# category: Honeybee.00 :: Create
# Honeybee View. -

input_python_script = CodeBlock { "Honeybee"; "view_node.py"; }
import_and_prepare_py_code = Python(IN[0]=input_python_script.out0, IN[1]=input_python_script.out1)
# ---------- import_and_prepare_py_code.python (88 lines) ----------
        
"""Find packages from Dynamo folder and prepare the code."""
import clr
from System import AppDomain, Environment, IO

def tryGetPluginPath(plugin):
    """Try to get path to plugin folder."""
    clr.AddReference('ProtoGeometry')
    _loc = tuple(a.Location
                 for a in AppDomain.CurrentDomain.GetAssemblies()
                 if 'ProtoGeometry' in a.FullName)

    try:
        _ver = float(_loc[0].split('\\')[-2])
    except:
        _ver = float(_loc[0].split('\\')[-2].split(' ')[-1])

    assert _ver >= 1.2, 'You need Dynamo 1.2 or higher to use this plugin!'

    _appdata = Environment.GetFolderPath(Environment.SpecialFolder.ApplicationData)
    _dynamoPath = '%s\\%.1f' % (('\\').join(_loc[0].split('\\')[-4:-2]), float(_loc[0].split('\\')[-2]))
    # if the assembly is cached put Revit folder first, and then try to load it from core
    _dynamoPaths = (_dynamoPath.replace('Dynamo Core', 'Dynamo Revit'),
                    _dynamoPath.replace('Dynamo Revit', 'Dynamo Core'))
    _settingsFilename = 'DynamoSettings.xml'

    pkf = []
    for path in _dynamoPaths:
        settingsFile = IO.Path.Combine(_appdata, path, _settingsFilename)
        if IO.File.Exists(settingsFile):
            with open(settingsFile, 'rb') as outf:
                for line in outf:
                    if line.strip().startswith('<CustomPackageFolders>'):
                        for l in outf:
                            if l.strip().startswith('</CustomPackageFolders>'):
                                break
                            else:
                                pkf.append(l.replace('</string>', '').replace('<string>', '').strip())

    for p in pkf:
        pp = IO.Path.Combine(p, 'packages', plugin, 'extra')
        # In case of custom folders user may put honeybee under the root folder
        ppp = IO.Path.Combine(p, plugin, 'extra')
        if IO.Directory.Exists(pp):
            return pp
        elif IO.Directory.Exists(ppp):
            return ppp


try:
    plugin, filename = IN

    p = tryGetPluginPath(plugin)

    if not p:
        raise ImportError('{} is not installed! Install it from package manager.'.format(plugin))

	# import the file and wrap it into sys.append
    f = IO.Path.Combine(p, 'nodesrc', filename)
    with open(f, 'rb') as inf:
        source = '    '.join(inf.readlines())

    header = 'try:\n    import sys\n' + \
        '    sys.path.append(r\'{}\')\n\n'.format(p) + \
        '    sys.path.append(r\'C:\Program Files (x86)\IronPython 2.7\Lib\')\n\n' + \
        '    '

    footer = '\nexcept Exception, e:\n' + \
        '    import traceback\n' + \
        '    OUT = "ERROR:\\n\\t{}".format(str(e)) + \\\n' + \
        '    "\\n\\nIf you think this is a bug submit an issue on github.\\n" + \\\n' + \
        '    "https://github.com/ladybug-tools/honeybee-dynamo/issues\\n" +  \\\n' + \
        '    "and include below error message:\\n\\n" + \\\n' + \
        '    "{}".format(traceback.format_exc())\n'

    OUT = header + source + footer

except Exception, e:
    import sys
    sys.path.append(r'C:\Program Files (x86)\IronPython 2.7\Lib')
    import traceback
    OUT = "ERROR:\n\t{}".format(str(e)) + \
        "\n\nIf you think this is a bug submit an issue on github.\n" + \
        "https://github.com/ladybug-tools/honeybee-dynamo/issues\n" +  \
        "and include below error message:\n\n" + \
        "{}".format(traceback.format_exc())

      
# ----------------------------------------
name = Input(_name: var)  # View name.
vLocation = Input(_vLocation: Autodesk.Point)  # Set the view point (-vp) to (x, y, z). This is the focal point of a perspective view or the center of a parallel projection.
vDirection = Input(_vDirection: Autodesk.Vector)  # Set the view direction (-vd) vector to (x, y, z). The length of this vector indicates the focal distance as needed by the pixle depth of field (-pd) in rpict. Default: (0, 0, 1)
vUpVector = Input(_vUpVector_: Autodesk.Vector = Autodesk.Vector.ByCoordinates(0,0,1))  # Set the view up (-vu) vector (vertical direction) to (x, y, z).
viewType = Input(_viewType_: int = 0)  # Set view type (-vt) to one of the choices below. 0 Perspective (v) 1 Hemispherical fisheye (h) 2 Parallel (l) 3 Cylindrical panorma (c) 4 Angular fisheye (a) 5 Planisphere [stereographic] projection (s) For more detailed description about view types check rpict manual
hViewAngle = Input(_hViewAngle_: double = 45)  # Set the view horizontal size (-vs). For a perspective projection (including fisheye views), val is the horizontal field of view (in degrees). For a parallel projection, val is the view width in world coordinates.
vViewAngle = Input(_vViewAngle_: double = 45)  # Set the view vertical size (-vv). For a perspective projection (including fisheye views), val is the horizontal field of view (in degrees). For a parallel projection, val is the view width in world coordinates.
xResolution = Input(_xResolution_: int = 420)  # Set the maximum x resolution (-x) to an integer.
yResolution = Input(_yResolution_: int = 420)  # Set the maximum y resolution (-y) to an integer.
core = PythonStringNode(script=import_and_prepare_py_code, IN[0]=name, IN[1]=vLocation, IN[2]=vDirection, IN[3]=vUpVector, IN[4]=viewType, IN[5]=hViewAngle, IN[6]=vViewAngle, IN[7]=xResolution, IN[8]=yResolution)
decompose_outputs = CodeBlock(out=core) { out[0]; }
view = Output(decompose_outputs)  # Honeybee view.
error_report = Python(IN[0]=import_and_prepare_py_code, IN[1]=core)
# ---------- error_report.python (17 lines) ----------
        
"""Report errors"""
importErr, runErr = IN
errors = []

if importErr and str(importErr).startswith("ERROR:"):
    errors.append(importErr)

if runErr and str(runErr).startswith("ERROR:"):
    errors.append(runErr)

if len(errors)==0:
    OUT = "All good! Vvizzzz."
else:
    OUT = "\n".join(errors)

      
# ----------------------------------------
ERRReport = Output(error_report)  # Report
