# Dynamo custom node Run Radiance Simulation.dyf (Dynamo 1.2.0.2690)
# category: Honeybee.04 :: Daylight :: Analysis
# Write and run radiance simulations from Radiance recipes.

# group: load the script
code_block = CodeBlock { "Honeybee"; "runRadianceSimulation_node.py"; }

import_and_prepare_py_code = Python(IN[0]=code_block.out0, IN[1]=code_block.out1)
# ---------- import_and_prepare_py_code.python (78 lines) ----------
"""Find packages from Dynamo folder and prepare the code."""
import clr
from System import AppDomain, Environment, IO

def tryGetPluginPath(plugin):
    """Try to get path to plugin folder."""
    clr.AddReference('ProtoGeometry')
    _loc = tuple(a.Location
                 for a in AppDomain.CurrentDomain.GetAssemblies()
                 if 'ProtoGeometry' in a.FullName)

    try:
        _ver = float(_loc[0].split('\\')[-2])
    except:
        _ver = float(_loc[0].split('\\')[-2].split(' ')[-1])

    assert _ver >= 1.2, 'You need Dynamo 1.2 or higher to use this plugin!'

    _appdata = Environment.GetFolderPath(Environment.SpecialFolder.ApplicationData)
    _dynamoPath = ('\\').join(_loc[0].split('\\')[-4:-1])
    # if the assembly is cached put Revit folder first, and then try to load it from core
    _dynamoPaths = (_dynamoPath.replace('Dynamo Core', 'Dynamo Revit'),
                    _dynamoPath.replace('Dynamo Revit', 'Dynamo Core'))
    _settingsFilename = 'DynamoSettings.xml'
    
    pkf = []
    for path in _dynamoPaths:
        settingsFile = IO.Path.Combine(_appdata, path, _settingsFilename)
        if not IO.File.Exists(settingsFile):
            continue
        with open(settingsFile, 'rb') as outf:
            for line in outf:
                if line.strip().startswith('<CustomPackageFolders>'):
                    for l in outf:
                        if l.strip().startswith('</CustomPackageFolders>'):
                            break
                        else:
                            pkf.append(l.replace('</string>', '').replace('<string>', '').strip())

    for p in pkf:
        pp = IO.Path.Combine(p, 'packages', plugin, 'extra')
        if IO.Directory.Exists(pp):
            return pp

try:
    plugin, filename = IN
    p = tryGetPluginPath(plugin)
    if not p:
        raise ImportError('{} is not installed! Install it from package manager.'.format(plugin))
    # import the file and wrap it into sys.append
    f = IO.Path.Combine(p, 'nodesrc', filename)
    with open(f, 'rb') as inf:
        source = '    '.join(inf.readlines())

    header = 'try:\n    import sys\n' + \
        '    sys.path.append(r\'{}\')\n\n'.format(p) + \
        '    sys.path.append(r\'C:\Program Files (x86)\IronPython 2.7\Lib\')\n\n' + \
        '    '

    footer = '\nexcept Exception, e:\n' + \
        '    import traceback\n' + \
        '    OUT = "ERROR:\\n\\t{}".format(str(e)) + \\\n' + \
        '    "\\n\\nIf you think this is a bug submit an issue on github.\\n" + \\\n' + \
        '    "https://github.com/ladybug-analysis-tools/honeybee-plus/issues\\n" +  \\\n' + \
        '    "and include below error message:\\n\\n" + \\\n' + \
        '    "{}".format(traceback.format_exc())\n'

    OUT = header + source + footer

except Exception, e:
    import sys
    sys.path.append(r'C:\Program Files (x86)\IronPython 2.7\Lib')
    import traceback
    OUT = "ERROR:\n\t{}".format(str(e)) + \
        "\n\nIf you think this is a bug submit an issue on github.\n" + \
        "https://github.com/ladybug-analysis-tools/honeybee-plus/issues\n" +  \
        "and include below error message:\n\n" + \
        "{}".format(traceback.format_exc())
# ----------------------------------------
analysisRecipe = Input(_analysisRecipe:System.Object = null)  # A Radiance Analysis Recipe
honeybeeObjects = Input()  # "_honeybeeObjects"; List of honeybee surfaces or zones
workingDir = Input(_workingDir_:string = null)  # Path to working directory default: c:/users/[username]/honeybee
projectName = Input(_projectName_:string = null)  # Name for this project. defult: unnamed.
write = Input(_write:bool = false)  # Write files to folder
run = Input(run_:bool = false)  # Run the analysis
python_script_from_string = PythonStringNode(script=import_and_prepare_py_code, IN[0]=analysisRecipe, IN[1]=honeybeeObjects, IN[2]=workingDir, IN[3]=projectName, IN[4]=write, IN[5]=run)
results = Output(python_script_from_string)  # Results of the analysis
error_report = Python(IN[0]=import_and_prepare_py_code, IN[1]=python_script_from_string)
# ---------- error_report.python (15 lines) ----------
"""Report errors"""
importErr = IN[0]
runErr = IN[1]
errors = []

if importErr and str(importErr).startswith("ERROR:"):
	errors.append(importErr)

if runErr and str(runErr).startswith("ERROR:"):
	errors.append(runErr)

if len(errors)==0:
	OUT = "All good! Vvizzzz."
else:
	OUT = "\n".join(errors)
# ----------------------------------------
ERRReport = Output(error_report)  # Report
