# Dynamo graph 02_daylight_factor.dyn (Dynamo 1.2.1.3083)

boolean = BoolSelector(true)

# group: This component fails for complex geometries. In those cases you can create the model surface by surface. You can also vote at the link below here so Autodesk opens up the Room API, so we can get the openings without failure! http://forums.autodesk.com/t5/revit-ideas/api-access-to-room-openings-geometry-and-materials-in-revit/idi-p/6642406
collect_rooms_and_spaces = Custom[Collect Rooms and Spaces](collect=boolean)  # Collect rooms and MEP spaces in the Revit document. Use "Rooms to HBZones" node to convert them to Honeybee zones.

rooms_to_hbzones = Custom[Rooms to HBZones](rooms=collect_rooms_and_spaces.rooms)  # Create Honeybee zones from Revit Rooms or MEPSpaces. This node currently ONLY collects geometrical data from Revit. In the future it will import constructions, materials and MEP data (e.g lighting power density).
code_block = CodeBlock { 500; 750; }
generate_test_points_from = Custom[Generate Test Points from HBZones](HBZones=rooms_to_hbzones.HBZones, gridSize=code_block.out0, disFromSurface=code_block.out1)  # Generate test points from Honeybee zones based on grid size.
byPatch = Surface.ByPatch(generate_test_points_from.polygons)

# group: generate an overcast sky with certain illuminance
set_sky_to_overcast = CodeBlock { 10000; }
sky_with_certain_illuminance = Custom[Sky with Certain Illuminance](illuminanceValue=set_sky_to_overcast)  # Genrate a uniform CIE sky from an illuminace value

grid_based_analysis_recipe = Custom[Grid-based Analysis Recipe](sky=sky_with_certain_illuminance.sky, testPoints=generate_test_points_from.testPts, ptsNormal=generate_test_points_from.ptsNormal)  # Create an analysis recipe for a grid-based daylight or radiation analysis.
code_block_2 = CodeBlock { "c:/ladybug"; "twoRooms"; true; }
run_radiance_simulation = Custom[Run Radiance Simulation](analysisRecipe=grid_based_analysis_recipe.gridbasedAnalysisRecipe, honeybeeObjects=rooms_to_hbzones.HBZones, workingDir=code_block_2.out0, projectName=code_block_2.out1, write=code_block_2.out2, run=code_block_2.out2)  # Write and run radiance simulations from Radiance recipes.

# group: calculate DF
code_block_3 = CodeBlock(illum=run_radiance_simulation.results, skyIlum=set_sky_to_overcast) { illum / skyIlum * 100; }

code_block_4 = CodeBlock { 1; {"min", 5}; }
code_block_5 = CodeBlock { 1; }
lb_color_range = Custom[LB Color Range](index=code_block_5)  # A set of color ranges for coloring analysis results
legend_parameters = Custom[Legend Parameters](cType=code_block_4.out0, domain=code_block_4.out1, colors=lb_color_range.colors)  # Use legend parameter to set up results visualization setting
generate_colors = Custom[Generate Colors](values=code_block_3, legendPar=legend_parameters.legendPar)  # Color a test surface based on the results of a study. The results structure should match the test points structure to be mapped correctly on the surface.
byGeometryColor = Display.Display.ByGeometryColor(byPatch, generate_colors.colors)
