# Grasshopper definition 01_gridbased_analysis.gh (Grasshopper 0.9.76)
# plug-ins: Python Interpreter

# ---- group: geometry
brep = Brep([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])
radglassmaterial = HoneybeePlus_RadianceGlassMaterial(name="g_material", TVis=".6")  # -> material; plug-in component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
preview = CustomPreview(Geometry=brep, Shader=ColourSwatch(SwatchColor=RGBA(65, 114, 255, 72)))
panel = Panel(radglassmaterial)
hbsurface = HoneybeePlus_HoneybeeSurface(type="5", radMat=radglassmaterial)  # -> readMe, HBSrf; plug-in component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

# ---- group: geometry / opaque surfaces
brep_2 = Brep([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])
wires = BrepWireframe(Brep=brep_2, Density=-1)
preview_2 = CustomPreview(Geometry=wires, Shader=ColourSwatch(SwatchColor=RGB(0, 0, 0)))
hbsurface_2 = HoneybeePlus_HoneybeeSurface(geo=brep_2)  # -> readMe, HBSrf; plug-in component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

# ---- group: geometry / context!
brep_3 = Brep([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])
debrep = DeconstructBrep(Brep=brep_3)  # -> flatten(Faces), Edges, Vertices
hbsurface_3 = HoneybeePlus_HoneybeeSurface(geo=debrep.Faces)  # -> readMe, HBSrf; plug-in component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

# ----
constructlocation = Ladybug_ConstructLocation(locationName="unknown_Location", latitude="36", longitude=0, timeZone=0, elevation=0)  # -> location; plug-in component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
brep_4 = Brep([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])
gentestpts = Honeybee_GenerateTestPoints(testGeometry=brep_4, gridSize="1", distBaseSrf=Slider(0.762, range=0..1), moveTestMesh=True)  # -> readMe, simplify(testPoints), simplify(ptsVectors), simplify(facesArea), simplify(mesh); plug-in component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
wires_2 = BrepWireframe(Brep=brep_4, Density=-1)
panel_2 = Panel("""room_a
room_b""")
panel_3 = Panel("12")
panel_4 = Panel("21")
graft = GraftTree(Tree=panel_2, IncludeEmptyLists=True, IncludeNullItems=True)
ciesky = HoneybeePlus_CIEStandardSky(location=constructlocation, month=6, day=21, hour="9", skyType=0)  # -> sky; plug-in component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
analysisgrid = HoneybeePlus_AnalysisGrid(name=graft, testPoints=gentestpts.testPoints, ptsVectors=gentestpts.ptsVectors)  # -> analysisGrid; plug-in component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
panel_5 = Panel(ciesky)
flatten = FlattenTree(Tree=analysisgrid, Path="{0}")
panel_6 = Panel(flatten)

# ---- group: analysis recipe
gridbasedrecipe = HoneybeePlus_GridBasedRecipe(sky=ciesky, analysisGrids=flatten, analysisType=0)  # -> analysisRecipe; plug-in component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

# ----
analysisgrid_2 = HoneybeePlus_AnalysisGrid()  # -> analysisGrid; plug-in component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
panel_7 = Panel(gridbasedrecipe)

# ---- group: visualizeGeometry
python = PythonScript()  # -> geo; inputs HBObjs: list
# ---------- python: Python ----------
geo = (hbo.geometry for hbo in HBObjs if hasattr(hbo, 'geometry'))
# ---------- end python ----------

# ----
toggle = BooleanToggle(False)
data = Data(flatten([hbsurface_3.HBSrf, hbsurface_2.HBSrf]))
panel_8 = Panel("500")
runradiance = HoneybeePlus_RunRadianceAnalysis(analysisRecipe=gridbasedrecipe, HBObjects=data, folder="c:\ladybug", name="workshop", write=toggle, run=toggle)  # -> readMe, legendPar, results; plug-in component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
panel_9 = Panel(runradiance.results)

# ---- group: temporary solution until ladybug[+] is ready!
python_2 = PythonScript(x=runradiance.legendPar)  # -> a, b, c, d
# ---------- python_2: Python ----------
from System.Drawing import Color
a = x.domain[0]
b = x.domain[-1]
c = 11
d = (Color.FromArgb(1, c.r, c.g, c.b) for c in x.colors)
# ---------- end python_2 ----------

# ---- group: hourly values
python_3 = PythonScript(grid=runradiance.results)  # -> readMe, illuminance; inputs hoy: Int32
# ---------- python_3: Python ----------
if _grid:
    from ladybug.dt import DateTime
    
    hoy = _hoy_ or 12
    
    try:
        states = eval(blinds_state_)
    except:
        states = None
    
    if _grid.isResultsPointInTime:
        
        print('Data is only available for {}'.format(DateTime.fromHoy(_grid.hoys[0])))
        illuminance = (p.combinedValueById(_grid.hoys[0], states)[0] for p in _grid)
    else:
        illuminance = (p.combinedValueById(hoy, states)[0] for p in _grid)
# ---------- end python_3 ----------

# ----
legendpar = Ladybug_LegendParameters(lowBound=python_2.a, highBound=python_2.b, numSegments=python_2.c, customColors=flatten(python_2.d))  # -> legendPar; plug-in component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
panel_10 = Panel(python_3.readMe)
flatten_2 = FlattenTree(Tree=gentestpts.mesh, Path="{0}")
flatten_3 = FlattenTree(Tree=python_3.illuminance, Path="{0}")
mjoin = MeshJoin(Meshes=flatten_2)
recolormesh = Ladybug_RecolorMesh(analysisResult=flatten_3, inputMesh=mjoin, legendPar=legendpar)  # -> readMe, newMesh, newLegend, legendBasePt, meshColors, legendColors; plug-in component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
ladybug = Ladybug_Ladybug()  # -> Vviiiiiiiiiizzz; plug-in component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
