# Grasshopper definition 02_imagebased_analysis.gh (Grasshopper 0.9.76)
# plug-ins: Python Interpreter, Embryo

ladybug = Ladybug_Ladybug()  # -> Vviiiiiiiiiizzz; plug-in component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
constructlocation = Ladybug_ConstructLocation(locationName="unknown_Location", latitude="27", longitude=0, timeZone=0, elevation=0)  # -> location; plug-in component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
panel = Panel("12")
panel_2 = Panel("9")
panel_3 = Panel("21")
number_slider = Slider(23, range=0..100)
crv = Curve(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)
ciesky = HoneybeePlus_CIEStandardSky(location=constructlocation, month=6, day=21, skyType=0)  # -> sky; plug-in component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
panel_4 = Panel(ciesky)
end = EndPoints(Curve=crv)  # -> Start, End
radopaquematerial = HoneybeePlus_RadianceOpaqueMaterial(name="wall", reflect=".55", spec=0, rough=0)  # -> material; plug-in component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
panel_5 = Panel("""1
2
3
4
5""")
radglassmaterial = HoneybeePlus_RadianceGlassMaterial(name="g_material", TVis=".6")  # -> material; plug-in component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
brep = Brep(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)
vec2pt = Vector2Pt(PointA=end.Start, PointB=end.End, Unitize=False)  # -> Vector, Length
panel_6 = Panel(radopaquematerial)
panel_7 = Panel(radglassmaterial)
view = HoneybeePlus_View(
    name="indoor_view",
    vLocation=end.Start,
    vDirection=vec2pt.Vector,
    vUpVector=Point(0, 0, 1),
    viewType=0,
    hViewAngle="120",
    vViewAngle=45,
    xResolution="800",
    yResolution="800")  # -> view; plug-in component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
brep_2 = Brep([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])
preview = CustomPreview(Geometry=brep, Shader=ColourSwatch(SwatchColor=RGBA(211, 208, 255, 64)))
wires = BrepWireframe(Brep=brep, Density=-1)
brep_3 = Brep(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)
brep_4 = Brep([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])
wires_2 = BrepWireframe(Brep=brep_4, Density=-1)
debrep = DeconstructBrep(Brep=[brep_2, brep_3])  # -> flatten(Faces), Edges, Vertices
brep_5 = Brep(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)
hbsurface = HoneybeePlus_HoneybeeSurface(geo=brep, name="glass_wall", radMat=radglassmaterial)  # -> readMe, HBSrf; plug-in component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
panel_8 = Panel(view)
debrep_2 = DeconstructBrep(Brep=brep_5)  # -> Faces, Edges, Vertices
hbsurface_2 = HoneybeePlus_HoneybeeSurface(geo=debrep.Faces, type=Slider(6, range=0..10))  # -> readMe, HBSrf; plug-in component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
hbsurface_3 = HoneybeePlus_HoneybeeSurface(geo=brep_4, name=panel_5, radMat=radopaquematerial)  # -> readMe, HBSrf; plug-in component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
hbsurface_4 = HoneybeePlus_HoneybeeSurface(geo=debrep_2.Faces)  # -> readMe, HBSrf; plug-in component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

# ---- group: analysis recipe
imagebasedrecipe = HoneybeePlus_ImageBasedRecipe(sky=ciesky, views=view, analysisType=2)  # -> analysisRecipe; plug-in component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

# ---- group: visualizeGeometry
python = PythonScript(HBObjs=hbsurface.HBSrf)  # -> geo; inputs HBObjs: list
# ---------- python: Python ----------
geo = (hbo.geometry for hbo in HBObjs if hasattr(hbo, 'geometry'))
# ---------- end python ----------

# ----
panel_9 = Panel(hbsurface_3.HBSrf)
panel_10 = Panel(imagebasedrecipe)
hbtorad = HoneybeePlus_WriteHBObjectsToRadiance(hbObjects=hbsurface_2.HBSrf, folder="c:\ladybug\untitled", filename="context", write=Toggle(True))  # -> radFile; plug-in component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

panel_11 = Panel("C:\Users\Administrator\Documents\GitHub\honeybee-plus\plugin\grasshopper")
exportladybug = Ladybug_ExportLadybug(targetFolder=panel_11, export=Toggle(True))  # -> readMe; plug-in component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

radscene = HoneybeePlus_RadianceScene(radFiles=hbtorad, copyLocal=True, overwrite=False)  # -> radScene; plug-in component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
data = Data(flatten([hbsurface_3.HBSrf, hbsurface.HBSrf, hbsurface_4.HBSrf]))
number_slider_2 = Slider(2, range=0..10)
panel_12 = Panel(radscene)
toggle = BooleanToggle(False)
runradiance = HoneybeePlus_RunRadianceAnalysis(analysisRecipe=imagebasedrecipe, HBObjects=data, folder="c:\ladybug", name="untitled", write=toggle, run=toggle)  # -> readMe, results; plug-in component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
panel_13 = Panel(runradiance.readMe)
hdr_tif = Honeybee_ConvertHDRToTIF(HDRFilePath=runradiance.results, adjustExposure=Toggle(True))  # -> TIFFFilePath; plug-in component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
number_slider_3 = Slider(0.5, range=0..1)
honeybee = Honeybee_Honeybee()  # -> Vviiiiiiiiiizzz; plug-in component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
image = ImageFromPath(P=hdr_tif, S=1)

# ---- group: change the path to honeybeex folder
panel_14 = Panel("C:\Users\Administrator\Documents\GitHub\")
panel_15 = Panel("""ladybug
honeybee
honeybee-plus""")

# ----
concat = Concatenate(FragmentA=panel_14, FragmentB=panel_15)

# ---- group: change the path to honeybeex folder (continued)
python_2 = PythonScript(path_to_honeybee_libs=concat)  # -> readMe; inputs path_to_honeybee_libs: list
# ---------- python_2: Python ----------
import sys

if path_to_honeybee_libs:
    for p in path_to_honeybee_libs:
        sys.path.append(p)

import honeybee_grasshopper
import honeybee
import honeybee.hbsurface
# ---------- end python_2 ----------
