# Grasshopper definition 03_daylight_coefficient_daylight_analysis.gh (Grasshopper 0.9.76)
# plug-ins: Python Interpreter

radopaquematerial = HoneybeePlus_RadianceOpaqueMaterial(name="wall", reflect=".55", spec=0, rough=0)  # -> material; plug-in component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
panel = Panel("""1
2
3
4
5""")
radglassmaterial = HoneybeePlus_RadianceGlassMaterial(name="g_material", TVis=".6")  # -> material; plug-in component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
brep = Brep(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)
brep_2 = Brep(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)
path = FilePath("C:\EnergyPlusV8-3-0\WeatherData\USA_CA_San.Francisco.Intl.AP.724940_TMY3.epw")
panel_2 = Panel(radopaquematerial)
wires = BrepWireframe(Brep=brep_2, Density=-1)
gentestpts = Honeybee_GenerateTestPoints(testGeometry=brep_2, gridSize=".5", distBaseSrf=Slider(0.762, range=0..1), moveTestMesh=True)  # -> readMe, simplify(testPoints), simplify(ptsVectors), simplify(facesArea), simplify(mesh); plug-in component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
panel_3 = Panel(radglassmaterial)
preview = CustomPreview(Geometry=brep, Shader=ColourSwatch(SwatchColor=RGBA(211, 208, 255, 64)))
wires_2 = BrepWireframe(Brep=brep, Density=-1)
brep_3 = Brep([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])
wea = HoneybeePlus_Wea(epwFile=path)  # -> wea; plug-in component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
wires_3 = BrepWireframe(Brep=brep_3, Density=-1)
brep_4 = Brep(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)
hbsurface = HoneybeePlus_HoneybeeSurface(geo=brep, name="glass_wall", radMat=radglassmaterial)  # -> readMe, HBSrf; plug-in component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
skymatrix = HoneybeePlus_SkyMatrix(north=0, wea=wea, skyDensity=1)  # -> skyMTX; plug-in component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
points = PointList(Points=gentestpts.testPoints)
debrep = DeconstructBrep(Brep=brep_4)  # -> Faces, Edges, Vertices
analysisgrid = HoneybeePlus_AnalysisGrid(testPoints=gentestpts.testPoints, ptsVectors=gentestpts.ptsVectors)  # -> analysisGrid; plug-in component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
hbsurface_2 = HoneybeePlus_HoneybeeSurface(geo=brep_3, name=panel, radMat=radopaquematerial)  # -> readMe, HBSrf; plug-in component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
hbsurface_3 = HoneybeePlus_HoneybeeSurface(geo=debrep.Faces)  # -> readMe, HBSrf; plug-in component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

# ---- group: visualizeGeometry
python = PythonScript(HBObjs=hbsurface.HBSrf)  # -> geo; inputs HBObjs: list
# ---------- python: Python ----------
geo = (hbo.geometry for hbo in HBObjs if hasattr(hbo, 'geometry'))
# ---------- end python ----------

# ----
panel_4 = Panel(hbsurface_2.HBSrf)
skyvector = HoneybeePlus_SkyVector(north=0, wea=wea, month=6, day=21, hour="6")  # -> skyVec; plug-in component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
dcoeffgbrecipe = HoneybeePlus_DCGridBasedDaylightRecipe(skyMTX=skyvector, analysisGrids=analysisgrid, analysisType=0, reuseDaylightMTX=True)  # -> analysisRecipe; plug-in component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
data = Data(flatten([hbsurface.HBSrf, hbsurface_2.HBSrf, hbsurface_3.HBSrf]))
panel_5 = Panel(dcoeffgbrecipe)
toggle = BooleanToggle(True)
runradiance = HoneybeePlus_RunRadianceAnalysis(analysisRecipe=dcoeffgbrecipe, HBObjects=data, folder="c:\ladybug", name="untitled", write=toggle, run=toggle)  # -> readMe, results; plug-in component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
panel_6 = Panel(runradiance.readMe)
panel_7 = Panel("test room")
number_slider = Slider(10000, range=0..10000)
panel_8 = Panel("100")
legendpar = Ladybug_LegendParameters(highBound="100")  # -> legendPar; plug-in component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

# ---- group: get daylight autonomy
python_2 = PythonScript(workingHours="9 To 17", threshold=300, minUsefulIllum=100, maxUsefulIllum=2000)  # -> DA, CDA, UDI, less, more; inputs results: list, threshold: Int32, minUsefulIllum: Int32, maxUsefulIllum: Int32
# ---------- python_2: Python ----------
if _results and _results[0]:
    stTime, endTime = _workingHours_
    _DA = [0] * len(_results[0])
    _CDA = [0] * len(_results[0])
    _UDI =  [0] * len(_results[0])
    _less =  [0] * len(_results[0])
    _more =  [0] * len(_results[0])
    nOfHours = 0
    for HOY, result in enumerate(_results):
        if not stTime <= HOY % 24 < endTime:
            continue
        nOfHours += 1
        for ptCount, ill in enumerate(result):
            _ill = float(ill)
            if _ill >= _threshold_:
                _DA[ptCount] += 1
                _CDA[ptCount] += 1
            else:
                _CDA[ptCount] += _ill /_threshold_
            
            if _ill < _minUsefulIllum_:
                _less[ptCount] += 1
            elif _ill > _maxUsefulIllum_:
                _more[ptCount] += 1
            else:
                _UDI[ptCount] += 1
    
    # divide values by the number of hours
    DA = (v / nOfHours * 100 for v in _DA)
    CDA = (v / nOfHours * 100 for v in _CDA)
    UDI = (v / nOfHours * 100 for v in _UDI)
    less = (v / nOfHours * 100 for v in _less)
    more = (v / nOfHours * 100 for v in _more)
# ---------- end python_2 ----------

# ---- group: get annual results for an hour of year
python_3 = PythonScript(results=runradiance.results, hoy="0")  # -> illuminance; inputs results: list, hoy: Int32
# ---------- python_3: Python ----------
if _results and _results[0] and _hoy is not None:
    illuminance = (float(i) for i in _results[_hoy])
# ---------- end python_3 ----------

# ----
ladybug = Ladybug_Ladybug()  # -> Vviiiiiiiiiizzz; plug-in component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
legendpar_2 = Ladybug_LegendParameters(lowBound="0", highBound="2000")  # -> legendPar; plug-in component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
recolormesh = Ladybug_RecolorMesh(analysisResult=python_3, inputMesh=gentestpts.mesh, legendPar=legendpar_2)  # -> readMe, newMesh, newLegend, legendBasePt, meshColors, legendColors; plug-in component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

# ---- group: change the path to honeybeex folder
panel_9 = Panel("""ladybug
honeybee
honeybee-plus""")
panel_10 = Panel("C:\Users\Administrator\Documents\GitHub\")

# ----
concat = Concatenate(FragmentA=panel_10, FragmentB=panel_9)

# ---- group: change the path to honeybeex folder (continued)
python_4 = PythonScript(path_to_honeybee_libs=concat)  # -> readMe; inputs path_to_honeybee_libs: list
# ---------- python_4: Python ----------
import sys

if path_to_honeybee_libs:
    for p in path_to_honeybee_libs:
        sys.path.append(p)

import honeybee_grasshopper
import honeybee
import honeybee.hbsurface
# ---------- end python_4 ----------
