# Grasshopper definition 03_three_phase_daylight_analysis.gh (Grasshopper 0.9.76)
# plug-ins: Python Interpreter

radglassmaterial = HoneybeePlus_RadianceGlassMaterial(name="g_material", TVis=".6")  # -> material; plug-in component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
panel = Panel(radglassmaterial)
radopaquematerial = HoneybeePlus_RadianceOpaqueMaterial(name="wall", reflect=".55", spec=0, rough=0)  # -> material; plug-in component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
panel_2 = Panel("""1
2
3
4
5""")
brep = Brep(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)
brep_2 = Brep(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)
panel_3 = Panel("C:\Users\Administrator\Documents\GitHub\honeybee\tests\room\xmls\diffuse50.xml")
panel_4 = Panel("C:\Users\Administrator\Documents\GitHub\honeybee\tests\room\xmls\clear.xml")
preview = CustomPreview(Geometry=brep, Shader=ColourSwatch(SwatchColor=RGBA(211, 208, 255, 64)))
panel_5 = Panel(radopaquematerial)
wires = BrepWireframe(Brep=brep_2, Density=-1)
brep_3 = Brep([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])
gentestpts = Honeybee_GenerateTestPoints(testGeometry=brep_2, gridSize="2", distBaseSrf=Slider(0.762, range=0..1), moveTestMesh=True)  # -> readMe, simplify(testPoints), simplify(ptsVectors), simplify(facesArea), simplify(mesh); plug-in component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
wires_2 = BrepWireframe(Brep=brep, Density=-1)

# ---- group: change the path to honeybeex folder
panel_6 = Panel("""C:\Users\Administrator\Documents\GitHub\honeybee
C:\Users\Administrator\Documents\GitHub\honeybee-plus""")
python = PythonScript(path_to_honeybee_libs=panel_6)  # -> readMe; inputs path_to_honeybee_libs: list
# ---------- python: Python ----------
import sys

if path_to_honeybee_libs:
    for p in path_to_honeybee_libs:
        sys.path.append(p)

import honeybee
import honeybee_grasshopper
import honeybee.hbsurface
# ---------- end python ----------

# ----
wires_3 = BrepWireframe(Brep=brep_3, Density=-1)
radbsdfmaterial = HoneybeePlus_RadianceBSDFMaterial(xmlfile=[panel_4, panel_3], upOrientation=Vector(0.01, 0.01, 1), thickness=0)  # -> material; plug-in component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

hbwinsrf = HoneybeePlus_HoneybeeWindowSurface(geo=brep, name="north_glass")  # -> readMe, HBWindowSrf; plug-in component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

brep_4 = Brep(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)
panel_7 = Panel("C:\Users\Administrator\Documents\GitHub\honeybee-plus\plugin\grasshopper")
points = PointList(Points=gentestpts.testPoints)
path = FilePath("C:\EnergyPlusV8-3-0\WeatherData\USA_CA_San.Francisco.Intl.AP.724940_TMY3.epw")
debrep = DeconstructBrep(Brep=brep_4)  # -> Faces, Edges, Vertices
analysisgrid = HoneybeePlus_AnalysisGrid(testPoints=gentestpts.testPoints)  # -> analysisGrid; plug-in component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
skymatrix = HoneybeePlus_SkyMatrix(epwFile=path, skyDensity=1)  # -> skyMTX; plug-in component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
hbsurface = HoneybeePlus_HoneybeeSurface(geo=brep_3, name=panel_2, radMat=radopaquematerial)  # -> readMe, HBSrf; plug-in component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
hbsurface_2 = HoneybeePlus_HoneybeeSurface(geo=debrep.Faces)  # -> readMe, HBSrf; plug-in component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
exportladybug = Ladybug_ExportLadybug(targetFolder=panel_7, export=Toggle(True))  # -> readMe; plug-in component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

# ---- group: visualizeGeometry
python_2 = PythonScript()  # -> geo; inputs HBObjs: list
# ---------- python_2: Python ----------
geo = (hbo.geometry for hbo in HBObjs if hasattr(hbo, 'geometry'))
# ---------- end python_2 ----------

# ----
hbwindowgroup = HoneybeePlus_HoneybeeWindowGroup(name="group_1", bsdfMaterials=radbsdfmaterial, HBWindowSrfs=hbwinsrf.HBWindowSrf)  # -> HBWindowGroup; plug-in component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
threephaserecipe = HoneybeePlus_ThreePhaseDaylightRecipe(skyMTX=skymatrix, analysisGrid=analysisgrid, reuseViewMTX=True, reuseDaylightMTX=True)  # -> analysisRecipe; plug-in component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
honeybee = Honeybee_Honeybee()  # -> Vviiiiiiiiiizzz; plug-in component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
brep_5 = Brep(<brep referenced from the Rhino model>)
data = Data(flatten([hbsurface_2.HBSrf, hbsurface.HBSrf, hbwindowgroup]))
panel_8 = Panel("test room")
python_3 = PythonScript(x=brep_5)  # -> out, a
# ---------- python_3: Python ----------
import Rhino as rc

def extractSurfacePoints(geometry, triangulate=False, meshingParameters=None):
    """Calculate list of points for a HBSurface.

    For planar surfaces the length of the list will be only 1. For non-planar
    surfaces or surfaces with internal edges it will be a number of lists.

    Args:
        geometry: A Mesh or Brep
        triangulate: If set to True the function returns the points for triangulated
            surfaces (Default: False)
        meshingParameters: Optional Rhino meshingParameters. This will only be used if the
            surface is non-planar or has an internal edge and needs to be meshed.
            Default:
                Rhino.Geometry.MeshingParameters.Coarse; SimplePlanes = True for planar surfaces
                Rhino.Geometry.MeshingParameters.Smooth for non-planar surfaces
    Returns:
        A list of point lists. For planar surfaces the length of the list will be
        only 1. For non-planar surfaces or surfaces with internal edges it will be
        a number of lists.
    """
    assert isinstance(geometry, rc.Geometry.GeometryBase), \
        TypeError("Input surface should be a Mesh or a Brep not {}.".format(type(geometry)))

    assert not isinstance(geometry, rc.Geometry.Mesh), \
        NotImplementedError("Extracting points for mesh surfaces hasn't been implemented.")
    
    meshingParameters = meshingParameters or rc.Geometry.MeshingParameters.Coarse
    meshingParameters.SimplePlanes = True
    pts = geometry.DuplicateVertices()
    # sort points anti clockwise
    # this is only important for energy simulation and won't make a difference
    # for Radiance

    # To sort the points we find border of the surface and evaluate points
    # on border and use the parameter value to sort them
    border = rc.Geometry.Curve.JoinCurves(geometry.DuplicateEdgeCurves(True))
    
    if len(border) == 1:
        pointsSorted = sorted(pts, key=lambda pt: border[0].ClosestPoint(pt)[1])
        # make sure points are anti clockwise
        if not isPointsSortedAntiClockwise(
            pointsSorted, getSurfaceCenterPtandNormal(geometry).normalVector):
            pointsSorted.reverse()

        # return sorted points
        # Wrap in a list as Honeybee accepts list of list of points
        return (pointsSorted,)
    else:
        # mesh the surface
        mesh = rc.Geometry.Mesh.CreateFromBrep(geometry, meshingParameters)[0]
        return tuple(tuple(rc.Geometry.Point3d(mesh.Vertices[i]) for i in face) for face in mesh.Faces)

a = extractSurfacePoints(x)
# ---------- end python_3 ----------
panel_9 = Panel(hbwindowgroup)
python_4 = PythonScript(x=threephaserecipe)  # -> out, a
# ---------- python_4: Python ----------
print x.subFolder
# ---------- end python_4 ----------
item = ListItem(List=python_3.a, Index=Slider(0, range=0..10), Wrap=True)
number_slider = Slider(7, range=7..20)
panel_10 = Panel(threephaserecipe)
panel_11 = Panel(python_4.out)
item_2 = ListItem(List=item, Index=0, Wrap=True)
runradiance = HoneybeePlus_RunRadianceAnalysis(analysisRecipe=threephaserecipe, HBObjects=data, folder="c:\ladybug", name="test_1", write=Toggle(False))  # -> readMe, results; plug-in component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
points_2 = PointList(Points=item_2, Size=Slider(1, range=0..10))
number_slider_2 = Slider(10000, range=0..10000)
doy_hoy = Ladybug_DOY_HOY(days="21", months="8", hours=number_slider)  # -> HOY, DOY, date; plug-in component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
panel_12 = Panel("100")
importlocation = Ladybug_ImportLocation(epwFile=path)  # -> location; plug-in component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
panel_13 = Panel(doy_hoy.HOY)

# ---- group: get daylight autonomy
python_5 = PythonScript(results=runradiance.results, workingHours="9 To 17", threshold=300, minUsefulIllum=100, maxUsefulIllum=2000)  # -> DA, CDA, UDI, less, more; inputs results: list, threshold: Int32, minUsefulIllum: Int32, maxUsefulIllum: Int32
# ---------- python_5: Python ----------
if _results and _results[0]:
    stTime, endTime = _workingHours_
    _DA = [0] * len(_results[0])
    _CDA = [0] * len(_results[0])
    _UDI =  [0] * len(_results[0])
    _less =  [0] * len(_results[0])
    _more =  [0] * len(_results[0])
    nOfHours = 0
    for HOY, result in enumerate(_results):
        if not stTime <= HOY % 24 < endTime:
            continue
        nOfHours += 1
        for ptCount, ill in enumerate(result):
            _ill = float(ill)
            if _ill >= _threshold_:
                _DA[ptCount] += 1
                _CDA[ptCount] += 1
            else:
                _CDA[ptCount] += _ill /_threshold_
            
            if _ill < _minUsefulIllum_:
                _less[ptCount] += 1
            elif _ill > _maxUsefulIllum_:
                _more[ptCount] += 1
            else:
                _UDI[ptCount] += 1
    
    # divide values by the number of hours
    DA = (v / nOfHours * 100 for v in _DA)
    CDA = (v / nOfHours * 100 for v in _CDA)
    UDI = (v / nOfHours * 100 for v in _UDI)
    less = (v / nOfHours * 100 for v in _less)
    more = (v / nOfHours * 100 for v in _more)
# ---------- end python_5 ----------

# ----
sunpath = Ladybug_SunPath(
    location=importlocation,
    hour=number_slider,
    day="21",
    month="8",
    timeStep=1,
    sunPathScale=".25",
    dailyOrAnnualSunPath=True)  # -> readMe, sunVectors, sunAltitudes, sunAzimuths, port, sunSpheresMesh, sunPathCrvs, legend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; plug-in component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

# ---- group: get annual results for an hour of year
python_6 = PythonScript(results=runradiance.results, hoy=panel_13)  # -> illuminance; inputs results: list, hoy: Int32
# ---------- python_6: Python ----------
if _results and _results[0] and _hoy:
    illuminance = (float(i) for i in _results[_hoy])
# ---------- end python_6 ----------

# ----
panel_14 = Panel(runradiance.readMe)
recolormesh = Ladybug_RecolorMesh(analysisResult=python_6, inputMesh=gentestpts.mesh)  # -> readMe, newMesh, newLegend, legendBasePt, meshColors, legendColors; plug-in component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
ladybug = Ladybug_Ladybug()  # -> Vviiiiiiiiiizzz; plug-in component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
legendpar = Ladybug_LegendParameters(highBound="100")  # -> legendPar; plug-in component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
