# Grasshopper definition 04_daylight_coefficient_daylight_analysis_Image.gh (Grasshopper 0.9.76)
# plug-ins: Python Interpreter, Embryo

brep = Brep(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)
brep_2 = Brep([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])
panel = Panel("""north_glass_1
north_glass_2""")
preview = CustomPreview(Geometry=brep, Shader=ColourSwatch(SwatchColor=RGBA(211, 208, 255, 64)))
preview_2 = CustomPreview(Geometry=brep_2, Shader=ColourSwatch(SwatchColor=RGBA(211, 208, 255, 64)))
hbwinsrf = HoneybeePlus_HoneybeeWindowSurface(geo=brep_2, name=panel)  # -> readMe, HBWindowSrf; plug-in component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

# ---- group: This window will be it's own group
hbwinsrf_2 = HoneybeePlus_HoneybeeWindowSurface(geo=brep, name="skylight")  # -> readMe, HBWindowSrf; plug-in component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

# ----
wires = BrepWireframe(Brep=brep_2, Density=-1)
path = FilePath("C:\EnergyPlusV8-3-0\WeatherData\USA_CA_San.Francisco.Intl.AP.724940_TMY3.epw")
brep_3 = Brep([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])
pt = Point(Point(1, 1, 2))
pt_2 = Point(Point(5, 4, 2))
series = Series(Start="12", Step=1, Count="2")
wea = HoneybeePlus_Wea(epwFile=path)  # -> wea; plug-in component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
ln = Line(StartPoint=pt, EndPoint=pt_2)
panel_2 = Panel("""1
2
3
4
5
6""")
wires_2 = BrepWireframe(Brep=brep_3, Density=-1)
vec = Vector(ln)
skymatrix = HoneybeePlus_SkyMatrix(north=0, wea=wea, skyDensity=1, hoys=series)  # -> skyMTX; plug-in component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
preview_3 = CustomPreview(Geometry=wires_2, Shader=ColourSwatch(SwatchColor=RGB(0, 0, 0)))
view = HoneybeePlus_View(
    name="inside_NE",
    vLocation=pt,
    vDirection=vec,
    vUpVector=Point(0, 0, 1),
    viewType=0,
    hViewAngle=45,
    vViewAngle=45,
    xResolution="500",
    yResolution="500")  # -> view; plug-in component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
panel_3 = Panel("15")
hbsurface = HoneybeePlus_HoneybeeSurface(geo=brep_3, name=panel_2)  # -> readMe, HBSrf; plug-in component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
panel_4 = Panel("""15
16
17""")
skyvector = HoneybeePlus_SkyVector(north=0, wea=wea, month=6, day=21, hour=12)  # -> skyVec; plug-in component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
dcoeffgbrecipe = HoneybeePlus_DCImageBasedDaylightRecipe(skyMTX=skyvector, views=view, analysisType=2, reuseDaylightMTX=True)  # -> analysisRecipe; plug-in component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
panel_5 = Panel("C:\Users\Administrator\Documents\GitHub\honeybee-plus\plugin\grasshopper")
data = Data(flatten([hbsurface.HBSrf, hbwinsrf_2.HBWindowSrf, hbwinsrf.HBWindowSrf]))
toggle = BooleanToggle(False)
python = PythonScript()  # -> out, a
# ---------- python: Python ----------
from ladybug.dt import LBDateTime

h = LBDateTime.fromHOY(20)
print h.date()
# ---------- end python ----------
runradiance = HoneybeePlus_RunRadianceAnalysis(analysisRecipe=dcoeffgbrecipe, HBObjects=data, folder="c:\ladybug", name="untitled", write=toggle, run=toggle)  # -> readMe, results; plug-in component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
ladybug = Ladybug_Ladybug()  # -> Vviiiiiiiiiizzz; plug-in component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
honeybee = Honeybee_Honeybee()  # -> Vviiiiiiiiiizzz; plug-in component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
exportladybug = Ladybug_ExportLadybug(targetFolder=panel_5, export=Toggle(True))  # -> readMe; plug-in component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
falsecolor = Honeybee_FalseColor(contourBands=False, maskThreshold=0.1, useAlterColors=False, render=Toggle(False))  # -> outputFilePath; plug-in component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
panel_6 = Panel(runradiance.readMe)
hdr_tif = Honeybee_ConvertHDRToTIF(HDRFilePath=runradiance.results, adjustExposure=Toggle(True))  # -> TIFFFilePath; plug-in component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
bang = ExplodeTree(Data=hdr_tif)  # -> Branch0, Branch1, Branch2
image = ImageFromPath(P=hdr_tif, S=1)

# ---- group: change the path to honeybeex folder
panel_7 = Panel("""ladybug
honeybee
honeybee-plus""")
panel_8 = Panel("C:\Users\Administrator\Documents\GitHub\")

# ----
concat = Concatenate(FragmentA=panel_8, FragmentB=panel_7)

# ---- group: change the path to honeybeex folder (continued)
python_2 = PythonScript(path_to_honeybee_libs=concat)  # -> readMe; inputs path_to_honeybee_libs: list
# ---------- python_2: Python ----------
import sys

if path_to_honeybee_libs:
    for p in path_to_honeybee_libs:
        sys.path.append(p)

import honeybee_grasshopper
import honeybee
import honeybee.hbsurface
# ---------- end python_2 ----------
