# Grasshopper definition 05_three_phase_daylight_analysis.gh (Grasshopper 0.9.76)
# plug-ins: Python Interpreter

panel = Panel("C:\Users\Mostapha\Documents\code\ladybug-tools\honeybee\tests\room\xmls\")
concat = Concatenate(FragmentA=panel, FragmentB="clear.xml")
concat_2 = Concatenate(FragmentA=panel, FragmentB="diffuse50.xml")
merge = Merge(Data1=concat, Data2=concat_2)
radbsdfmaterial = HoneybeePlus_RadianceBSDFMaterial(xmlfile=merge, upOrientation=Vector(0.01, 0.01, 1), thickness=0)  # -> material; plug-in component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
item = ListItem(List=radbsdfmaterial, Index=0, Wrap=True)  # -> Item, Item1
brep = Brep(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)
brep_2 = Brep([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])
path = FilePath("C:\EnergyPlusV8-6-0\WeatherData\USA_VA_Sterling-Washington.Dulles.Intl.AP.724030_TMY3.epw")
preview = CustomPreview(Geometry=brep, Shader=ColourSwatch(SwatchColor=RGBA(211, 208, 255, 64)))
wires = BrepWireframe(Brep=brep_2, Density=-1)
preview_2 = CustomPreview(Geometry=brep_2, Shader=ColourSwatch(SwatchColor=RGBA(211, 208, 255, 64)))
hbwingroupstate = HoneybeePlus_WindowGroupState(name="diffuse", radMat=item.Item1)  # -> report, state; plug-in component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
wea = HoneybeePlus_Wea(epwFile=path)  # -> wea; plug-in component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
panel_2 = Panel("group_1")

# ---- group: This window will be it's own group
hbwingroup = HoneybeePlus_HoneybeeWindowGroup(geo=brep, name="skylight", radMat=item.Item)  # -> report, HBWinGroup; plug-in component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

# ----
brep_3 = Brep(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)
wires_2 = BrepWireframe(Brep=brep_3, Density=-1)
gentestpts = Honeybee_GenerateTestPoints(testGeometry=brep_3, gridSize="2", distBaseSrf=Slider(0.762, range=0..1), moveTestMesh=True)  # -> readMe, simplify(testPoints), simplify(ptsVectors), simplify(facesArea), simplify(mesh); plug-in component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
brep_4 = Brep([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])
panel_3 = Panel("""12
13
14
15""")
hbwingroup_2 = HoneybeePlus_HoneybeeWindowGroup(geo=brep_2, name="north_windows", radMat=item.Item, states=hbwingroupstate.state)  # -> report, HBWinGroup; plug-in component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
wires_3 = BrepWireframe(Brep=brep_4, Density=-1)
skymatrix = HoneybeePlus_SkyMatrix(north=0, wea=wea, skyDensity=1)  # -> skyMTX; plug-in component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
skyvector = HoneybeePlus_SkyVector(north=0, wea=wea, month="6", day=21, hour="6")  # -> skyVec; plug-in component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
points = PointList(Points=gentestpts.testPoints)
panel_4 = Panel(hbwingroup_2.HBWinGroup)
preview_3 = CustomPreview(Geometry=wires_3, Shader=ColourSwatch(SwatchColor=RGB(0, 0, 0)))

# ---- group: context!
brep_5 = Brep([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])
hbsurface = HoneybeePlus_HoneybeeSurface(geo=brep_5, type="6")  # -> report, HBSrf; plug-in component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

# ----
hbsurface_2 = HoneybeePlus_HoneybeeSurface(geo=brep_4, name="room_surface")  # -> report, HBSrf; plug-in component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
toggle = BooleanToggle(False)
analysisgrid = HoneybeePlus_AnalysisGrid(name="room_w_skylight", testPoints=gentestpts.testPoints, ptsVectors=gentestpts.ptsVectors)  # -> analysisGrid; plug-in component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
panel_5 = Panel(hbsurface_2.HBSrf)
threephasegbrecipe = HoneybeePlus_GridBasedThreePhaseDaylightRecipe(skyMTX=skymatrix, analysisGrid=analysisgrid, analysisType=0, reuseViewMTX=toggle, reuseDaylightMTX=toggle)  # -> analysisRecipe; plug-in component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
hbtorad = HoneybeePlus_WriteHBObjectsToRadiance(hbObjects=hbsurface.HBSrf, folder="c:\ladybug\untitled", filename="threePhase_context.rad", write=Toggle(True))  # -> radFile; plug-in component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
radscene = HoneybeePlus_RadianceScene(radFiles=hbtorad, copyLocal=True, overwrite=True)  # -> radScene; plug-in component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

# ---- group: visualizeGeometry
python = PythonScript()  # -> geo; inputs HBObjs: list
# ---------- python: Python ----------
geo = (hbo.geometry for hbo in HBObjs if hasattr(hbo, 'geometry'))
# ---------- end python ----------

# ----
data = Data(flatten([hbsurface_2.HBSrf, hbwingroup.HBWinGroup, hbwingroup_2.HBWinGroup]))
toggle_2 = BooleanToggle(False)
runradiance = HoneybeePlus_RunRadianceAnalysis(
    analysisRecipe=threephasegbrecipe,
    HBObjects=data,
    radScene=radscene,
    folder="c:\ladybug",
    name="discussion",
    write=toggle_2,
    run=toggle_2)  # -> readMe, legendPar, results; plug-in component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
panel_6 = Panel(runradiance.readMe)
data_2 = Data(runradiance.results)
panel_7 = Panel(data_2)
number_slider = Slider(3, range=0..10)
number_slider_2 = Slider(10, range=0..10)
panel_8 = Panel("""0, 0
1, 0
0, -1
1, -1""")
python_2 = PythonScript(grid=data_2, id=Slider(5, range=0..10))  # -> position, sensor; inputs id: Int32
# ---------- python_2: Python ----------
import Rhino.Geometry.Point3d as P
import Rhino.Geometry.Sphere as S
if _grid:
    id = _id_ or 0
    sensor = _grid[id]
    p = P(sensor.location.x, sensor.location.y, sensor.location.z)
    position = S(p, 0.5)
# ---------- end python_2 ----------
panel_9 = Panel(panel_8)

# ---- group: temporary solution until ladybug[+] is ready!
python_3 = PythonScript(x=runradiance.legendPar)  # -> a, b, c, d
# ---------- python_3: Python ----------
from System.Drawing import Color
if x:
    a = x.domain[0]
    b = x.domain[-1]
    c = 11
    d = (Color.FromArgb(1, c.r, c.g, c.b) for c in x.colors)
# ---------- end python_3 ----------

# ----
panel_10 = Panel("""(0, 0)
(0, -1)
(-1, 0)""")
# Configuaration
# Sensor and scheudle
python_4 = PythonScript(sensor=python_2.sensor, logic="ill > 3000")  # -> report, blinds_state, blinds_index, illum, illum_dir, success; inputs combs: list, data: list
# ---------- python_4: Python ----------
import copy

if _sensor:
    sensor = _sensor
    
    # print the details to help user set up the 
    print(sensor.details)
    
    if _logic_:
    
        logic = compile('r = {}'.format(_logic_), '<string>', 'exec')
        data = data_
        def checkLogic(ill, ill_dir, hour, *data, **kwargs):
            exec(logic)
            return r
    
        setattr(sensor, 'logic', checkLogic)
    else:
        setattr(sensor, 'logic', sensor._logic)

#    states = tuple(eval(t) for t in _combs_)
#    print states
    results = sensor.blindsState(sensor.hoys, _combs_)
    if results:
        blinds_state = (str(d) for d in results[0])  # tuple is not a standard GH Type
        blinds_index = results[1]
        illum = results[2]
        illum_dir = results[3]
        success = results[4]
# ---------- end python_4 ----------
legendpar = Ladybug_LegendParameters(lowBound=python_3.a, highBound=python_3.b, numSegments=python_3.c, customColors=flatten(python_3.d))  # -> legendPar; plug-in component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
repeat = RepeatData(Data="(0, -1)", Length="8760")

# ---- group: hourly values
python_5 = PythonScript(grid=data_2, hoy=Slider(10, range=0..10), blinds_state=panel_10)  # -> illuminance; inputs hoy: Int32
# ---------- python_5: Python ----------
if _grid and _hoy:
    try:
        states = eval(blinds_state_)
    except:
        states = None
    illuminance = (p.combinedValueById(_hoy, states)[0] for p in _grid)
# ---------- end python_5 ----------

# ----
panel_11 = Panel(python_4.report)

# ---- group: office schedule
python_6 = PythonScript()  # -> schedule
# ---------- python_6: Python ----------
from honeybee.schedule import Schedule

schedule = Schedule.fromAnalysisPeriod()
# ---------- end python_6 ----------

# ----
panel_12 = Panel("""Total
Group I Contribution
Skylight Contribution""")

# ---- group: annual metrics
python_7 = PythonScript(grid=data_2, UDI_min_max="100 To 3000", blinds_state=python_4.blinds_state, occSchedule=python_6)  # -> report, DA, CDA, UDI, UDI_less, UDI_more; inputs blinds_state: list
# ---------- python_7: Python ----------
if _grid:
    states = tuple(eval(t) for t in blinds_state_)
    DA, CDA, UDI, UDI_less, UDI_more = \
        _grid.annualMetrics(_DA_thresholds_, _UDI_min_max_, states,
                            _occSchedule_)
# ---------- end python_7 ----------

# ----
graft = GraftTree(Tree=panel_12, IncludeEmptyLists=True, IncludeNullItems=True)

# ---- group: hourly values
python_8 = PythonScript(grid=data_2, hoy=Slider(11, range=0..100), blinds_state="(1,0)")  # -> illuminance; inputs hoy: Int32
# ---------- python_8: Python ----------
if _grid and _hoy:
    illuminance = (p.combinedValueById(_hoy, eval(blinds_state_))[0] for p in _grid)
# ---------- end python_8 ----------

# ----
recolormesh = Ladybug_RecolorMesh(analysisResult=python_5, inputMesh=gentestpts.mesh, legendPar=legendpar, analysisTitle=graft, legendTitle="lux")  # -> readMe, newMesh, newLegend, legendBasePt, meshColors, legendColors; plug-in component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
ladybug = Ladybug_Ladybug()  # -> Vviiiiiiiiiizzz; plug-in component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
recolormesh_2 = Ladybug_RecolorMesh(analysisResult=python_8, inputMesh=gentestpts.mesh, legendPar=legendpar, legendTitle="lux")  # -> readMe, newMesh, newLegend, legendBasePt, meshColors, legendColors; plug-in component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
panel_13 = Panel("""0
20
20""")
panel_14 = Panel("""0
7
-7""")

panel_15 = Panel(panel_9)
gradientlibrary = Ladybug_GradientLibrary(gradIndex="15")  # -> customColors; plug-in component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
lng = ListLength(List=panel_15)
subtraction = Subtraction(A=lng, B=1)
legendpar_2 = Ladybug_LegendParameters(highBound=subtraction, numSegments=lng, customColors=flatten(gradientlibrary))  # -> legendPar; plug-in component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
legendpar_3 = Ladybug_LegendParameters(lowBound="-1", highBound="1", numSegments="3")  # -> legendPar; plug-in component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
legendpar_4 = Ladybug_LegendParameters(highBound="2000")  # -> legendPar; plug-in component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
_3dchart = Ladybug_3DChart(inputData=flatten(python_4.blinds_index), basePoint="{0, -150, 0}", xScale="0.1", yScale="0.5", legendPar=legendpar_2)  # -> readMe, graphMesh, graphCurves, legend, legendBasePts, title, titleBasePts, dataPts, conditionalHOY; plug-in component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
_3dchart_2 = Ladybug_3DChart(inputData=flatten(python_4.success), basePoint="{0, -300, 0}", xScale="0.1", yScale="0.5", legendPar=legendpar_3)  # -> readMe, graphMesh, graphCurves, legend, legendBasePts, title, titleBasePts, dataPts, conditionalHOY; plug-in component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
_3dchart_3 = Ladybug_3DChart(
    inputData=flatten(python_4.illum),
    basePoint="{0, -450, 0}",
    xScale="0.1",
    yScale="0.5",
    zScale=Slider(0, range=0..100),
    legendPar=legendpar_4)  # -> readMe, graphMesh, graphCurves, legend, legendBasePts, title, titleBasePts, dataPts, conditionalHOY; plug-in component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

vec = VectorXYZ(XComponent=panel_13, YComponent=panel_14, ZComponent=0)  # -> graft(Vector), Length
move = Move(Geometry=recolormesh.newMesh, Motion=vec.Vector)  # -> Geometry, Transform
move_2 = Move(Geometry=recolormesh.newLegend, Motion=vec.Vector)  # -> Geometry, Transform
