# Dynamo custom node Honeybee Surface.dyf (Dynamo 1.2.0.2690)
# category: Honeybee.00 :: Honeybee :: Core
# Create a Honeybee surface, which can be plugged into the "Run Daylight Sumilation" component.
# Not available in the currant version for Dynamo but this surface can be combined with other surfaces to make HBZones with the "Create Honeybee Zone" node.

# group: load the script
code_block = CodeBlock { "Honeybee"; "honeybeeSurface_node.py"; }

import_and_prepare_py_code = Python(IN[0]=code_block.out0, IN[1]=code_block.out1)
# ---------- import_and_prepare_py_code.python (78 lines) ----------
"""Find packages from Dynamo folder and prepare the code."""
import clr
from System import AppDomain, Environment, IO

def tryGetPluginPath(plugin):
    """Try to get path to plugin folder."""
    clr.AddReference('ProtoGeometry')
    _loc = tuple(a.Location
                 for a in AppDomain.CurrentDomain.GetAssemblies()
                 if 'ProtoGeometry' in a.FullName)

    try:
        _ver = float(_loc[0].split('\\')[-2])
    except:
        _ver = float(_loc[0].split('\\')[-2].split(' ')[-1])

    assert _ver >= 1.2, 'You need Dynamo 1.2 or higher to use this plugin!'

    _appdata = Environment.GetFolderPath(Environment.SpecialFolder.ApplicationData)
    _dynamoPath = ('\\').join(_loc[0].split('\\')[-4:-1])
    # if the assembly is cached put Revit folder first, and then try to load it from core
    _dynamoPaths = (_dynamoPath.replace('Dynamo Core', 'Dynamo Revit'),
                    _dynamoPath.replace('Dynamo Revit', 'Dynamo Core'))
    _settingsFilename = 'DynamoSettings.xml'
    
    pkf = []
    for path in _dynamoPaths:
        settingsFile = IO.Path.Combine(_appdata, path, _settingsFilename)
        if not IO.File.Exists(settingsFile):
            continue
        with open(settingsFile, 'rb') as outf:
            for line in outf:
                if line.strip().startswith('<CustomPackageFolders>'):
                    for l in outf:
                        if l.strip().startswith('</CustomPackageFolders>'):
                            break
                        else:
                            pkf.append(l.replace('</string>', '').replace('<string>', '').strip())

    for p in pkf:
        pp = IO.Path.Combine(p, 'packages', plugin, 'extra')
        if IO.Directory.Exists(pp):
            return pp

try:
    plugin, filename = IN
    p = tryGetPluginPath(plugin)
    if not p:
        raise ImportError('{} is not installed! Install it from package manager.'.format(plugin))
    # import the file and wrap it into sys.append
    f = IO.Path.Combine(p, 'nodesrc', filename)
    with open(f, 'rb') as inf:
        source = '    '.join(inf.readlines())

    header = 'try:\n    import sys\n' + \
        '    sys.path.append(r\'{}\')\n\n'.format(p) + \
        '    sys.path.append(r\'C:\Program Files (x86)\IronPython 2.7\Lib\')\n\n' + \
        '    '

    footer = '\nexcept Exception, e:\n' + \
        '    import traceback\n' + \
        '    OUT = "ERROR:\\n\\t{}".format(str(e)) + \\\n' + \
        '    "\\n\\nIf you think this is a bug submit an issue on github.\\n" + \\\n' + \
        '    "https://github.com/ladybug-analysis-tools/honeybee-plus/issues\\n" +  \\\n' + \
        '    "and include below error message:\\n\\n" + \\\n' + \
        '    "{}".format(traceback.format_exc())\n'

    OUT = header + source + footer

except Exception, e:
    import sys
    sys.path.append(r'C:\Program Files (x86)\IronPython 2.7\Lib')
    import traceback
    OUT = "ERROR:\n\t{}".format(str(e)) + \
        "\n\nIf you think this is a bug submit an issue on github.\n" + \
        "https://github.com/ladybug-analysis-tools/honeybee-plus/issues\n" +  \
        "and include below error message:\n\n" + \
        "{}".format(traceback.format_exc())
# ----------------------------------------
geometry = Input()  # "_geometry"; A single surface or list of surfaces
name = Input(_name_:string=null)  # An optional name for this surface
type = Input(_type_:double=null)  # An optional input for surface type. If not indicated it will be assigned based on normal vector angle. 0.0: Wall           0.5: UndergroundWall 1.0: Roof           1.5: UndergroundCeiling 2.0: Floor          2.25: UndergroundSlab 2.5: SlabOnGrade    2.75: ExposedFloor 3.0: Ceiling        4.0: AirWall 5.0: Window         6.0: Context
code_block_2 = CodeBlock { "radianceProperties_node.py"; }
find_file_and_import_it = Python(IN[0]=code_block_2)
# ---------- find_file_and_import_it.python (37 lines) ----------
try:
	def getPackagePath(packageName):
		import sys
		sys.path.append('C:\Program Files (x86)\IronPython 2.7\Lib')
		import os
		import clr
		clr.AddReference('DynamoCore')
		_loc = clr.References[2].Location
		_ver = _loc.split('\\')[-2].split(' ')[-1]
		
		# the path structure has changed after the release of version 1
		dynamoPath_1 = "Dynamo\\Dynamo Revit\\" + _ver
		dynamoPath_0 = "Dynamo\\" + _ver
		appdata = os.getenv('APPDATA')
		path1 = r'%s\%s\packages\%s\extra\nodesrc\\'%(appdata, dynamoPath_1, packageName)
		path0 = r'%s\%s\packages\%s\extra\nodesrc\\'%(appdata, dynamoPath_0, packageName)
		
		if os.path.isdir(path1):
			return path1
		elif os.path.isdir(path0):
			return path0
		else:
			raise Exception("Can't find Dynamo installation Folder!")

	filePath = getPackagePath('Honeybee') + IN[0]

	with open(filePath, 'rb') as inf:
	    lines = inf.readlines()

	OUT = ''.join(lines)
except Exception, e:
	import traceback
	OUT = "ERROR:\n%s" % str(e) + \
		"\n\nIf you think this is a bug submit an issue on github.\n" + \
		"https://github.com/ladybug-analysis-tools/ladybug-dynamo/issues" + \
		"\n\n%s" % traceback.format_exc()
		
# ----------------------------------------
radianceMaterial = Input(_radianceMaterial_:System.Object=null)  # An optional radiance material If not indicated it will be assigned based on surface type If surface type is not indicated it will be calculated based on normal vector angle.
python_script_from_string = PythonStringNode(script=find_file_and_import_it, IN[0]=radianceMaterial)
code_block_3 = CodeBlock()
# ---------- code_block_3.designscript (2 lines) ----------
//EPParameters - will be added later
null;
# ----------------------------------------
python_script_from_string_2 = PythonStringNode(script=import_and_prepare_py_code, IN[0]=geometry, IN[1]=name, IN[2]=type, IN[3]=python_script_from_string, IN[4]=code_block_3)
honeybeeSurface = Output(python_script_from_string_2)  # A list of honeybee surfaces
error_report = Python(IN[0]=import_and_prepare_py_code, IN[1]=python_script_from_string_2)
# ---------- error_report.python (15 lines) ----------
"""Report errors"""
importErr = IN[0]
runErr = IN[1]
errors = []

if importErr and str(importErr).startswith("ERROR:"):
	errors.append(importErr)

if runErr and str(runErr).startswith("ERROR:"):
	errors.append(runErr)

if len(errors)==0:
	OUT = "All good! Vvizzzz."
else:
	OUT = "\n".join(errors)
# ----------------------------------------
ERRReport = Output(error_report)  # Report
