# Dynamo custom node Run Radiance Simulation.dyf (Dynamo 1.0.0.1180)
# category: Honeybee.04 :: Daylight :: Analysis
# Write and run radiance simulations from Radiance recipes.

# group: load the script
code_block = CodeBlock { "runRadianceSimulation_node.py"; }

find_file_and_import_it = Python(IN[0]=code_block)
# ---------- find_file_and_import_it.python (37 lines) ----------
try:
	def getPackagePath(packageName):
		import sys
		sys.path.append('C:\Program Files (x86)\IronPython 2.7\Lib')
		import os
		import clr
		clr.AddReference('DynamoCore')
		_loc = clr.References[2].Location
		_ver = _loc.split('\\')[-2].split(' ')[-1]
		
		# the path structure has changed after the release of version 1
		dynamoPath_1 = "Dynamo\\Dynamo Revit\\" + _ver
		dynamoPath_0 = "Dynamo\\" + _ver
		appdata = os.getenv('APPDATA')
		path1 = r'%s\%s\packages\%s\extra\nodesrc\\'%(appdata, dynamoPath_1, packageName)
		path0 = r'%s\%s\packages\%s\extra\nodesrc\\'%(appdata, dynamoPath_0, packageName)
		
		if os.path.isdir(path1):
			return path1
		elif os.path.isdir(path0):
			return path0
		else:
			raise Exception("Can't find Dynamo installation Folder!")

	filePath = getPackagePath('Honeybee') + IN[0]

	with open(filePath, 'rb') as inf:
	    lines = inf.readlines()

	OUT = ''.join(lines)
except Exception, e:
	import traceback
	OUT = "ERROR:\n%s" % str(e) + \
		"\n\nIf you think this is a bug submit an issue on github.\n" + \
		"https://github.com/ladybug-analysis-tools/ladybug-dynamo/issues" + \
		"\n\n%s" % traceback.format_exc()
		
# ----------------------------------------
analysisRecipe = Input(_analysisRecipe:System.Object = null)  # A Radiance Analysis Recipe
honeybeeObjects = Input()  # "_honeybeeObjects"; List of honeybee surfaces or zones
workingDir = Input(_workingDir_:string = null)  # Path to working directory default: c:/users/[username]/honeybee
projectName = Input(_projectName_:string = null)  # Name for this project. defult: unnamed.
write = Input(_write:bool = false)  # Write files to folder
run = Input(run_:bool = false)  # Run the analysis
python_script_from_string = PythonStringNode(script=find_file_and_import_it, IN[0]=analysisRecipe, IN[1]=honeybeeObjects, IN[2]=workingDir, IN[3]=projectName, IN[4]=write, IN[5]=run)
results = Output(python_script_from_string)  # Results of the analysis
error_report = Python(IN[0]=find_file_and_import_it, IN[1]=python_script_from_string)
# ---------- error_report.python (15 lines) ----------
"""Report errors"""
importErr = IN[0]
runErr = IN[1]
errors = []

if importErr and str(importErr).startswith("ERROR:"):
	errors.append(importErr)

if runErr and str(runErr).startswith("ERROR:"):
	errors.append(runErr)

if len(errors)==0:
	OUT = "All good! Vvizzzz."
else:
	OUT = "\n".join(errors)
# ----------------------------------------
ERRReport = Output(error_report)  # Report
