# Dynamo custom node Sunlighthours Analysis Recipe.dyf (Dynamo 1.0.0.1180)
# category: Honeybee.03 :: Daylight :: Recipes
# Calculate number of direct sunlight hours.

# group: load the script
code_block = CodeBlock { "sunlighthoursAnalysisRecipe_node.py"; }

find_file_and_import_it = Python(IN[0]=code_block)
# ---------- find_file_and_import_it.python (37 lines) ----------
try:
	def getPackagePath(packageName):
		import sys
		sys.path.append('C:\Program Files (x86)\IronPython 2.7\Lib')
		import os
		import clr
		clr.AddReference('DynamoCore')
		_loc = clr.References[2].Location
		_ver = _loc.split('\\')[-2].split(' ')[-1]
		
		# the path structure has changed after the release of version 1
		dynamoPath_1 = "Dynamo\\Dynamo Revit\\" + _ver
		dynamoPath_0 = "Dynamo\\" + _ver
		appdata = os.getenv('APPDATA')
		path1 = r'%s\%s\packages\%s\extra\nodesrc\\'%(appdata, dynamoPath_1, packageName)
		path0 = r'%s\%s\packages\%s\extra\nodesrc\\'%(appdata, dynamoPath_0, packageName)
		
		if os.path.isdir(path1):
			return path1
		elif os.path.isdir(path0):
			return path0
		else:
			raise Exception("Can't find Dynamo installation Folder!")

	filePath = getPackagePath('Honeybee') + IN[0]

	with open(filePath, 'rb') as inf:
	    lines = inf.readlines()

	OUT = ''.join(lines)
except Exception, e:
	import traceback
	OUT = "ERROR:\n%s" % str(e) + \
		"\n\nIf you think this is a bug submit an issue on github.\n" + \
		"https://github.com/ladybug-analysis-tools/ladybug-dynamo/issues" + \
		"\n\n%s" % traceback.format_exc()
		
# ----------------------------------------
sunVectors = Input()  # "_sunVectors"; A list of sun vectors. Use Ladybug sunpath component to calculate sun vectors.
testPoints = Input()  # "_testPoints"; A list or list of list of points. Each point indicates the location of a sensor.
ptsNormal = Input()  # "_ptsNormal"; A list or list of list of Vectors. Each vector indicates the direction of a sensor.
timestep = Input(_timestep_:int = 1)  # Timestep
python_script_from_string = PythonStringNode(script=find_file_and_import_it, IN[0]=sunVectors, IN[1]=testPoints, IN[2]=ptsNormal, IN[3]=timestep)
sunlighthoursAnalysisRecipe = Output(python_script_from_string)  # Sunlighthours analysis recipe
error_report = Python(IN[0]=find_file_and_import_it, IN[1]=python_script_from_string)
# ---------- error_report.python (15 lines) ----------
"""Report errors"""
importErr = IN[0]
runErr = IN[1]
errors = []

if importErr and str(importErr).startswith("ERROR:"):
	errors.append(importErr)

if runErr and str(runErr).startswith("ERROR:"):
	errors.append(runErr)

if len(errors)==0:
	OUT = "All good! Vvizzzz."
else:
	OUT = "\n".join(errors)
# ----------------------------------------
ERRReport = Output(error_report)  # Report
