# Grasshopper definition honeybee_daylight.gh (Grasshopper 0.9.76)
# plug-ins: Python Interpreter, Human UI, Human

ladybug = Ladybug_Ladybug()  # -> Vviiiiiiiiiizzz; plug-in component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
honeybee = Honeybee_Honeybee()  # -> Vviiiiiiiiiizzz; plug-in component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

toggle = CreateToggle(Default=False, OnLabel="Stop", OffLabel="Run")
toggle_2 = CreateToggle(Default=False, OnLabel="Remove Honeybee Surfaces", OffLabel="Create Honeybee Surfaces")

# ---- group: 0::Scene
callfromlibrary = Honeybee_CallFromRadianceLibrary()  # -> materials; plug-in component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
layertable = LayerTable(Update=True, AutoUpdate=Toggle(True))  # -> Layers, FullLayerPaths, LayerColors, Linetypes, MaterialNames, Visible, PrintWidth, PrintColor
data = Data(callfromlibrary)
lng = ListLength(List=data)
range = Range(Domain=Domain(0, 1), Steps=expr("x - 1", lng))
checkbox = CreateCheckbox(Label=layertable.Layers, StartingValue=Toggle(True))
lng_2 = ListLength(List=checkbox)
gradient = Gradient(
    LowerLimit=0,
    UpperLimit=1,
    Parameter=range,
    stops=[0: RGB(243, 57, 0), 0.1: RGB(236, 27, 60), 0.2: RGB(210, 0, 118), 0.3: RGB(103, 0, 120), 0.4: RGB(39, 72, 161), 0.5: RGB(1, 192, 229), 0.6: RGB(18, 178, 90), 0.7: RGB(79, 186, 8), 0.8: RGB(220, 237, 32), 0.9: RGB(247, 159, 20), 1: RGB(243, 57, 0)])
rectangle = Rectangle(Plane=PlaneXY(0, 0, 0), XSize="-10 To -20", YSize="-10 To -20", Radius=0)  # -> Rectangle, Length
dup = DuplicateData(Data=data, Number=lng_2, Order=True)
dup_2 = DuplicateData(Data=rectangle.Rectangle, Number=lng_2, Order=True)  # -> graft(Data)
partition = PartitionList(List=dup, Size=lng)  # -> simplify(Chunks)
item = ListItem(List=gradient, Index="0", Wrap=True)  # -> graft(Item)
shape = CreateShape(Shape=dup_2, FillColor=item, StrokeColor=RGB(0, 0, 0), Scale=1)  # -> flatten(Shape)
pulldown = CreatePulldownMenu(ListItems=partition, SelectedIndex="0")  # -> flatten(Pulldown)
pipeline = GeometryPipeline(
    GroupByLayer=False,
    GroupByType=False,
    IncludeHidden=True,
    IncludeLocked=True,
    LayerFilter="*",
    NameFilter="*",
    TypeFilter=1073741880)
weave = Weave(Pattern=[0, 1, 2], Stream0=shape, Stream1=flatten(checkbox), Stream2=flatten(pulldown), NullGaps=False)
objatts = ObjectAttributes(ObjectOrAttributes=pipeline)  # -> Name, LayerName, LayerFullPath, Color, MaterialName, LinetypeName, GroupIndices, PlotWeight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
partition_2 = PartitionList(List=weave, Size="3")
_3dview = Create3DView(MeshToDisplay=pipeline, MeshColors=objatts.Color, ViewWidth="425", ViewHeight=300)
label = CreateLabel(LabelText="1. Pick layers and materials", LabelSize=18, Justification=0)
stack = CreateStack(UIElements=partition_2, Horizontal=True)  # -> flatten(Stack)
label_2 = CreateLabel(LabelText="Radiance scene. Objects are colored based on materials.", LabelSize=12, Justification=1)
textbox = CreateTextBox(UpdateButton=False)
adjustpos = AdjustElementPositioning(ElementsToAdjust=stack, Margin="30, 0, 0, 0", AbsolutePositioning=False, HorizontalAlignment=0)
merge = Merge(Data1=label, Data2=flatten(stack), Data3=flatten(_3dview), Data4=label_2)

# ----
panel = Panel("""            0 - Original Ladybug
            1 - Nuanced Ladybug
            2 - Multi-colored Ladybug
            3 - View Analysis 1
            4 - View Analysis 2 (Red,Green,Blue)
            5 - Sunlight Hours
            6 - Ecotect
            7 - Thermal Comfort Percentage
            8 - Thermal Comfort Colors
            9 - Thermal Comfort Colors (UTCI)
            10 - Hot Hours
            11 - Cold Hours
            12 - Shade Benefit/Harm
            13 - Thermal Comfort Colors v2 (UTCI)
            14 - Shade Harm
            15 - Shade Benefit
            16 - Black to White
            17 - CFD Colors 1
            18 - CFD Colors 2
            19 - Energy Balance
            20 - THERM
            21 - Cloud Cover
            22 - Glare Potential
            23 - Radiation Benefit""")
textbox_2 = CreateTextBox(Label="Higher bound", DefaultText="500", UpdateButton=True)
textbox_3 = CreateTextBox(Label="Lower bound", DefaultText="0", UpdateButton=True)
pulldown_2 = CreatePulldownMenu(ListItems=panel)
stack_2 = CreateStack(UIElements=flatten([textbox_3, textbox_2]), Horizontal=True)

button = CreateButton(ButtonName="Clear selection", ButtonStyle=0)
button_2 = CreateButton(ButtonName="Pick analyis surface", ButtonStyle=0)
tb = CreateTextBlock(Text="...", TextSize=12, Justification=0)

# ---- group: Run
panel_2 = Panel("Check this box to create honeybee surfaces from the selected layers.")
panel_3 = Panel("""Run the analysis
Visualization
Report""")
label_3 = CreateLabel(LabelText=panel_3, LabelSize=18, Justification=0)
tb_2 = CreateTextBlock(Text="...", TextSize=12, Justification=0)
item_2 = ListItem(List=label_3, Index=0, Wrap=True)  # -> Item, Item1, Item2
checkbox_2 = CreateCheckbox(Label=panel_2, StartingValue=Toggle(False))
merge_2 = Merge(
    Data1=flatten(item_2.Item),
    Data2=flatten(toggle_2),
    Data3=flatten(toggle),
    Data4=flatten(item_2.Item1),
    Data5=flatten(stack_2),
    Data6=flatten(pulldown_2),
    Data7=flatten(item_2.Item2),
    Data8=flatten(tb_2),
    Data9=flatten(tb))

# ----
pan = Panel("""0::Scene
1::Recipe
2::Run""")
launchwin = LaunchWindow(Show=Toggle(True), Name="Honeybee[rh]-Daylighting", Width="425", Height="650", ChildStatus=1, EnableHorizScroll=False)

# ---- group: Scene
values = ValueListener(Elements=checkbox, SomeProperty=True)  # -> flatten(Values), Indices
values_2 = ValueListener(Elements=pulldown, SomeProperty=True)  # -> flatten(Values), Indices
values_3 = ValueListener(Elements=toggle_2, SomeProperty=True)  # -> flatten(Values), Indices
panel_4 = Panel("""Brep
Mesh
Extrusion""")
int = Integer(values_3.Values)
mdispatch = DispatchMultiple(DispatchPattern=values.Values, List0=layertable.Layers, List1=values_2.Values)  # -> List0, List1
not = GateNot(A=values.Values)
hideshow = HideShowElement(ElementToHideShow=pulldown, Show=True, Collapse=False, Disable=not)
dpipeline = DynamicGeometryPipeline(
    LayerFilter=mdispatch.List0,
    TypeFilter=panel_4,
    NameFilter="*",
    enableFullPath=False,
    GroupByLayer=False,
    GroupByType=False,
    IncludeHidden=True,
    IncludeLocked=True,
    listenToAttriubtes=True)
lng_3 = ListLength(List=dpipeline)
larger = LargerThan(FirstNumber=lng_3, SecondNumber=0)  # -> flatten(LargerThan), OrEqualTo
clean = CleanTree(RemoveNulls=True, RemoveInvalid=True, RemoveEmpty=True, Tree=dpipeline)
mdispatch_2 = DispatchMultiple(DispatchPattern=larger.LargerThan, List0=mdispatch.List1)  # -> List0, List1
graft = GraftTree(Tree=mdispatch_2.List0, IncludeEmptyLists=True, IncludeNullItems=True)  # -> simplify(Tree)
fsim = FindSimilarMember(Data=flatten(graft), Set=flatten(data))  # -> Hit, Index
fsim_2 = FindSimilarMember(Data=flatten(values_2.Values), Set=flatten(data))  # -> Hit, Index
gate = StreamGate(Stream=clean, Gate=int)  # -> Target0, Target1
item_3 = ListItem(List=gradient, Index=fsim.Index, Wrap=True)
item_4 = ListItem(List=gradient, Index=fsim_2.Index, Wrap=True)
lng_4 = ListLength(List=clean)
graft_2 = GraftTree(Tree=item_3, IncludeEmptyLists=True, IncludeNullItems=True)  # -> simplify(Tree)
dup_3 = DuplicateData(Data=graft_2, Number=lng_4, Order=True)
setshape = SetShape(ShapeToModify=shape, FillColor=item_4, StrokeColor=RGB(0, 0, 0), Scale=1)
argb = SplitARGB(Colour=flatten(dup_3))  # -> Alpha, Red, Green, Blue
createhbsrfs = Honeybee_createHBSrfs(geometry=gate.Target1, RADMaterial=graft)  # -> readMe, simplify(flatten(HBSurface)); plug-in component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
frgb = ColourRGBF(Alpha="0.8", Red=argb.Red, Green=argb.Green, Blue=argb.Blue)
set3dview = Set3DView(_3DView=_3dview, MeshToDisplay=flatten(clean), MeshColors=flatten(frgb))
flatten = FlattenTree(Tree=createhbsrfs.readMe, Path="{0}")
panel_5 = Panel("")
join = TextJoin(Text=flatten, Join=panel_5)
filter = StreamFilter(Gate=int, Stream0="...", Stream1=join)
settextblock = SetTextBlockContents(TextBlockToModify=tb, NewTextBlockContents=filter)

# ----
values_4 = ValueListener(Elements=toggle, SomeProperty=True)  # -> Values, Indices
bool = Boolean(values_4.Values)
geo = Geometry(createhbsrfs.HBSurface)
values_5 = ValueListener(Elements=pulldown_2, SomeProperty=True)  # -> Values, Indices
values_6 = ValueListener(Elements=textbox_3, SomeProperty=True)  # -> Values, Indices
values_7 = ValueListener(Elements=textbox_2, SomeProperty=True)  # -> Values, Indices
gradientlibrary = Ladybug_GradientLibrary(gradIndex=values_5.Indices)  # -> customColors; plug-in component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
legendpar = Ladybug_LegendParameters(lowBound=values_6.Values, highBound=values_7.Values, customColors=flatten(gradientlibrary))  # -> legendPar; plug-in component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

panel_6 = Panel("""JAN
FEB
MAR
APR
MAY
JUN
JUL
AUG
SEP
OCT
NOV
DEC""")
panel_7 = Panel("""Month
Day
Hour""")
panel_8 = Panel("""[0] illuminance (lux)
[1] radiation (kwh)
[2] luminance (Candela)""")
series = Series(Start="1", Step=1, Count="31")
docunits = ConvertToDocumentUnits(ValueString="0.5m")
docunits_2 = ConvertToDocumentUnits(ValueString="0.75m")
int_2 = Integer(series)
textbox_4 = CreateTextBox(Label="Distance from surface", DefaultText=docunits_2, UpdateButton=True)
textbox_5 = CreateTextBox(Label="Grid Size", DefaultText=docunits, UpdateButton=True)
label_4 = CreateLabel(LabelText=panel_7, LabelSize=12, Justification=0)
pulldown_3 = CreatePulldownMenu(ListItems=int_2, SelectedIndex="20")
pulldown_4 = CreatePulldownMenu(ListItems=panel_6, SelectedIndex="2")
slider = CreateSlider(Slider=Slider(9, range=0..24), ShowBounds=False, ShowTicks=False, ShowTooltip=False, ShowValLabel=True)
item_5 = ListItem(List=label_4, Index=0, Wrap=True)  # -> Item, Item1, Item2
pulldown_5 = CreatePulldownMenu(ListItems=panel_8)
pulldown_6 = CreatePulldownMenu(ListItems="Climate-based Sky")
pulldown_7 = CreatePulldownMenu(ListItems="Grid based Analysis")
panel_9 = Panel("""1. Create Sky
2. Simulation Type
3. Create test points""")
merge_3 = Merge(
    Data1=flatten(item_5.Item),
    Data2=flatten(pulldown_4),
    Data3=item_5.Item1,
    Data4=flatten(pulldown_3),
    Data5=item_5.Item2,
    Data6=flatten(slider))
tb_3 = CreateTextBlock(Text="0 points are created.", TextSize=12, Justification=0)
toggle_3 = CreateToggle(Default=True, OnLabel="Hide points", OffLabel="Show points")
stack_3 = CreateStack(UIElements=flatten([textbox_5, textbox_4]), Horizontal=True)
stack_4 = CreateStack(UIElements=flatten(merge_3), Horizontal=True)
filepicker = CreateFilePicker(ButtonLabelText="Pick epw weather file", DialogType=0, MustExist=True, Filter="*.epw")
label_5 = CreateLabel(LabelText=panel_9, LabelSize=18, Justification=0)
item_6 = ListItem(List=label_5, Index=0, Wrap=True)  # -> Item, Item1, Item2

stack_5 = CreateStack(UIElements=flatten([button_2, toggle_3, button]), Horizontal=True)

merge_4 = Merge(
    Data1=flatten(pulldown_7),
    Data2=flatten(item_6.Item),
    Data3=flatten(pulldown_6),
    Data4=flatten(filepicker),
    Data5=flatten(stack_4),
    Data6=flatten(item_6.Item1),
    Data7=flatten(pulldown_5),
    Data8=flatten(item_6.Item2),
    Data9=flatten(stack_3),
    Data10=flatten(stack_5),
    Data11=flatten(tb_3))

tabs = TabbedView(TabNames=pan, TabTextSize="20", Tab0=flatten(merge), Tab1=flatten(merge_4), Tab2=flatten(merge_2))
addelems = AddElements(Window=launchwin, Elements=flatten(tabs), DoVLChecking=True)  # -> AddedElements, ElementNames

# ---- group: recipe
values_8 = ValueListener(Elements=button_2, SomeProperty=True)  # -> Values, Indices
values_9 = ValueListener(Elements=button, SomeProperty=True)  # -> Values, Indices
object_picker = CSharpScript(
    run=values_8.Values,
    allowMultiple=Toggle(True),
    allowNone=Toggle(True),
    msg="Pick analyis surface",
    clear=values_9.Values)  # -> pickedGeometry; inputs run: Boolean, allowMultiple: Boolean, allowNone: Boolean, msg: String, clear: Boolean
# ---------- object_picker: C# ----------
    if(run) getNewGeometry(msg, allowMultiple, allowNone);
    pickedGeometry = objIDs;
    if(clear) objIDs.Clear();
# ---------- object_picker: C# additional code ----------
  static List<Guid> objIDs = new List<Guid>();


  void getNewGeometry(string msg, bool allowMultiple, bool allowNone){
    ObjectType filter = ObjectType.AnyObject;

    ObjRef[] rhObjects = new ObjRef[1];


    try{
      Rhino.Commands.Result result = Rhino.Commands.Result.Cancel;
      if(!allowMultiple) {
        ObjRef rhObject;
        result = Rhino.Input.RhinoGet.GetOneObject(msg, allowNone, filter, out rhObject);
        rhObjects[0] = rhObject;

      } else {
        result = Rhino.Input.RhinoGet.GetMultipleObjects(msg, allowNone, filter, out rhObjects);
      }

      if(result == Rhino.Commands.Result.Cancel){

      } else if(result == Rhino.Commands.Result.Success){
        objIDs = rhObjects.Select(o => o.ObjectId).ToList();
        return;
      }
    } catch {

    }
  }
# ---------- end object_picker ----------
values_10 = ValueListener(Elements=filepicker, SomeProperty=True)  # -> Values, Indices
values_11 = ValueListener(Elements=pulldown_4, SomeProperty=True)  # -> Values, Indices
values_12 = ValueListener(Elements=pulldown_3, SomeProperty=True)  # -> Values, Indices
values_13 = ValueListener(Elements=slider, SomeProperty=True)  # -> Values, Indices
genclimatebasedsky = Honeybee_GenerateClimateBasedSky(weatherFile=values_10.Values, month=values_11.Indices, day=values_12.Values, hour=values_13.Values)  # -> radiationValues, skyFilePath; plug-in component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
values_14 = ValueListener(Elements=textbox_4, SomeProperty=True)  # -> Values, Indices
values_15 = ValueListener(Elements=textbox_5, SomeProperty=True)  # -> Values, Indices
gentestpts = Honeybee_GenerateTestPoints(testGeometry=object_picker, gridSize=values_15.Values, distBaseSrf=values_14.Values, moveTestMesh=True)  # -> readMe, simplify(testPoints), simplify(ptsVectors), simplify(facesArea), simplify(mesh); plug-in component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
values_16 = ValueListener(Elements=toggle_3, SomeProperty=True)  # -> Values, Indices
values_17 = ValueListener(Elements=pulldown_5, SomeProperty=True)  # -> Values, Indices
clean_2 = CleanTree(RemoveNulls=True, RemoveInvalid=True, RemoveEmpty=False, Tree=flatten(gentestpts.testPoints))
gridbasedsimulation = Honeybee_GridBasedSimulation(
    skyFile=genclimatebasedsky.skyFilePath,
    testPoints=gentestpts.testPoints,
    ptsVectors=gentestpts.ptsVectors,
    simulationType=values_17.Indices)  # -> analysisRecipe; plug-in component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
lng_5 = ListLength(List=flatten(clean_2))
filter_2 = StreamFilter(Gate=values_16.Values, Stream1=clean_2)
preview = CustomPreview(Geometry=filter_2, Shader=ColourSwatch(SwatchColor=RGB(44, 201, 255)))

# ----
lng_6 = ListLength(List=flatten(object_picker))

# ---- group: recipe (continued)
concat = Concatenate(FragmentA=lng_6, FragmentB=" surfaces are selected.", FragmentC=lng_5, FragmentD=" points are created.")
settextblock_2 = SetTextBlockContents(TextBlockToModify=tb_3, NewTextBlockContents=concat)

# ----
rundaylightanalysis = Honeybee_RunDaylightSimulation(HBObjects=flatten(geo), analysisRecipe=gridbasedsimulation, writeRad=bool, runRad=bool, overwriteResults=True)  # -> readMe, analysisType, resultsUnit, results, testPts, resultFiles, radGeoFile, studyFolder, done; plug-in component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

# ---- group: check if all the inputs are None
python = PythonScript(x=geo, epwfile=values_10.Values)  # -> out, isHBSrfGenerated, isReadyToRun; inputs x: list
# ---------- python: Python ----------
isHBSrfGenerated = not all(i is None for i in x)
if not isHBSrfGenerated:
    print('No honeybee surface is created!')

isReadyToRun =  isHBSrfGenerated and bool(epwfile)
# ---------- end python ----------

# ----
panel_10 = Panel(rundaylightanalysis.readMe)
not_2 = GateNot(A=python.isReadyToRun)
merge_5 = Merge(Data1=flatten(genclimatebasedsky.radiationValues), Data2=python.out)
hideshow_2 = HideShowElement(ElementToHideShow=toggle, Show=True, Collapse=False, Disable=not_2)
join_2 = TextJoin(Text=panel_10, Join=panel_5)
join_3 = TextJoin(Text=merge_5, Join=panel_5)
filter_3 = StreamFilter(Gate=bool, Stream0=join_3, Stream1=join_2)
settextblock_3 = SetTextBlockContents(TextBlockToModify=tb_2, NewTextBlockContents=filter_3)
recolormesh = Ladybug_RecolorMesh(
    analysisResult=rundaylightanalysis.results,
    inputMesh=gentestpts.mesh,
    legendPar=legendpar,
    analysisTitle=rundaylightanalysis.analysisType,
    legendTitle=rundaylightanalysis.resultsUnit)  # -> readMe, newMesh, newLegend, legendBasePt, meshColors, legendColors; plug-in component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
