# Dynamo graph 00_point_in_time_gridbased.dyn (Dynamo 1.3.0.875)

boolean = BoolSelector(true)
collect_rooms_and_spaces = Custom[Collect Rooms and Spaces](collect=boolean)  # Collect rooms and MEP spaces in the Revit document. Use "Rooms to HBZones" node to convert them to Honeybee zones.

# group: This component fails for complex geometries. In those cases you can create the model surface by surface. You can also vote at the link below here so Autodesk opens up the Room API, so we can get the openings without failure! http://forums.autodesk.com/t5/revit-ideas/ api-access-to-room-openings-geometry-and-materials-in-revit/ idi-p/6642406
rooms_to_hbzones = Custom[Rooms to HBZones](rooms=collect_rooms_and_spaces.rooms)  # Create Honeybee zones from Revit Rooms or MEPSpaces. This node currently ONLY collects geometrical data from Revit. In the future it will import constructions, materials and MEP data (e.g lighting power density).

code_block = CodeBlock { 500; 750; }
generate_test_points_from = Custom[Generate Test Points from HBZones](HBZones=rooms_to_hbzones.HBZones, gridSize=code_block.out0, disFromSurface=code_block.out1)  # Generate test points from Honeybee zones based on grid size.
byPatch = Surface.ByPatch(generate_test_points_from.polygons)
# note: This definition is using Honeybee and to run daylight analysis with Honeybee you need to install Radiance. Radiance can be downloaded and installed from this link:
# https://github.com/NREL/Radiance/releases/tag/5.2.0
file_path = Filename("..\..\..\..\..\..\..\..\EnergyPlusV8-6-0\WeatherData\USA_CA_San.Francisco.Intl.AP.724940_TMY3.epw")
wea = Custom[Wea](epwFile=file_path)  # epw2wea -
code_block_2 = CodeBlock { 16; }
climatebased_sky = Custom[Climatebased Sky](wea=wea.wea, hour=code_block_2)  # Climate-based Sky.
analysis_grid = Custom[Analysis Grid](testPoints=generate_test_points_from.testPts, ptsVectors=generate_test_points_from.ptsNormal)  # Analysis Grid. -
grid_based_recipe = Custom[Grid-Based Recipe](sky=climatebased_sky.sky, analysisGrids=analysis_grid.analysisGrid)  # Grid-based Recipe. -
flatten = Flatten(rooms_to_hbzones.HBZones)
code_block_3 = CodeBlock { "c:/ladybug"; "dynamo_sample_files"; true; }
boolean_2 = BoolSelector(false)
run_radiance_analysis = Custom[Run Radiance Analysis](analysisRecipe=grid_based_recipe.analysisRecipe, HBObjects=flatten, folder=code_block_3.out0, name=code_block_3.out1, write=code_block_3.out2, run=boolean_2)  # Run Radiance Analysis -
hourly_values = Custom[Hourly Values](analysisGrid=run_radiance_analysis.outputs)  # Hourly results for an analysis grid for a single hour of the year. -
generate_colors = Custom[Generate Colors](values=hourly_values.values, legendPar=run_radiance_analysis.legendPar)  # Color a test surface based on the results of a study. The results structure should match the test points structure to be mapped correctly on the surface.
byGeometryColor = Display.Display.ByGeometryColor(byPatch, generate_colors.colors)
