# Dynamo graph 01_daylight.dyn (Dynamo 1.2.0.2690)

code_block = CodeBlock { 1; {"min", 100, 300, 2000}; }
legend_parameters = Custom[Legend Parameters](cType=code_block.out0, domain=code_block.out1)  # Use legend parameter to set up results visualization setting
boolean = BoolSelector(true)

# group: This component fails for complex geometries. In those cases you can create the model surface by surface. You can also vote at the link below here so Autodesk opens up the Room API, so we can get the openings without failure! http://forums.autodesk.com/t5/revit-ideas/api-access-to-room-openings-geometry-and-materials-in-revit/idi-p/6642406
collect_rooms_and_spaces = Custom[Collect Rooms and Spaces](collect=boolean)  # Collect rooms and MEP spaces in the Revit document. Use "Rooms to HBZones" node to convert them to Honeybee zones.

rooms_to_hbzones = Custom[Rooms to HBZones](rooms=collect_rooms_and_spaces.rooms)  # Create Honeybee zones from Revit Rooms or MEPSpaces. This node currently ONLY collects geometrical data from Revit. In the future it will import constructions, materials and MEP data (e.g lighting power density).
code_block_2 = CodeBlock { 500; 750; }
generate_test_points_from = Custom[Generate Test Points from HBZones](HBZones=rooms_to_hbzones.HBZones, gridSize=code_block_2.out0, disFromSurface=code_block_2.out1)  # Generate test points from Honeybee zones based on grid size.
byPatch = Surface.ByPatch(generate_test_points_from.polygons)
file_path = Filename("C:\EnergyPlusV8-3-0\WeatherData\USA_CA_San.Francisco.Intl.AP.724940_TMY3.epw")
import_location = Custom[Import Location](epwFile=file_path)  # Import location data from an epw weather file
code_block_3 = CodeBlock { 12; 21; 12; }
cie_standard_sky = Custom[CIE Standard Sky](location=import_location.location, month=code_block_3.out0, day=code_block_3.out1, hour=code_block_3.out2)  # Generate Radiance's CIE Standard sky (aka. gensky).
grid_based_analysis_recipe = Custom[Grid-based Analysis Recipe](sky=cie_standard_sky.sky, testPoints=generate_test_points_from.testPts, ptsNormal=generate_test_points_from.ptsNormal)  # Create an analysis recipe for a grid-based daylight or radiation analysis.
code_block_4 = CodeBlock { "c:/ladybug"; "twoRooms"; true; }
run_radiance_simulation = Custom[Run Radiance Simulation](analysisRecipe=grid_based_analysis_recipe.gridbasedAnalysisRecipe, honeybeeObjects=rooms_to_hbzones.HBZones, workingDir=code_block_4.out0, projectName=code_block_4.out1, write=code_block_4.out2, run=code_block_4.out2)  # Write and run radiance simulations from Radiance recipes.
generate_colors = Custom[Generate Colors](values=run_radiance_simulation.results)  # Color a test surface based on the results of a study. The results structure should match the test points structure to be mapped correctly on the surface.
byGeometryColor = Display.Display.ByGeometryColor(byPatch, generate_colors.colors)
