# Dynamo graph 01_point_in_time_imagebased.dyn (Dynamo 1.3.0.875)

file_path = Filename("..\..\..\..\..\..\..\..\EnergyPlusV8-6-0\WeatherData\USA_CA_San.Francisco.Intl.AP.724940_TMY3.epw")
# note: This definition is using Honeybee and to run daylight analysis with Honeybee you need to install Radiance. Radiance can be downloaded and installed from this link:
# https://github.com/NREL/Radiance/releases/tag/5.2.0
wea = Custom[Wea](epwFile=file_path)  # epw2wea -
code_block = CodeBlock { 16; }
climatebased_sky = Custom[Climatebased Sky](wea=wea.wea, hour=code_block)  # Climate-based Sky.
code_block_2 = CodeBlock { "room_corner"; }
boolean = BoolSelector(true)
collect_rooms_and_spaces = Custom[Collect Rooms and Spaces](collect=boolean)  # Collect rooms and MEP spaces in the Revit document. Use "Rooms to HBZones" node to convert them to Honeybee zones.
code_block_3 = CodeBlock(rooms=collect_rooms_and_spaces.rooms) { rooms[1]; }

# group: This component fails for complex geometries. In those cases you can create the model surface by surface. You can also vote at the link below here so Autodesk opens up the Room API, so we can get the openings without failure! http://forums.autodesk.com/t5/revit-ideas/ api-access-to-room-openings-geometry-and-materials-in-revit/ idi-p/6642406
rooms_to_hbzones = Custom[Rooms to HBZones](rooms=code_block_3)  # Create Honeybee zones from Revit Rooms or MEPSpaces. This node currently ONLY collects geometrical data from Revit. In the future it will import constructions, materials and MEP data (e.g lighting power density).

code_block_4 = CodeBlock(x=rooms_to_hbzones.polylines) { x[0][1]; }
byPatch = Surface.ByPatch(code_block_4)
code_block_5 = CodeBlock { 0.1; 0.9; }
pointAtParameter = Surface.PointAtParameter(surface=byPatch, u=code_block_5.out0, v=code_block_5.out1)
code_block_6 = CodeBlock { 1200; }
translate = Geometry.Translate(geometry=pointAtParameter, zTranslation=code_block_6)
code_block_7 = CodeBlock { 0.9; 0.1; }
pointAtParameter_2 = Surface.PointAtParameter(surface=byPatch, u=code_block_7.out0, v=code_block_7.out1)
byTwoPoints = Vector.ByTwoPoints(start=pointAtParameter, end=pointAtParameter_2)
fish_eye_view_type = CodeBlock { 1; }
view = Custom[View](name=code_block_2, vLocation=translate, vDirection=byTwoPoints, viewType=fish_eye_view_type)  # Honeybee View. -
image_based_recipe = Custom[Image-Based Recipe](sky=climatebased_sky.sky, views=view.view)  # Image-based Recipe. -
flatten = Flatten(rooms_to_hbzones.HBZones)
code_block_8 = CodeBlock { "c:/ladybug"; "dynamo_sample_files"; true; }
boolean_2 = BoolSelector(false)
run_radiance_analysis = Custom[Run Radiance Analysis](analysisRecipe=image_based_recipe.analysisRecipe, HBObjects=flatten, folder=code_block_8.out0, name=code_block_8.out1, write=code_block_8.out2, run=boolean_2)  # Run Radiance Analysis -
boolean_3 = BoolSelector(true)
hdr_to_tiff = Custom[HDR to Tiff](hdrs=run_radiance_analysis.outputs, convert=boolean_3)  # Convert hdr files to tiff files. -
flatten_2 = Flatten(hdr_to_tiff.tiff)
number_slider = DoubleSlider(0, range=0..7 step 1)
getItemAtIndex = List.GetItemAtIndex(list=flatten_2, index=number_slider)
fromPath = FileObject(getItemAtIndex)  # "File.FromPath"
readFromFile = Image.ReadFromFile(fromPath)
watch_image = WatchImageCore(readFromFile)
