# Dynamo graph 03_solaraccess_gridbased.dyn (Dynamo 1.3.0.875)

boolean = BoolSelector(true)
collect_rooms_and_spaces = Custom[Collect Rooms and Spaces](collect=boolean)  # Collect rooms and MEP spaces in the Revit document. Use "Rooms to HBZones" node to convert them to Honeybee zones.

# group: This component fails for complex geometries. In those cases you can create the model surface by surface. You can also vote at the link below here so Autodesk opens up the Room API, so we can get the openings without failure! http://forums.autodesk.com/t5/revit-ideas/ api-access-to-room-openings-geometry-and-materials-in-revit/ idi-p/6642406
rooms_to_hbzones = Custom[Rooms to HBZones](rooms=collect_rooms_and_spaces.rooms)  # Create Honeybee zones from Revit Rooms or MEPSpaces. This node currently ONLY collects geometrical data from Revit. In the future it will import constructions, materials and MEP data (e.g lighting power density).

code_block = CodeBlock { 500; 750; }
generate_test_points_from = Custom[Generate Test Points from HBZones](HBZones=rooms_to_hbzones.HBZones, gridSize=code_block.out0, disFromSurface=code_block.out1)  # Generate test points from Honeybee zones based on grid size.
byPatch = Surface.ByPatch(generate_test_points_from.polygons)
file_path = Filename("..\..\..\..\..\..\..\..\EnergyPlusV8-6-0\WeatherData\USA_CA_San.Francisco.Intl.AP.724940_TMY3.epw")
import_location = Custom[Import Location](epwFile=file_path)  # Import location data from an epw weather file
code_block_2 = CodeBlock { 9; 21; 7..18; }
calculate_hoy = Custom[Calculate HOY](month=code_block_2.out0, day=code_block_2.out1, hour=code_block_2.out2)  # Calculate hour of year for a month, day and hour
code_block_3 = CodeBlock { 100; }
# note: This definition is using Honeybee and to run daylight analysis with Honeybee you need to install Radiance. Radiance can be downloaded and installed from this link:
# https://github.com/NREL/Radiance/releases/tag/5.2.0
sunPath = Custom[SunPath](location=import_location.location, hoys=calculate_hoy.hoy, scale=code_block_3)  # Use this component to make a 3D sun-path (aka. sun plot). The component also outputs sun vectors that can be used for solar access analysis or shading design. -
analysis_grid = Custom[Analysis Grid](testPoints=generate_test_points_from.testPts, ptsVectors=generate_test_points_from.ptsNormal)  # Analysis Grid. -
solar_access_recipe = Custom[Solar Access Recipe](sunVectors=sunPath.vectors, hoys=sunPath.hoys, analysisGrids=analysis_grid.analysisGrid)  # Solar Access Recipe. -
flatten = Flatten(rooms_to_hbzones.HBZones)
code_block_4 = CodeBlock { "c:/ladybug"; "dynamo_sample_files"; true; }
boolean_2 = BoolSelector(false)
run_radiance_analysis = Custom[Run Radiance Analysis](analysisRecipe=solar_access_recipe.analysisRecipe, HBObjects=flatten, folder=code_block_4.out0, name=code_block_4.out1, write=code_block_4.out2, run=boolean_2)  # Run Radiance Analysis -
cumulative_value = Custom[Cumulative Value](analysisGrid=run_radiance_analysis.outputs)  # Mass addition of values for a grid. This component is mostly useful for solar access and radiation studies. -
generate_colors = Custom[Generate Colors](values=cumulative_value.values)  # Color a test surface based on the results of a study. The results structure should match the test points structure to be mapped correctly on the surface.
byGeometryColor = Display.Display.ByGeometryColor(byPatch, generate_colors.colors)

# group: visualize hourly results
integer_slider = IntegerSlider(2, range=0..10 step 1)
getItemAtIndex = List.GetItemAtIndex(list=sunPath.hoys, index=integer_slider)
getItemAtIndex_2 = List.GetItemAtIndex(list=sunPath.sunPts, index=integer_slider)
code_block_5 = CodeBlock { 500; }
byCenterPointRadius = Sphere.ByCenterPointRadius(centerPoint=getItemAtIndex_2, radius=code_block_5)

hourly_values = Custom[Hourly Values](analysisGrid=run_radiance_analysis.outputs, hoy=getItemAtIndex)  # Hourly results for an analysis grid for a single hour of the year. -
code_block_6 = CodeBlock { 0; }
count = Count(sunPath.vectors)
create = List.Create(code_block_6, count)
code_block_7 = CodeBlock { 6; }
color_range = Custom[Color Range](index=code_block_7)  # Use this component to access a library of typical gradients useful throughout Ladybug. The output from this component should be plugged into the colors_ input of the "Legend Parameters" component. For an image of each of the gardients in the library, check here: https://github.com/mostaphaRoudsari/ladybug/blob/master/resources/gradients.jpg -
legend_parameters = Custom[Legend Parameters](domain=create, colors=color_range.colors)  # Use this component to change the colors, numerical range, and/or number of divisions of any Ladybug legend along with the corresponding colored mesh that the legend refers to. Any Ladybug component that outputs a colored mesh and a legend will have an input that can accept Legend Parameters from this component. This component particularly helpful in making the colors of Ladybug graphics consistent for a presentation or for synchonizing the numerical range and colors between Ladybug graphics. -
watch = Watch(analysis_grid.ERRReport)
byStartPointEndPoint = Line.ByStartPointEndPoint(startPoint=sunPath.centerPt, endPoint=getItemAtIndex_2)
watch_2 = Watch(sunPath.sunPts)
code_block_8 = CodeBlock { 500; }
byCenterPointRadius_2 = Sphere.ByCenterPointRadius(centerPoint=sunPath.sunPts, radius=code_block_8)
