# Dynamo graph 04_annual_daylight_gridbased.dyn (Dynamo 1.3.0.875)

boolean = BoolSelector(true)
collect_rooms_and_spaces = Custom[Collect Rooms and Spaces](collect=boolean)  # Collect rooms and MEP spaces in the Revit document. Use "Rooms to HBZones" node to convert them to Honeybee zones.

# group: This component fails for complex geometries. In those cases you can create the model surface by surface. You can also vote at the link below here so Autodesk opens up the Room API, so we can get the openings without failure! http://forums.autodesk.com/t5/revit-ideas/ api-access-to-room-openings-geometry-and-materials-in-revit/ idi-p/6642406
rooms_to_hbzones = Custom[Rooms to HBZones](rooms=collect_rooms_and_spaces.rooms)  # Create Honeybee zones from Revit Rooms or MEPSpaces. This node currently ONLY collects geometrical data from Revit. In the future it will import constructions, materials and MEP data (e.g lighting power density).

code_block = CodeBlock { 500; 750; }
generate_test_points_from = Custom[Generate Test Points from HBZones](HBZones=rooms_to_hbzones.HBZones, gridSize=code_block.out0, disFromSurface=code_block.out1)  # Generate test points from Honeybee zones based on grid size.
byPatch = Surface.ByPatch(generate_test_points_from.polygons)
file_path = Filename("..\..\..\..\..\..\..\..\EnergyPlusV8-6-0\WeatherData\USA_CO_Golden-NREL.724666_TMY3.epw")
# note: This definition is using Honeybee and to run daylight analysis with Honeybee you need to install Radiance. Radiance can be downloaded and installed from this link:
# https://github.com/NREL/Radiance/releases/tag/5.2.0
wea = Custom[Wea](epwFile=file_path)  # epw2wea -
sky_matrix = Custom[Sky Matrix](wea=wea.wea)  # Sky Matrix. -
analysis_grid = Custom[Analysis Grid](testPoints=generate_test_points_from.testPts, ptsVectors=generate_test_points_from.ptsNormal)  # Analysis Grid. -
annual_daylight_recipe = Custom[Annual Daylight Recipe](skymtx=sky_matrix.skymtx, analysisGrids=analysis_grid.analysisGrid)  # Annual daylight analysis recipe. Use this recipe to set up annual daylight analysis for scenes with no window groups. -
flatten = Flatten(rooms_to_hbzones.HBZones)
code_block_2 = CodeBlock { "c:/ladybug"; "dynamo_sample_files"; true; }
boolean_2 = BoolSelector(false)
run_radiance_analysis = Custom[Run Radiance Analysis](analysisRecipe=annual_daylight_recipe.analysisRecipe, HBObjects=flatten, folder=code_block_2.out0, name=code_block_2.out1, write=code_block_2.out2, run=boolean_2)  # Run Radiance Analysis -
annual_daylight_metrics = Custom[Annual Daylight Metrics](analysisGrid=run_radiance_analysis.outputs)  # Annual Daylight Metrics -
code_block_3 = CodeBlock(x=annual_daylight_metrics.legendPar) { x[0]; }
generate_colors = Custom[Generate Colors](values=annual_daylight_metrics.DA, legendPar=code_block_3)  # Color a test surface based on the results of a study. The results structure should match the test points structure to be mapped correctly on the surface.
byGeometryColor = Display.Display.ByGeometryColor(byPatch, generate_colors.colors)
spatial_daylight_autonomy = Custom[Spatial Daylight Autonomy]()  # Calculate annual solar exposure (ASE). As per IES-LM-83-12 ASE is the percent of sensors that are found to be exposed to more than 1000lux of direct sunlight for more than 250hrs per year. For LEED credits no more than 10% of the points in the grid should fail this measure. -; unwired: analysisGrid
sDA = Watch(spatial_daylight_autonomy.sDA)
annual_solar_exposure = Custom[Annual Solar Exposure]()  # Calculate annual solar exposure (ASE). As per IES-LM-83-12 ASE is the percent of sensors that are found to be exposed to more than 1000lux of direct sunlight for more than 250hrs per year. For LEED credits no more than 10% of the points in the grid should fail this measure. -; unwired: analysisGrid
