# Dynamo graph 05_annual_radiation_gridbased.dyn (Dynamo 1.3.0.875)

# group: Create test geometries!
XY = Plane.XY()
code_block = CodeBlock { 100; }
byWidthLength = Rectangle.ByWidthLength(plane=XY, width=code_block, length=code_block)
byPatch = Surface.ByPatch(byWidthLength)
byCoordinates = Point.ByCoordinates()
YAxis = Vector.YAxis()
code_block_2 = CodeBlock { 45; }
rotate = Geometry.Rotate(geometry=byWidthLength, origin=byCoordinates, axis=YAxis, degrees=code_block_2)
byPatch_2 = Surface.ByPatch(rotate)
code_block_3 = CodeBlock { 0.5; }
scale = Geometry.Scale(geometry=byPatch_2, xamount=code_block_3, yamount=code_block_3, zamount=code_block_3)

create = List.Create(byPatch, scale)
code_block_4 = CodeBlock { 5; 0.05; }
create_2 = List.Create(byWidthLength, rotate)
generate_test_points_by_grid = Custom[Generate Test Points by Grid Size](testSurfaces=create, gridSize=code_block_4.out0, disFromSurface=code_block_4.out1, borders=create_2)  # Generate test points from Dynamo surfaces based on grid size.
byPatch_3 = Surface.ByPatch(generate_test_points_by_grid.polygons)
file_path = Filename("..\..\..\..\..\..\..\..\EnergyPlusV8-6-0\WeatherData\USA_CO_Golden-NREL.724666_TMY3.epw")
wea = Custom[Wea](epwFile=file_path)  # epw2wea -
sky_matrix = Custom[Sky Matrix](wea=wea.wea)  # Sky Matrix. -
analysis_grid = Custom[Analysis Grid](testPoints=generate_test_points_by_grid.testPts, ptsVectors=generate_test_points_by_grid.ptsNormal)  # Analysis Grid. -
annual_radiation_recipe = Custom[Annual Radiation Recipe](skymtx=sky_matrix.skymtx, analysisGrids=analysis_grid.analysisGrid)  # Annual radiation analysis -
honeybee_surface = Custom[Honeybee Surface](geo=create)  # Honeybee Surface -
flatten = Flatten(honeybee_surface.HBSrf)
code_block_5 = CodeBlock { "c:/ladybug"; "dynamo_sample_files"; true; }
boolean = BoolSelector(false)
# note: This definition is using Honeybee and to run daylight analysis with Honeybee you need to install Radiance. Radiance can be downloaded and installed from this link:
# https://github.com/NREL/Radiance/releases/tag/5.2.0
run_radiance_analysis = Custom[Run Radiance Analysis](analysisRecipe=annual_radiation_recipe.analysisRecipe, HBObjects=flatten, folder=code_block_5.out0, name=code_block_5.out1, write=code_block_5.out2, run=boolean)  # Run Radiance Analysis -
cumulative_value = Custom[Cumulative Value](analysisGrid=run_radiance_analysis.outputs)  # Mass addition of values for a grid. This component is mostly useful for solar access and radiation studies. -
generate_colors = Custom[Generate Colors](values=cumulative_value.values)  # Color a test surface based on the results of a study. The results structure should match the test points structure to be mapped correctly on the surface.
byGeometryColor = Display.Display.ByGeometryColor(byPatch_3, generate_colors.colors)
calculate_hoy = Custom[Calculate HOY]()  # Calculate hour of the year. -
hourly_values = Custom[Hourly Values](analysisGrid=run_radiance_analysis.outputs, hoy=calculate_hoy.hoy)  # frozen; Hourly results for an analysis grid for a single hour of the year. -
watch = Watch(hourly_values.values)
code_block_6 = CodeBlock(x=run_radiance_analysis.outputs) { x[0]; }
code_block_7 = CodeBlock { 100; }
sensor_from_analysis_grid = Custom[Sensor from analysis grid](analysisGrid=code_block_6, index=code_block_7)  # Sensor from analysis grid -
sensor_hourly_values = Custom[Sensor Hourly Values](sensor=sensor_from_analysis_grid.sensor)  # Hourly results for a sensor for several hours during the year. -
watch_2 = Watch(sensor_hourly_values.values)

# group: Draw a line chart using mandrill
code_block_8 = CodeBlock { "annual_hourly_radiation"; }
code_block_9 = CodeBlock { 0; 500; }
domain = Charts.MiscNodes.Domain(code_block_9.out0, code_block_9.out1)
data = Charts.LineChart.Data(code_block_8, sensor_hourly_values.values, domain)
address = Charts.MiscNodes.Address()
style = Charts.LineChart.Style(arg1=address)
chart = Charts.LineChart.Chart(data, style)
create_report = MandrillReportNode(chart)
report_window = MandrillWindowNodeModel(create_report)
