# Dynamo graph 07_daylight_coefficient_imagebased.dyn (Dynamo 1.3.0.875)

boolean = BoolSelector(true)
collect_rooms_and_spaces = Custom[Collect Rooms and Spaces](collect=boolean)  # Collect rooms and MEP spaces in the Revit document. Use "Rooms to HBZones" node to convert them to Honeybee zones.
code_block = CodeBlock(rooms=collect_rooms_and_spaces.rooms) { rooms[1]; }

# group: This component fails for complex geometries. In those cases you can create the model surface by surface. You can also vote at the link below here so Autodesk opens up the Room API, so we can get the openings without failure! http://forums.autodesk.com/t5/revit-ideas/ api-access-to-room-openings-geometry-and-materials-in-revit/ idi-p/6642406
rooms_to_hbzones = Custom[Rooms to HBZones](rooms=code_block)  # Create Honeybee zones from Revit Rooms or MEPSpaces. This node currently ONLY collects geometrical data from Revit. In the future it will import constructions, materials and MEP data (e.g lighting power density).

south_windows = CodeBlock(x=rooms_to_hbzones.polylines) { x[0][3..6]; }
byPatch = Surface.ByPatch(south_windows)
flipNormalDirection = Surface.FlipNormalDirection(byPatch)
code_block_2 = CodeBlock { "south_wgroup"; }
code_block_3 = CodeBlock { "glass_60"; 0.6; }
radiance_glass_material = Custom[Radiance Glass Material](name=code_block_3.out0, tVis=code_block_3.out1)  # Radiance Glass Material from Visible Transmitance -
code_block_4 = CodeBlock { "dark_glass"; }
code_block_5 = CodeBlock { "glass_35"; 0.35; }
radiance_glass_material_2 = Custom[Radiance Glass Material](name=code_block_5.out0, tVis=code_block_5.out1)
windowgroup_state = Custom[WindowGroup State](name=code_block_4, radMat=radiance_glass_material_2.material)  # Window Group State -
honeybee_window_group = Custom[Honeybee Window Group](geo=flipNormalDirection, name=code_block_2, radMat=radiance_glass_material.material, states=windowgroup_state.state)  # Honeybee Window Group A window group is a group of HBWindow surfaces which will be grouped together for 3-phase daylight analysis. View matrix will be calculated for all the Window surfaces in a group once. Window surfaces in a group shoudl have the same normal direction, and same BSDF materials will be assigned to all the windows in this group. -
check_surface_normal = Python(IN[0]=honeybee_window_group.HBWinGroup)
# ---------- check_surface_normal.python (8 lines) ----------
import clr
clr.AddReference('ProtoGeometry')
from Autodesk.DesignScript.Geometry import *
#The inputs to this node will be stored as a list in the IN variables.
dataEnteringNode = IN

#Assign your output to the OUT variable.
OUT = IN[0].normal
# ----------------------------------------
watch = Watch(check_surface_normal)
file_path = Filename("..\..\..\..\..\..\..\..\EnergyPlusV8-6-0\WeatherData\USA_CO_Golden-NREL.724666_TMY3.epw")
# note: This definition is using Honeybee and to run daylight analysis with Honeybee you need to install Radiance. Radiance can be downloaded and installed from this link:
# https://github.com/NREL/Radiance/releases/tag/5.2.0
wea = Custom[Wea](epwFile=file_path)  # epw2wea -
code_block_6 = CodeBlock { 9; 21; {9, 10, 11, 12, 13, 14, 15, 16}; }
calculate_hoy = Custom[Calculate HOY](month=code_block_6.out0, day=code_block_6.out1, hour=code_block_6.out2)  # Calculate hour of the year. -
sky_matrix = Custom[Sky Matrix](wea=wea.wea, hoys=calculate_hoy.hoy)  # Sky Matrix. -

# group: create the view
code_block_7 = CodeBlock { "room_corner"; }
code_block_8 = CodeBlock(x=rooms_to_hbzones.polylines) { x[0][1]; }
byPatch_2 = Surface.ByPatch(code_block_8)
code_block_9 = CodeBlock { 0.1; 0.9; }
pointAtParameter = Surface.PointAtParameter(surface=byPatch_2, u=code_block_9.out0, v=code_block_9.out1)
code_block_10 = CodeBlock { 1200; }
translate = Geometry.Translate(geometry=pointAtParameter, zTranslation=code_block_10)
code_block_11 = CodeBlock { 0.9; 0.1; }
pointAtParameter_2 = Surface.PointAtParameter(surface=byPatch_2, u=code_block_11.out0, v=code_block_11.out1)
byTwoPoints = Vector.ByTwoPoints(start=pointAtParameter, end=pointAtParameter_2)
fish_eye_view_type = CodeBlock { 1; }
view = Custom[View](name=code_block_7, vLocation=translate, vDirection=byTwoPoints, viewType=fish_eye_view_type)  # Honeybee View. -

dc_image_based_daylight_recipe = Custom[DC Image-based Daylight Recipe](skymtx=sky_matrix.skymtx, views=view.view)  # Daylight Coefficient Image-based Daylight Recipe. Use this recipe to set up annual daylight analysis. -
get_geometries_from_hbzone = Python(IN[0]=rooms_to_hbzones.HBZones)
# ---------- get_geometries_from_hbzone.python (33 lines) ----------
import clr
clr.AddReference('ProtoGeometry')
from Autodesk.DesignScript.Geometry import *


def create_surface(parent_pl, child_pl=None):
	if not child_pl:
		return Surface.ByPatch(parent_pl)
	else:
		p = Surface.ByPatch(parent_pl)
		childSrfs = tuple(Surface.ByPatch(c) for c in child_pl)
		centPts = tuple(c.Center() for c in child_pl)
		
		# trimmedSrf = tuple(p.Trim(c, p) for c, p in zip(childSrfs, centPts))
		trimmedSrf = []
		for i in range(len(childSrfs)):
			s = p.Trim(childSrfs[i], centPts[i])
			trimmedSrf.extend(s)
		return p.IntersectAll(trimmedSrf);
	
zones = IN[0]
_geo = []
for zone in zones:
	for surface in zone.surfaces:
	    if not surface.hasChildSurfaces:
	    	_geo.append(create_surface(surface.geometry))
	    else:
	        child_pl = [childSurface.geometry for childSurface in surface.childrenSurfaces]
	        _geo.extend(create_surface(surface.geometry, child_pl))
	        _geo.extend(Surface.ByPatch(c) for c in child_pl)
	            

OUT = _geo
# ----------------------------------------
code_block_12 = CodeBlock(x=get_geometries_from_hbzone) { x[0..2]; x[7..9]; }
create = List.Create(code_block_12.out0, code_block_12.out1)
flatten = Flatten(create)
honeybee_surface = Custom[Honeybee Surface](geo=flatten)  # Honeybee Surface -
west_windows = CodeBlock(x=rooms_to_hbzones.polylines) { x[0][10]; }
byPatch_3 = Surface.ByPatch(west_windows)
code_block_13 = CodeBlock { "west_window"; }
honeybee_window_surface = Custom[Honeybee Window Surface](geo=byPatch_3, names=code_block_13, radMat=radiance_glass_material.material)  # Honeybee Window Surface -
create_2 = List.Create(honeybee_surface.HBSrf, honeybee_window_surface.HBWinSrf, honeybee_window_group.HBWinGroup)
flatten_2 = Flatten(create_2)
code_block_14 = CodeBlock { "c:/ladybug"; "dynamo_sample_files"; true; }
boolean_2 = BoolSelector(false)
run_radiance_analysis = Custom[Run Radiance Analysis](analysisRecipe=dc_image_based_daylight_recipe.analysisRecipe, HBObjects=flatten_2, folder=code_block_14.out0, name=code_block_14.out1, write=code_block_14.out2, run=boolean_2)  # Run Radiance Analysis -
code_block_15 = CodeBlock { "(-1, 0)"; }
count = Count(calculate_hoy.hoy)
ofRepeatedItem = List.OfRepeatedItem(item=code_block_15, amount=count)
generate_images = Custom[Generate Images](imgCollection=run_radiance_analysis.outputs, hoys=calculate_hoy.hoy, blindStates=ofRepeatedItem)  # Hourly results for a sensor for several hours during the year. -
boolean_3 = BoolSelector(true)
hdr_to_tiff = Custom[HDR to Tiff](hdrs=generate_images.images, convert=boolean_3)  # Convert hdr files to tiff files. -
flatten_3 = Flatten(hdr_to_tiff.tiff)
number_slider = DoubleSlider(4, range=0..7 step 1)
getItemAtIndex = List.GetItemAtIndex(list=flatten_3, index=number_slider)
fromPath = FileObject(getItemAtIndex)  # "File.FromPath"
readFromFile = Image.ReadFromFile(fromPath)
watch_image = WatchImageCore(readFromFile)
code_block_16 = CodeBlock { 1000; }
byStartPointDirectionLength = Line.ByStartPointDirectionLength(startPoint=translate, direction=byTwoPoints, length=code_block_16)
