# Dynamo graph 08_three_phase_I_gridbased.dyn (Dynamo 1.3.0.875)

# note: This definition is using Honeybee and to run daylight analysis with Honeybee you need to install Radiance. Radiance can be downloaded and installed from this link:
# https://github.com/NREL/Radiance/releases/tag/5.2.0

boolean = BoolSelector(true)
collect_rooms_and_spaces = Custom[Collect Rooms and Spaces](collect=boolean)  # Collect rooms and MEP spaces in the Revit document. Use "Rooms to HBZones" node to convert them to Honeybee zones.
code_block = CodeBlock(rooms=collect_rooms_and_spaces.rooms) { south_room = rooms[1]; }

# group: This component fails for complex geometries. In those cases you can create the model surface by surface. You can also vote at the link below here so Autodesk opens up the Room API, so we can get the openings without failure! http://forums.autodesk.com/t5/revit-ideas/ api-access-to-room-openings-geometry-and-materials-in-revit/ idi-p/6642406
rooms_to_hbzones = Custom[Rooms to HBZones](rooms=code_block)  # Create Honeybee zones from Revit Rooms or MEPSpaces. This node currently ONLY collects geometrical data from Revit. In the future it will import constructions, materials and MEP data (e.g lighting power density).

code_block_2 = CodeBlock { 500; 750; }
generate_test_points_from = Custom[Generate Test Points from HBZones](HBZones=rooms_to_hbzones.HBZones, gridSize=code_block_2.out0, disFromSurface=code_block_2.out1)  # Generate test points from Honeybee zones based on grid size.
byPatch = Surface.ByPatch(generate_test_points_from.polygons)
file_path = Filename("..\..\..\..\..\..\..\..\EnergyPlusV8-6-0\WeatherData\USA_CO_Golden-NREL.724666_TMY3.epw")
wea = Custom[Wea](epwFile=file_path)  # epw2wea -
sky_matrix = Custom[Sky Matrix](wea=wea.wea)  # Sky Matrix. -
analysis_grid = Custom[Analysis Grid](testPoints=generate_test_points_from.testPts, ptsVectors=generate_test_points_from.ptsNormal)  # Analysis Grid. -
grid_based_three_phase_daylight = Custom[Grid-Based Three-Phase Daylight Recipe](skymtx=sky_matrix.skymtx, analysisGrids=analysis_grid.analysisGrid)  # Three-pahse daylight Recipe. -
get_geometries_from_hbzone = Python(IN[0]=rooms_to_hbzones.HBZones)
# ---------- get_geometries_from_hbzone.python (33 lines) ----------
import clr
clr.AddReference('ProtoGeometry')
from Autodesk.DesignScript.Geometry import *


def create_surface(parent_pl, child_pl=None):
	if not child_pl:
		return Surface.ByPatch(parent_pl)
	else:
		p = Surface.ByPatch(parent_pl)
		childSrfs = tuple(Surface.ByPatch(c) for c in child_pl)
		centPts = tuple(c.Center() for c in child_pl)
		
		# trimmedSrf = tuple(p.Trim(c, p) for c, p in zip(childSrfs, centPts))
		trimmedSrf = []
		for i in range(len(childSrfs)):
			s = p.Trim(childSrfs[i], centPts[i])
			trimmedSrf.extend(s)
		return p.IntersectAll(trimmedSrf);
	
zones = IN[0]
_geo = []
for zone in zones:
	for surface in zone.surfaces:
	    if not surface.hasChildSurfaces:
	    	_geo.append(create_surface(surface.geometry))
	    else:
	        child_pl = [childSurface.geometry for childSurface in surface.childrenSurfaces]
	        _geo.extend(create_surface(surface.geometry, child_pl))
	        _geo.extend(Surface.ByPatch(c) for c in child_pl)
	            

OUT = _geo
# ----------------------------------------
code_block_3 = CodeBlock(x=get_geometries_from_hbzone) { x[0..2]; x[7..9]; }
create = List.Create(code_block_3.out0, code_block_3.out1)
flatten = Flatten(create)
honeybee_surface = Custom[Honeybee Surface](geo=flatten)  # Honeybee Surface -
west_windows = CodeBlock(x=rooms_to_hbzones.polylines) { x[0][10]; }
byPatch_2 = Surface.ByPatch(west_windows)
code_block_4 = CodeBlock { "west_window"; }

# group: Change this path to your local folder.
directory_path = Directory("C:\Users\Mostapha\Documents\code\ladybug-tools\honeybee-dynamo\plugin\samplefiles\xmls")

code_block_5 = CodeBlock { "\\clear.xml"; "\\diffuse50.xml"; }
concat = String.Concat(directory_path, code_block_5.out0)
radiance_bsdf_material = Custom[Radiance BSDF Material](xmlfile=concat)  # Radiance BSDF Material -
honeybee_window_surface = Custom[Honeybee Window Surface](geo=byPatch_2, names=code_block_4, radMat=radiance_bsdf_material.material)  # Honeybee Window Surface -
south_windows = CodeBlock(x=rooms_to_hbzones.polylines) { x[0][3..6]; }
byPatch_3 = Surface.ByPatch(south_windows)
flipNormalDirection = Surface.FlipNormalDirection(byPatch_3)
code_block_6 = CodeBlock { "south_wgroup"; }
code_block_7 = CodeBlock { "diffuse"; }
concat_2 = String.Concat(directory_path, code_block_5.out1)
radiance_bsdf_material_2 = Custom[Radiance BSDF Material](xmlfile=concat_2)
windowgroup_state = Custom[WindowGroup State](name=code_block_7, radMat=radiance_bsdf_material_2.material)  # Window Group State -
honeybee_window_group = Custom[Honeybee Window Group](geo=flipNormalDirection, name=code_block_6, radMat=radiance_bsdf_material.material, states=windowgroup_state.state)  # Honeybee Window Group A window group is a group of HBWindow surfaces which will be grouped together for 3-phase daylight analysis. View matrix will be calculated for all the Window surfaces in a group once. Window surfaces in a group shoudl have the same normal direction, and same BSDF materials will be assigned to all the windows in this group. -
create_2 = List.Create(honeybee_surface.HBSrf, honeybee_window_surface.HBWinSrf, honeybee_window_group.HBWinGroup)
flatten_2 = Flatten(create_2)
code_block_8 = CodeBlock { "c:/ladybug"; "dynamo_sample_files"; true; }
boolean_2 = BoolSelector(false)
run_radiance_analysis = Custom[Run Radiance Analysis](analysisRecipe=grid_based_three_phase_daylight.analysisRecipe, HBObjects=flatten_2, folder=code_block_8.out0, name=code_block_8.out1, write=code_block_8.out2, run=boolean_2)  # Run Radiance Analysis -
code_block_9 = CodeBlock { 9; 21; 15; }
calculate_hoy = Custom[Calculate HOY](month=code_block_9.out0, day=code_block_9.out1, hour=code_block_9.out2)  # Calculate hour of the year. -
hourly_values = Custom[Hourly Values](analysisGrid=run_radiance_analysis.outputs, hoy=calculate_hoy.hoy)  # Hourly results for an analysis grid for a single hour of the year. -
generate_colors = Custom[Generate Colors](values=hourly_values.values, legendPar=run_radiance_analysis.legendPar)  # Color a test surface based on the results of a study. The results structure should match the test points structure to be mapped correctly on the surface.
byGeometryColor = Display.Display.ByGeometryColor(byPatch, generate_colors.colors)
annual_daylight_metrics = Custom[Annual Daylight Metrics](analysisGrid=run_radiance_analysis.outputs)  # frozen; Annual Daylight Metrics -
check_surface_normal = Python(IN[0]=honeybee_window_group.HBWinGroup)
# ---------- check_surface_normal.python (8 lines) ----------
import clr
clr.AddReference('ProtoGeometry')
from Autodesk.DesignScript.Geometry import *
#The inputs to this node will be stored as a list in the IN variables.
dataEnteringNode = IN

#Assign your output to the OUT variable.
OUT = IN[0].normal
# ----------------------------------------
watch = Watch(check_surface_normal)
what_will_happen_by_removing = CodeBlock { "(0, -1)"; }  # "What will happen by removing south windows?"
what_will_happen_by_removing_2 = CodeBlock { "(-1, 0)"; }  # "What will happen by removing west windows?"
what_about_the_diffuse_glass = CodeBlock { "(0, 1)"; }

# group: This should work but it doesn't!
flatten_3 = Flatten(generate_test_points_from.testPts)  # frozen
code_block_10 = CodeBlock(values=hourly_values.values) { values[0]; }  # frozen
string_from_object = FromObject(code_block_10)
byPointAndString = Analysis.Label.ByPointAndString(flatten_3, string_from_object)
