# Dynamo custom node CIE Standard Sky.dyf (Dynamo 1.0.0.1180)
# category: Honeybee.02 :: Daylight :: Skies
# Generate Radiance's CIE Standard sky (aka. gensky).

# group: load the script
code_block = CodeBlock { "CIEStandardSky_node.py"; }

find_file_and_import_it = Python(IN[0]=code_block)
# ---------- find_file_and_import_it.python (37 lines) ----------
try:
	def getPackagePath(packageName):
		import sys
		sys.path.append('C:\Program Files (x86)\IronPython 2.7\Lib')
		import os
		import clr
		clr.AddReference('DynamoCore')
		_loc = clr.References[2].Location
		_ver = _loc.split('\\')[-2].split(' ')[-1]
		
		# the path structure has changed after the release of version 1
		dynamoPath_1 = "Dynamo\\Dynamo Revit\\" + _ver
		dynamoPath_0 = "Dynamo\\" + _ver
		appdata = os.getenv('APPDATA')
		path1 = r'%s\%s\packages\%s\extra\nodesrc\\'%(appdata, dynamoPath_1, packageName)
		path0 = r'%s\%s\packages\%s\extra\nodesrc\\'%(appdata, dynamoPath_0, packageName)
		
		if os.path.isdir(path1):
			return path1
		elif os.path.isdir(path0):
			return path0
		else:
			raise Exception("Can't find Dynamo installation Folder!")

	filePath = getPackagePath('Honeybee') + IN[0]

	with open(filePath, 'rb') as inf:
	    lines = inf.readlines()

	OUT = ''.join(lines)
except Exception, e:
	import traceback
	OUT = "ERROR:\n%s" % str(e) + \
		"\n\nIf you think this is a bug submit an issue on github.\n" + \
		"https://github.com/ladybug-analysis-tools/ladybug-dynamo/issues" + \
		"\n\n%s" % traceback.format_exc()
		
# ----------------------------------------
north = Input(north_: int = 0)  # A number between 0 and 360 that represents the degrees off from the y-axis to make North. The default North direction is set to the Y-axis (default: 0 degrees)
location = Input(_location: System.Object)  # A ladybug location.
month = Input(_month_: int = 6)  # A number to indicate month (1..12).
day = Input(_day_: int = 21)  # A number to indicate day (1..31).
hour = Input(_hour_: double = 12.0)  # A number to indicate hour (0..23).
skyType = Input(_skyType_: int = 0)  # An integer between 0..5 to indicate CIE Sky Type. [0] Sunny with sun, [1] sunny without sun, [2] intermediate with sun [3] intermediate without sun, [4] cloudy sky, [5] uniform sky
python_script_from_string = PythonStringNode(script=find_file_and_import_it, IN[0]=north, IN[1]=location, IN[2]=month, IN[3]=day, IN[4]=hour, IN[5]=skyType)
sky = Output(python_script_from_string)  # Honeybee sky
error_report = Python(IN[0]=find_file_and_import_it, IN[1]=python_script_from_string)
# ---------- error_report.python (15 lines) ----------
"""Report errors"""
importErr = IN[0]
runErr = IN[1]
errors = []

if importErr and str(importErr).startswith("ERROR:"):
	errors.append(importErr)

if runErr and str(runErr).startswith("ERROR:"):
	errors.append(runErr)

if len(errors)==0:
	OUT = "All good! Vvizzzz."
else:
	OUT = "\n".join(errors)
# ----------------------------------------
ERRReport = Output(error_report)  # Report
