# Dynamo custom node Generate Test Points by Grid Size.dyf (Dynamo 1.0.0.1180)
# category: Honeybee.03 :: Daylight :: Recipes
# Generate test points from Dynamo surfaces based on grid size.

# group: load the script
code_block = CodeBlock { "genTestPointsByGridSize_node.py"; }

find_file_and_import_it = Python(IN[0]=code_block)
# ---------- find_file_and_import_it.python (37 lines) ----------
try:
	def getPackagePath(packageName):
		import sys
		sys.path.append('C:\Program Files (x86)\IronPython 2.7\Lib')
		import os
		import clr
		clr.AddReference('DynamoCore')
		_loc = clr.References[2].Location
		_ver = _loc.split('\\')[-2].split(' ')[-1]
		
		# the path structure has changed after the release of version 1
		dynamoPath_1 = "Dynamo\\Dynamo Revit\\" + _ver
		dynamoPath_0 = "Dynamo\\" + _ver
		appdata = os.getenv('APPDATA')
		path1 = r'%s\%s\packages\%s\extra\nodesrc\\'%(appdata, dynamoPath_1, packageName)
		path0 = r'%s\%s\packages\%s\extra\nodesrc\\'%(appdata, dynamoPath_0, packageName)
		
		if os.path.isdir(path1):
			return path1
		elif os.path.isdir(path0):
			return path0
		else:
			raise Exception("Can't find Dynamo installation Folder!")

	filePath = getPackagePath('Honeybee') + IN[0]

	with open(filePath, 'rb') as inf:
	    lines = inf.readlines()

	OUT = ''.join(lines)
except Exception, e:
	import traceback
	OUT = "ERROR:\n%s" % str(e) + \
		"\n\nIf you think this is a bug submit an issue on github.\n" + \
		"https://github.com/ladybug-analysis-tools/ladybug-dynamo/issues" + \
		"\n\n%s" % traceback.format_exc()
		
# ----------------------------------------
testSurfaces = Input(_testSurfaces: var[]..[])  # A list or a single test surface
gridSize = Input(_gridSize: double)  # Number of divisions in U and V directions. Default is set to 10
disFromSurface = Input(_disFromSurface_: double = 0.01)  # Test point distance from base surface. Default is set to 0.01
borders = Input(_borders: var[]..[] = null)  # List of borders of test surfaces as polygons Borders are used to filter test points
python_script_from_string = PythonStringNode(script=find_file_and_import_it, IN[0]=testSurfaces, IN[1]=gridSize, IN[2]=disFromSurface, IN[3]=borders)
code_block_2 = CodeBlock(out=python_script_from_string) { testPts = out[0]; ptsNormal = out[1]; UVs = out[2]; polygons = out[3]; }
testPts = Output(code_block_2.testPts)  # Lists of list of Points
ptsNormal = Output(code_block_2.ptsNormal)  # Lists of list of points direction as Vector
inputs = CodeBlock { _testSurfaces; _gridSize; _disFromSurface; _borders; }
UVs = Output(code_block_2.UVs)  # Lists of list of UVs for test points
polygons = Output(code_block_2.polygons)  # List of polygons for each test cell
error_report = Python(IN[0]=find_file_and_import_it, IN[1]=python_script_from_string)
# ---------- error_report.python (15 lines) ----------
"""Report errors"""
importErr = IN[0]
runErr = IN[1]
errors = []

if importErr and str(importErr).startswith("ERROR:"):
	errors.append(importErr)

if runErr and str(runErr).startswith("ERROR:"):
	errors.append(runErr)

if len(errors)==0:
	OUT = "All good! Vvizzzz."
else:
	OUT = "\n".join(errors)
# ----------------------------------------
ERRReport = Output(error_report)  # Report
