# Dynamo custom node Honeybee Surface.dyf (Dynamo 1.0.0.1180)
# category: Honeybee.00 :: Honeybee :: Core
# Create a Honeybee surface, which can be plugged into the "Run Daylight Sumilation" component.
# Not available in the currant version for Dynamo but this surface can be combined with other surfaces to make HBZones with the "Create Honeybee Zone" node.

# group: load the script
code_block = CodeBlock { "honeybeeSurface_node.py"; }

find_file_and_import_it = Python(IN[0]=code_block)
# ---------- find_file_and_import_it.python (37 lines) ----------
try:
	def getPackagePath(packageName):
		import sys
		sys.path.append('C:\Program Files (x86)\IronPython 2.7\Lib')
		import os
		import clr
		clr.AddReference('DynamoCore')
		_loc = clr.References[2].Location
		_ver = _loc.split('\\')[-2].split(' ')[-1]
		
		# the path structure has changed after the release of version 1
		dynamoPath_1 = "Dynamo\\Dynamo Revit\\" + _ver
		dynamoPath_0 = "Dynamo\\" + _ver
		appdata = os.getenv('APPDATA')
		path1 = r'%s\%s\packages\%s\extra\nodesrc\\'%(appdata, dynamoPath_1, packageName)
		path0 = r'%s\%s\packages\%s\extra\nodesrc\\'%(appdata, dynamoPath_0, packageName)
		
		if os.path.isdir(path1):
			return path1
		elif os.path.isdir(path0):
			return path0
		else:
			raise Exception("Can't find Dynamo installation Folder!")

	filePath = getPackagePath('Honeybee') + IN[0]

	with open(filePath, 'rb') as inf:
	    lines = inf.readlines()

	OUT = ''.join(lines)
except Exception, e:
	import traceback
	OUT = "ERROR:\n%s" % str(e) + \
		"\n\nIf you think this is a bug submit an issue on github.\n" + \
		"https://github.com/ladybug-analysis-tools/ladybug-dynamo/issues" + \
		"\n\n%s" % traceback.format_exc()
		
# ----------------------------------------
geometry = Input()  # "_geometry"; A single surface or list of surfaces
name = Input(_name_:string=null)  # An optional name for this surface
type = Input(_type_:double=null)  # An optional input for surface type. If not indicated it will be assigned based on normal vector angle. 0.0: Wall           0.5: UndergroundWall 1.0: Roof           1.5: UndergroundCeiling 2.0: Floor          2.25: UndergroundSlab 2.5: SlabOnGrade    2.75: ExposedFloor 3.0: Ceiling        4.0: AirWall 5.0: Window         6.0: Context
code_block_2 = CodeBlock { "radianceProperties_node.py"; }
find_file_and_import_it_2 = Python(IN[0]=code_block_2)  # same code as find_file_and_import_it
radianceMaterial = Input(_radianceMaterial_:System.Object=null)  # An optional radiance material If not indicated it will be assigned based on surface type If surface type is not indicated it will be calculated based on normal vector angle.
python_script_from_string = PythonStringNode(script=find_file_and_import_it_2, IN[0]=radianceMaterial)
code_block_3 = CodeBlock()
# ---------- code_block_3.designscript (2 lines) ----------
//EPParameters - will be added later
null;
# ----------------------------------------
python_script_from_string_2 = PythonStringNode(script=find_file_and_import_it, IN[0]=geometry, IN[1]=name, IN[2]=type, IN[3]=python_script_from_string, IN[4]=code_block_3)
honeybeeSurface = Output(python_script_from_string_2)  # A list of honeybee surfaces
error_report = Python(IN[0]=find_file_and_import_it, IN[1]=python_script_from_string_2)
# ---------- error_report.python (15 lines) ----------
"""Report errors"""
importErr = IN[0]
runErr = IN[1]
errors = []

if importErr and str(importErr).startswith("ERROR:"):
	errors.append(importErr)

if runErr and str(runErr).startswith("ERROR:"):
	errors.append(runErr)

if len(errors)==0:
	OUT = "All good! Vvizzzz."
else:
	OUT = "\n".join(errors)
# ----------------------------------------
ERRReport = Output(error_report)  # Report
