# Grasshopper definition analysisRecipe.gh (Grasshopper 0.9.76)
# plug-ins: Python Interpreter

panel = Panel("C:\Users\Administrator\Documents\GitHub\honeybee-grasshopper")
planesrf = PlaneSurface(Plane=PlaneXY(0, 0, 0), XSize="20", YSize="20")
python = PythonScript(path_to_honeybee_libs=panel)  # -> readMe
# ---------- python: Python ----------
from scriptcontext import sticky

sticky["hb_lib_path"] = path_to_honeybee_libs
# ---------- end python ----------
wires = BrepWireframe(Brep=planesrf, Density=-1)
number_slider = Slider(20, range=0..100)

# ---- group: Radiance parameters
radpar = PythonScript(quality=Slider(2, range=0..10))  # -> radParameters; inputs quality: Int32, ab: Int32, ad: Int32, as: Int32, ar: Int32
# ---------- radpar: Python ----------
import sys
from scriptcontext import sticky

if "hb_lib_path" in sticky:
    sys.path.append(sticky["hb_lib_path"])

try:
    from honeybeegrasshopper.radiance import parameters
    from honeybeegrasshopper import wrapper
except ImportError:
    raise ImportError("Failed to import Honeybee libraries.\n" + \
                      "Set-up path to Honeybee libraries in honeybee_honeybee component")

if _quality:
    radParameters = parameters.RadianceParameters(_quality)
    if _ab_: radParameters.ab = _ab_
    if _ad_: radParameters.ad = _ad_
    if _as_: radParameters.as_ = _as_
    if _ar_: radParameters.ar = _ar_
    if _aa_: radParameters.aa = _aa_
    
    #print radParameters
    #wrap the object
    radParameters = wrapper.Wrapper(radParameters)
# ---------- end radpar ----------

# ---- group: sky library
sky = PythonScript(illuminanceValue=Slider(200, range=0..1000))  # -> HBSky
# ---------- sky: Python ----------
import sys
from scriptcontext import sticky

if "hb_lib_path" in sticky:
    sys.path.append(sticky["hb_lib_path"])

try:
    from honeybeegrasshopper.radiance.sky.certainIlluminance import SkyWithCertainIlluminanceLevel
    from honeybeegrasshopper.wrapper import Wrapper
except ImportError:
    raise ImportError("Failed to import Honeybee libraries.\n" + \
                      "Set-up path to Honeybee libraries in honeybee_honeybee component")

if _illuminanceValue:
    HBSky = Wrapper(SkyWithCertainIlluminanceLevel(_illuminanceValue))
# ---------- end sky ----------

# ----
python_2 = PythonScript(name="g_material", TVis=".25")  # -> material
# ---------- python_2: Python ----------
import sys
from scriptcontext import sticky

if "hb_lib_path" in sticky:
    sys.path.append(sticky["hb_lib_path"])

try:
    from honeybeegrasshopper.radiance.material.glass import GlassMaterial
    from honeybeegrasshopper.wrapper import Wrapper
except ImportError:
    raise ImportError("Failed to import Honeybee libraries.\n" + \
                      "Set-up path to Honeybee libraries in honeybee_honeybee component")



if _name and _reflect:
    material = GlassMaterial.bySingleTransValue(_name, _TVis)
    
    material = Wrapper(material)
# ---------- end python_2 ----------
brep = Brep(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)
python_3 = PythonScript(name="wall", reflect=".55", spec=0, rough=0)  # -> material
# ---------- python_3: Python ----------
import sys
from scriptcontext import sticky

if "hb_lib_path" in sticky:
    sys.path.append(sticky["hb_lib_path"])

try:
    from honeybeegrasshopper.radiance.material.plastic import PlasticMaterial
    from honeybeegrasshopper.wrapper import Wrapper
except ImportError:
    raise ImportError("Failed to import Honeybee libraries.\n" + \
                      "Set-up path to Honeybee libraries in honeybee_honeybee component")



if _name and _reflect:
    material = PlasticMaterial.bySingleReflectValue(_name, _reflect, _spec_, _rough_)
    
    material = Wrapper(material)
# ---------- end python_3 ----------
sdivide = DivideSurface(Surface=planesrf, UCount=number_slider, VCount=number_slider)  # -> Points, Normals, Parameters
panel_2 = Panel(python_2)
wires_2 = BrepWireframe(Brep=brep, Density=-1)
preview = CustomPreview(Geometry=brep, Shader=ColourSwatch(SwatchColor=RGBA(211, 208, 255, 72)))
panel_3 = Panel(python_3)
panel_4 = Panel(sky)
panel_5 = Panel(radpar)

# ---- group: I'm not sure if we need this extra step
python_4 = PythonScript(material=python_3)  # -> radProp
# ---------- python_4: Python ----------
import sys
from scriptcontext import sticky

if "hb_lib_path" in sticky:
    sys.path.append(sticky["hb_lib_path"])

try:
    from honeybeegrasshopper.radiance.properties import RadianceProperties
    from honeybeegrasshopper.wrapper import Wrapper
except ImportError:
    raise ImportError("Failed to import Honeybee libraries.\n" + \
                      "Set-up path to Honeybee libraries in honeybee_honeybee component")


radProp = RadianceProperties(_material_.unwrap(), True) if _material_ else RadianceProperties()
radProp = Wrapper(radProp)
# ---------- end python_4 ----------

# ----
python_5 = PythonScript(material=python_2)  # -> radProp; same code as python_4
move = Move(Geometry=sdivide.Points, Motion="0,0,0.05")  # -> Geometry, Transform
panel_6 = Panel(python_5)

# ---- group: analysis recipe
gridbased = PythonScript(HBSky=sky, testPoints=move.Geometry, ptsVectors=sdivide.Normals, radParameters=radpar)  # -> analysisRecipe; inputs testPoints: tree of Point3d, ptsVectors: tree of Vector3d
# ---------- gridbased: Python ----------
import sys
from scriptcontext import sticky

if "hb_lib_path" in sticky:
    sys.path.append(sticky["hb_lib_path"])

try:
    from honeybeegrasshopper.radiance.recipe.gridbased import GridBasedAnalysisRecipe
    from honeybeegrasshopper import wrapper
except ImportError:
    raise ImportError("Failed to import Honeybee libraries.\n" + \
                      "Set-up path to Honeybee libraries in honeybee_honeybee component")

if _HBSky and _testPoints and ptsVectors_:
    if _radParameters_:
        _radParameters_ = _radParameters_.unwrap()
    
    analysisRecipe = GridBasedAnalysisRecipe(
        _HBSky.unwrap(), _testPoints, ptsVectors_, _radParameters_
        )
    
    analysisRecipe = wrapper.Wrapper(analysisRecipe)
# ---------- end gridbased ----------

# ----
panel_7 = Panel(python_4)

# ---- group: HBHive is not implemented yet- the component outputs the surface itself
python_6 = PythonScript(geo=planesrf, radProp=python_4)  # -> readMe, HBSrf; inputs geo: GeometryBase, type: Int32
# ---------- python_6: Python ----------
import sys
from scriptcontext import sticky

if "hb_lib_path" in sticky:
    sys.path.append(sticky["hb_lib_path"])

try:
    from honeybeegrasshopper.hbsurface import HBSurface
    from honeybeegrasshopper.wrapper import Wrapper
except ImportError:
    raise ImportError("Failed to import Honeybee libraries.\n" + \
                      "Set-up path to Honeybee libraries in honeybee_honeybee component")

from uuid import uuid4

if _geo:
    
    isNameSetByUser = True
    if not name_:
        name_ = "Surface_%s" % uuid4()
        isNameSetByUser = False
        
    isTypeSetByUser = True
    if not _type_:
        isTypeSetByUser = False
    
    radProp_ = radProp_.unwrap() if radProp_ else None
    
    epProp_ = epProp_.unwrap() if epProp_ else None
    
    HBSrf = HBSurface(name_, _geo, _type_, isNameSetByUser,isTypeSetByUser,
                      radProp_, epProp_)

    HBSrf = Wrapper(HBSrf)
# ---------- end python_6 ----------

# ----
python_7 = PythonScript(geo=brep, radProp=python_5)  # -> readMe, HBSrf; inputs geo: GeometryBase, type: Int32; same code as python_6
panel_8 = Panel(python_6.HBSrf)
panel_9 = Panel(gridbased)
toggle = BooleanToggle(True)
python_8 = PythonScript(
    recipe=gridbased,
    HBObjs=[python_6.HBSrf, python_7.HBSrf],
    folder="c:\ladybug",
    name="untitled",
    write=toggle,
    run=toggle)  # -> readMe, results; inputs HBObjs: tree, write: Boolean, run: Boolean
# ---------- python_8: Python ----------
_HBObjs.Flatten()
_HBObjs = _HBObjs.Branch(0)

if _HBObjs and _recipe:
    _recipe = _recipe.unwrap()
    _HBObjs = [objs.unwrap() for objs in _HBObjs]

    if _write:
        _recipe.hbObjects = _HBObjs
        _recipe.writeToFile(_folder_, _name_)
    
    if _write and run_:
        results = _recipe.run(False)
# ---------- end python_8 ----------
panel_10 = Panel(python_8.readMe)
pt = Point(move.Geometry)

# ---- group: haven't implemnted read results!
honeybee = Honeybee_Honeybee()  # -> Vviiiiiiiiiizzz; plug-in component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
readradresults = Honeybee_ReadRADResult(analysisType="0", resultFiles=python_8.results, testPts=pt, writeToFile=False)  # -> readMe, unit, values; plug-in component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

# ----
bnd = Bounds(Numbers=flatten(readradresults.values))
round = Round(Number=readradresults.values)  # -> Nearest, Floor, Ceiling
dedomain = DeconstructDomain(Domain=bnd)  # -> Start, End
gradient = Gradient(
    LowerLimit=dedomain.End,
    UpperLimit=dedomain.Start,
    Parameter=readradresults.values,
    stops=[0: RGB(234, 38, 0), 0.25: RGB(234, 126, 0), 0.5: RGB(254, 244, 84), 0.75: RGB(173, 203, 249), 1: RGB(75, 107, 169)])
preview_2 = CustomPreview(Geometry=pt, Shader=gradient)
