# Dynamo graph gridbased_sample.dyn (Dynamo 0.9.2.4472)

code_block = CodeBlock()
# ---------- code_block.designscript (2 lines) ----------
{"C:\\Users\\Administrator\\Documents\\GitHub\\honeybeex",
"C:\Program Files (x86)\IronPython 2.7\Lib"};
# ----------------------------------------
code_block_2 = CodeBlock { 0; }

# group: Radiance Parameters
python_script = Python(IN[0]=code_block, IN[1]=code_block_2)
# ---------- python_script.python (16 lines) ----------
import sys
sys.path.extend(IN[0])

try:
    from honeybeex.radiance.parameters.gridbased import GridBasedParameters
    from honeybeex import wrapper
except ImportError:
    raise ImportError("Failed to import Honeybee libraries.\n" + \
                      "Set-up path to Honeybee libraries in honeybee_honeybee component")

_quality = IN[1]
if _quality is not None:
    radParameters = GridBasedParameters(_quality)
 
    #wrap the object
    OUT = wrapper.Wrapper(radParameters)
# ----------------------------------------

watch = Watch(python_script)
code_block_3 = CodeBlock { "g_material"; 0.65; }

# group: Glass Materials
python_script_2 = Python(IN[0]=code_block, IN[1]=code_block_3.out0, IN[2]=code_block_3.out1)
# ---------- python_script_2.python (18 lines) ----------
import sys
sys.path.extend(IN[0])

try:
    from honeybeex.radiance.material.glass import GlassMaterial
    from honeybeex.wrapper import Wrapper
except ImportError:
    raise ImportError("Failed to import Honeybee libraries.\n" + \
                      "Set-up path to Honeybee libraries in honeybee_honeybee component")



_name, _TVis = IN[1:]

if _name and _TVis:
    material = GlassMaterial.bySingleTransValue(_name, _TVis)
    
    OUT = Wrapper(material)
# ----------------------------------------

watch_2 = Watch(python_script_2)
code_block_4 = CodeBlock { 10000; }

# group: generate sky
python_script_3 = Python(IN[0]=code_block, IN[1]=code_block_4)
# ---------- python_script_3.python (13 lines) ----------
import sys
sys.path.extend(IN[0])

try:
	from honeybeex.radiance.sky.certainIlluminance import SkyWithCertainIlluminanceLevel
	from honeybeex.wrapper import Wrapper
except ImportError as e:
    raise ImportError("Failed to import Honeybee libraries.\n" + \
                      "Set-up path to Honeybee libraries in honeybee_honeybee component:\n%s"%e)

_illuminanceValue = IN[1]
if _illuminanceValue:
    OUT = Wrapper(SkyWithCertainIlluminanceLevel(_illuminanceValue))
# ----------------------------------------

code_block_5 = CodeBlock { 13; }
code_block_6 = CodeBlock { 9; }
code_block_7 = CodeBlock { 5; }
code_block_8 = CodeBlock(x=code_block_5, y=code_block_6, z=code_block_7) { x/2; y/2; z/2; }
byCoordinates = Point.ByCoordinates(x=code_block_8.out0, y=code_block_8.out1, z=code_block_8.out2)
byLengths = Cuboid.ByLengths(origin=byCoordinates, width=code_block_5, length=code_block_6, height=code_block_7)
explode = Geometry.Explode(byLengths)
code_block_9 = CodeBlock(x=explode) { x[1]; }
code_block_10 = CodeBlock { 0.5; }
pointAtParameter = Surface.PointAtParameter(surface=code_block_9, u=code_block_10, v=code_block_10)
byOriginNormal = Plane.ByOriginNormal(origin=pointAtParameter)
code_block_11 = CodeBlock { 0.98; }
scale = Geometry.Scale(code_block_9, byOriginNormal, code_block_11, code_block_11, code_block_11)
code_block_12 = CodeBlock { 12; }
code_block_13 = CodeBlock { 0.762; }
generate_test_points = Custom[Generate Test Points](testSurfaces=scale, numOfSegments=code_block_12, disFromSurface=code_block_13)  # Generate test points from a surface based on number of segments and distance from the surface
code_block_14 = CodeBlock { 0; }

# group: grid based analysis recipe
analysis_recipe = Python(IN[0]=code_block, IN[1]=python_script_3, IN[2]=generate_test_points.testPts, IN[3]=generate_test_points.ptsNormal, IN[4]=code_block_14, IN[5]=python_script)
# ---------- analysis_recipe.python (22 lines) ----------
import sys
sys.path.extend(IN[0])

try:
    from honeybeex.radiance.recipe.gridbased import GridBasedAnalysisRecipe
    from honeybeex import wrapper
except ImportError:
    raise ImportError("Failed to import Honeybee libraries.\n" + \
                      "Set-up path to Honeybee libraries in honeybee_honeybee component")


_HBSky, _testPoints, ptsVectors_, _simType, _radParameters_ = IN[1:]

if _HBSky and _testPoints and ptsVectors_:
    if _radParameters_:
        _radParameters_ = _radParameters_.unwrap()
    
    analysisRecipe = GridBasedAnalysisRecipe(
        _HBSky.unwrap(), _testPoints, ptsVectors_, _simType, _radParameters_
        )
    
    OUT = wrapper.Wrapper(analysisRecipe)
# ----------------------------------------

watch_3 = Watch(analysis_recipe)
watch_4 = Watch(python_script_3)

# group: Radiance Properties
python_script_4 = Python(IN[0]=code_block, IN[1]=python_script_2)
# ---------- python_script_4.python (15 lines) ----------
import sys
sys.path.extend(IN[0])

try:
    from honeybeex.radiance.properties import RadianceProperties
    from honeybeex.wrapper import Wrapper
except ImportError:
    raise ImportError("Failed to import Honeybee libraries.\n" + \
                      "Set-up path to Honeybee libraries in honeybee_honeybee component")


_material_ = IN[1]
radProp = RadianceProperties(_material_.unwrap(), True) if _material_ else RadianceProperties()

OUT = Wrapper(radProp)
# ----------------------------------------

watch_5 = Watch(python_script_4)
code_block_15 = CodeBlock()
# ---------- code_block_15.designscript (5 lines) ----------
{{-0.810513, 0.579652, -0.084093}, {-0.67166, 0.702357, -0.235729},
                           {-0.487065, 0.798284, -0.354275}, {-0.269301, 0.8609, -0.431657},
                           {-0.033196, 0.885943, -0.462605}, {0.20517, 0.871705, -0.445013},
                           {0.429563, 0.819156, -0.380077}, {0.624703, 0.731875, -0.272221},
                           {0.777301, 0.615806, -0.128788}};
# ----------------------------------------
code_block_16 = CodeBlock { 1; 1000; }

# group: sunlighthours analysis recipe
# note: Inputs are:
# sun vectors
# points,
# vectors,
# timestep,
# and ambient division
analysis_recipe_2 = Python(IN[0]=code_block, IN[1]=code_block_15, IN[2]=generate_test_points.testPts, IN[3]=generate_test_points.ptsNormal, IN[4]=code_block_16.out0, IN[5]=code_block_16.out1)
# ---------- analysis_recipe_2.python (20 lines) ----------
import sys
sys.path.extend(IN[0])

try:
    from honeybeex.radiance.recipe.sunlighthours import SunlightHoursAnalysisRecipe
    from honeybeex import wrapper
except ImportError:
    raise ImportError("Failed to import Honeybee libraries.\n" + \
                      "Set-up path to Honeybee libraries in honeybee_honeybee component")


_sunVectors, _testPoints, ptsVectors_, _timestep_, _ad_ = IN[1:]

if _sunVectors and _testPoints and ptsVectors_:
    
    analysisRecipe = SunlightHoursAnalysisRecipe(_sunVectors,
        _testPoints, ptsVectors_, _timestep_, _ad_
        )
    
    OUT = wrapper.Wrapper(analysisRecipe)
# ----------------------------------------

code_block_17 = CodeBlock(x=explode) { x[2]; List.RemoveItemAtIndex(x, 2); }
code_block_18 = CodeBlock { "opaque"; }
python_script_5 = Python(IN[0]=code_block, IN[1]=code_block_17.out1, IN[2]=code_block_18)
# ---------- python_script_5.python (68 lines) ----------
import sys
sys.path.extend(IN[0])

try:
    from honeybeex.hbsurface import HBSurface
    from honeybeex.wrapper import Wrapper
except ImportError:
    raise ImportError("Failed to import Honeybee libraries.\n" + \
                      "Set-up path to Honeybee libraries in honeybee_honeybee component")

from uuid import uuid4

# create list from inputs if it's not a list
_geo, name_, _type_, radProp_, epProp_ = IN[1:]

if _geo:
    
    # this is not good practice. I need to find a better generic solution for
    # dynamo inputs
    for count, inp in enumerate(IN):
        if not hasattr(inp, '__iter__'):
            IN[count] = [inp]
    
    _geos, names_, _types_, radProps_, epProps_ = IN[1:]
    
    HBSrfs = range(len(_geos))
    
    for count, _geo in enumerate(_geos):
        try:
            name_ = names_[count]
        except IndexError:
            name_ = names_[0] + "_{}".format(count)
        
        isNameSetByUser = True
        if not name_:
            name_ = "Surface_%s" % uuid4()
            isNameSetByUser = False
        
        try:
            _type_ = _types_[count]
        except IndexError:
            _type_ = _types_[0]
    
        isTypeSetByUser = True
        if not _type_:
            isTypeSetByUser = False

        try:
            radProp_ = radProps_[count]
        except IndexError:
            radProp_ = radProps_[0]
            
        radProp_ = radProp_.unwrap() if radProp_ else None

        try:
            epProp_ = epProps_[count]
        except IndexError:
            epProp_ = epProps_[0]
            
        epProp_ = epProp_.unwrap() if epProp_ else None
    
        HBSrf = HBSurface(name_, _geo, _type_, isNameSetByUser, isTypeSetByUser,
                          radProp_, epProp_)
    
        HBSrfs[count] = Wrapper(HBSrf)

    
    OUT = HBSrfs
# ----------------------------------------
code_block_19 = CodeBlock { "glass_wall"; }

# group: Honeybee Surface
python_script_6 = Python(IN[0]=code_block, IN[1]=code_block_17.out0, IN[2]=code_block_19, IN[4]=python_script_4)  # same code as python_script_5

# group: I assume there is a better way to merge lists that I'm not aware of!
create = List.Create(python_script_5, python_script_6)
flatten = Flatten(create)

code_block_20 = CodeBlock { "c:\ladybug"; "untitled2"; }
boolean = BoolSelector(true)
boolean_2 = BoolSelector(true)

# group: Run Analysis
python_script_7 = Python(IN[0]=code_block, IN[1]=analysis_recipe_2, IN[2]=flatten, IN[3]=code_block_20.out0, IN[4]=code_block_20.out1, IN[5]=boolean, IN[6]=boolean_2)
# ---------- python_script_7.python (28 lines) ----------
import sys
sys.path.extend(IN[0])
import time

_recipe, _HBObjs, _folder_, _name_, _write, run_ = IN[1:]

if _HBObjs and _recipe and _write:
    try:
        _HBObjs = [objs.unwrap() for objs in _HBObjs]
    except AttributeError:
        raise AttributeError(" At least one of the inputs in _HBObjs is not a valid Honeybee object.")
   
    try:
       _recipe= _recipe.unwrap()
    except AttributeError:
        raise AttributeError(" Can't read the analysis recipe.")

    if _write:
        # Add Honeybee objects to the recipe
        _recipe.hbObjects = _HBObjs
        # try:
        _recipe.writeToFile(_folder_, _name_)
        # except AttributeError, e:
        #     raise ValueError(" Expected a recipe not a %s:\n%s" % (type(_recipe), str(e)))

    if _write and run_:
        if _recipe.run(False):
        	OUT = _recipe.results()
# ----------------------------------------

unflattenList = Python(IN[0]=generate_test_points.testPts, IN[1]=python_script_7)
# ---------- unflattenList.python (18 lines) ----------
def unflatten(guide, flattenedInput):
    """Unflatten a falttened generator
        guide: A guide list to follow the structure
        falttenedInput: A flattened iterator object

        Usage:
            guide = [["a"], ["b","c","d"], [["e"]], ["f"]]
            inputList = [0, 1, 2, 3, 4, 5, 6, 7]
            unflatten(guide, iter(inputList))
            >> [[0], [1, 2, 3], [[4]], [5]]
    """
    if isinstance(flattenedInput, list):
    	flattenedInput = iter(flattenedInput)
    	
    return [unflatten(subList, flattenedInput) if isinstance(subList, list) else next(flattenedInput) for subList in guide]


OUT = unflatten(*IN)
# ----------------------------------------
color_surface = Custom[Color Surface](analysisSurfaces=scale, values=unflattenList)  # Color a test surface based on the results of a study. The results structure should match the test points structure to be mapped correctly on the surface.
watch_6 = Watch(python_script_6)
code_block_21 = CodeBlock { 1; }
lb_color_range = Custom[LB Color Range](index=code_block_21)  # A set of color ranges for coloring analysis results
legend_parameters = Custom[Legend Parameters](colors=lb_color_range.colors)  # Use legend parameter to set up results visualization setting
