# Grasshopper definition gridbased_sample.gh (Grasshopper 0.9.76)
# plug-ins: Python Interpreter

number_slider = Slider(200, range=0..1000)
number_slider_2 = Slider(2, range=0..10)
constructlocation = Ladybug_ConstructLocation(locationName="unknown_Location", latitude="36", longitude=0, timeZone=0, elevation=0)  # -> location; plug-in component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
number_slider_3 = Slider(6, range=0..10)
series = Series(Start=0, Step=1, Count="24")
python = PythonScript(path_to_honeybee_libs="C:\Users\Administrator\Documents\GitHub\honeybeex")  # -> readMe
# ---------- python: Python ----------
from scriptcontext import sticky

sticky["hb_lib_path"] = path_to_honeybee_libs
# ---------- end python ----------

# ---- group: Radiance parameters
radpar = PythonScript(quality=Slider(0, range=0..10))  # -> radParameters; inputs quality: Int32, ab: Int32, ad: Int32, as: Int32, ar: Int32
# ---------- radpar: Python ----------
import sys
from scriptcontext import sticky

if "hb_lib_path" in sticky:
    sys.path.append(sticky["hb_lib_path"])

try:
    from honeybeex.radiance.parameters.gridbased import GridBasedParameters
    from honeybeex import wrapper
except ImportError:
    raise ImportError("Failed to import Honeybee libraries.\n" + \
                      "Set-up path to Honeybee libraries in honeybee_honeybee component")

if _quality is not None:
    radParameters = GridBasedParameters(_quality)
    if _ab_: radParameters.ab = _ab_
    if _ad_: radParameters.ad = _ad_
    if _as_: radParameters.as_ = _as_
    if _ar_: radParameters.ar = _ar_
    if _aa_: radParameters.aa = _aa_
    
    #wrap the object
    radParameters = wrapper.Wrapper(radParameters)
# ---------- end radpar ----------

# ----
brep = Brep(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)

# ---- group: sky library
sky = PythonScript(illuminanceValue="20000")  # -> HBSky
# ---------- sky: Python ----------
import sys
from scriptcontext import sticky

if "hb_lib_path" in sticky:
    sys.path.append(sticky["hb_lib_path"])

try:
    from honeybeex.radiance.sky.certainIlluminance import SkyWithCertainIlluminanceLevel
    from honeybeex.wrapper import Wrapper
except ImportError:
    raise ImportError("Failed to import Honeybee libraries.\n" + \
                      "Set-up path to Honeybee libraries in honeybee_honeybee component")

if _illuminanceValue:
    HBSky = Wrapper(SkyWithCertainIlluminanceLevel(_illuminanceValue))
# ---------- end sky ----------

# ----
panel = Panel("""1
2
3
4
5""")
python_2 = PythonScript(name="g_material", TVis=".65")  # -> material
# ---------- python_2: Python ----------
import sys
from scriptcontext import sticky

if "hb_lib_path" in sticky:
    sys.path.append(sticky["hb_lib_path"])

try:
    from honeybeex.radiance.material.glass import GlassMaterial
    from honeybeex.wrapper import Wrapper
except ImportError:
    raise ImportError("Failed to import Honeybee libraries.\n" + \
                      "Set-up path to Honeybee libraries in honeybee_honeybee component")



if _name and _TVis:
    material = GlassMaterial.bySingleTransValue(_name, _TVis)
    
    material = Wrapper(material)
# ---------- end python_2 ----------
sunpath = Ladybug_SunPath(
    location=constructlocation,
    hour=series,
    day=21,
    month=12,
    timeStep=1,
    sunPathScale=Slider(0.2, range=0..1),
    dailyOrAnnualSunPath=True)  # -> readMe, sunVectors, sunAltitudes, sunAzimuths, port, sunSpheresMesh, sunPathCrvs, legend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; plug-in component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
brep_2 = Brep(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)
gentestpts = Honeybee_GenerateTestPoints(testGeometry=brep, gridSize=Slider(1, range=0..10), distBaseSrf=Slider(0.762, range=0..1), moveTestMesh=True)  # -> readMe, simplify(testPoints), simplify(ptsVectors), simplify(facesArea), simplify(mesh); plug-in component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
wires = BrepWireframe(Brep=brep, Density=-1)
python_3 = PythonScript(name="wall", reflect=".55", spec=0, rough=0)  # -> material
# ---------- python_3: Python ----------
import sys
from scriptcontext import sticky

if "hb_lib_path" in sticky:
    sys.path.append(sticky["hb_lib_path"])

try:
    from honeybeex.radiance.material.plastic import PlasticMaterial
    from honeybeex.wrapper import Wrapper
except ImportError:
    raise ImportError("Failed to import Honeybee libraries.\n" + \
                      "Set-up path to Honeybee libraries in honeybee_honeybee component")



if _name and _reflect:
    material = PlasticMaterial.bySingleReflectValue(_name, _reflect, _spec_, _rough_)
    
    material = Wrapper(material)
# ---------- end python_3 ----------
panel_2 = Panel(radpar)
panel_3 = Panel(python_2)
wires_2 = BrepWireframe(Brep=brep_2, Density=-1)
brep_3 = Brep([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])
preview = CustomPreview(Geometry=brep_2, Shader=ColourSwatch(SwatchColor=RGBA(211, 208, 255, 64)))
panel_4 = Panel(sky)
panel_5 = Panel(python_3)
python_4 = PythonScript(material=python_2)  # -> radProp
# ---------- python_4: Python ----------
import sys
from scriptcontext import sticky

if "hb_lib_path" in sticky:
    sys.path.append(sticky["hb_lib_path"])

try:
    from honeybeex.radiance.properties import RadianceProperties
    from honeybeex.wrapper import Wrapper
except ImportError:
    raise ImportError("Failed to import Honeybee libraries.\n" + \
                      "Set-up path to Honeybee libraries in honeybee_honeybee component")


radProp = RadianceProperties(_material_.unwrap(), True) if _material_ else RadianceProperties()
radProp = Wrapper(radProp)
# ---------- end python_4 ----------
wires_3 = BrepWireframe(Brep=brep_3, Density=-1)
pt = Point(gentestpts.testPoints)

# ---- group: I'm not sure if we need this extra step
python_5 = PythonScript(material=python_3)  # -> radProp; same code as python_4

# ----
panel_6 = Panel(python_4)
python_6 = PythonScript(geo=brep_2, name="glass_wall", radProp=python_4)  # -> readMe, HBSrf; inputs geo: GeometryBase, type: Int32
# ---------- python_6: Python ----------
import sys
from scriptcontext import sticky

if "hb_lib_path" in sticky:
    sys.path.append(sticky["hb_lib_path"])

try:
    from honeybeex.hbsurface import HBSurface
    from honeybeex.wrapper import Wrapper
except ImportError:
    raise ImportError("Failed to import Honeybee libraries.\n" + \
                      "Set-up path to Honeybee libraries in honeybee_honeybee component")

from uuid import uuid4

if _geo:
    
    isNameSetByUser = True
    if not name_:
        name_ = "Surface_%s" % uuid4()
        isNameSetByUser = False
        
    isTypeSetByUser = True
    if not _type_:
        isTypeSetByUser = False
    
    radProp_ = radProp_.unwrap() if radProp_ else None
    
    epProp_ = epProp_.unwrap() if epProp_ else None
    
    HBSrf = HBSurface(name_, _geo, _type_, isNameSetByUser,isTypeSetByUser,
                      radProp_, epProp_)

    HBSrf = Wrapper(HBSrf)
# ---------- end python_6 ----------
panel_7 = Panel(python_5)

# ---- group: analysis recipe
gridbased = PythonScript(HBSky=sky, testPoints=pt, radParameters=radpar)  # -> analysisRecipe; inputs testPoints: tree of Point3d, ptsVectors: tree of Vector3d, simulationType: Int32
# ---------- gridbased: Python ----------
import sys
from scriptcontext import sticky

if "hb_lib_path" in sticky:
    sys.path.append(sticky["hb_lib_path"])

try:
    from honeybeex.radiance.recipe.gridbased import GridBasedAnalysisRecipe
    from honeybeex import wrapper
except ImportError:
    raise ImportError("Failed to import Honeybee libraries.\n" + \
                      "Set-up path to Honeybee libraries in honeybee_honeybee component")

if _HBSky and _testPoints and ptsVectors_:
    if _radParameters_:
        _radParameters_ = _radParameters_.unwrap()
        
    analysisRecipe = GridBasedAnalysisRecipe(
        _HBSky.unwrap(), _testPoints, ptsVectors_, _simulationType_, _radParameters_
        )
    
    analysisRecipe = wrapper.Wrapper(analysisRecipe)
# ---------- end gridbased ----------

gridbased_2 = PythonScript(sunVectors=sunpath.sunVectors, testPoints=pt, timestep=Slider(1, range=0..1), ad="1000")  # -> analysisRecipe; inputs sunVectors: list of Vector3d, testPoints: tree of Point3d, ptsVectors: tree of Vector3d, timestep: Int32, ad: Int32
# ---------- gridbased_2: Python ----------
import sys
from scriptcontext import sticky

if "hb_lib_path" in sticky:
    sys.path.append(sticky["hb_lib_path"])

try:
    from honeybeex.radiance.recipe.sunlighthours import SunlightHoursAnalysisRecipe
    from honeybeex import wrapper
except ImportError:
    raise ImportError("Failed to import Honeybee libraries.\n" + \
                      "Set-up path to Honeybee libraries in honeybee_honeybee component")

if _sunVectors and _testPoints and ptsVectors_:
    analysisRecipe = SunlightHoursAnalysisRecipe(_sunVectors,
        _testPoints, ptsVectors_, _timestep_, _ad_
    )
    analysisRecipe = wrapper.Wrapper(analysisRecipe)
# ---------- end gridbased_2 ----------

# ---- group: HBHive is not implemented yet- the component outputs the surface itself
python_7 = PythonScript(geo=brep_3, name=panel, radProp=python_5)  # -> readMe, HBSrf; inputs geo: GeometryBase, type: Int32
# ---------- python_7: Python ----------
import sys
from scriptcontext import sticky

if "hb_lib_path" in sticky:
    sys.path.append(sticky["hb_lib_path"])

try:
    from honeybeex.hbsurface import HBSurface
    from honeybeex.wrapper import Wrapper
except ImportError:
    raise ImportError("Failed to import Honeybee libraries.\n" + \
                      "Set-up path to Honeybee libraries in honeybee_honeybee component")

from uuid import uuid4

if _geo:
    
    isNameSetByUser = True
    if not name_:
        name_ = "Surface_%s" % uuid4()
        isNameSetByUser = False
        
    isTypeSetByUser = True
    if not _type_:
        isTypeSetByUser = False
    
    radProp_ = radProp_.unwrap() if radProp_ else None
    
    epProp_ = epProp_.unwrap() if epProp_ else None
    
    HBSrf = HBSurface(name_, _geo, _type_, isNameSetByUser, isTypeSetByUser,
                      radProp_, epProp_)

    HBSrf = Wrapper(HBSrf)
# ---------- end python_7 ----------

# ----
number_slider_4 = Slider(0.01, range=0..0.01)
panel_8 = Panel(gridbased_2)

# ---- group: visualizeGeometry
python_8 = PythonScript()  # -> geo; inputs HBObjs: list
# ---------- python_8: Python ----------
geo = [hbo.unwrap().geometry for hbo in HBObjs if hasattr(hbo, 'unwrap')
    and hasattr(hbo.unwrap(), 'isHBObject')]
# ---------- end python_8 ----------

# ----
panel_9 = Panel(python_7.HBSrf)
sunlighthoursanalysis = Ladybug_SunlightHoursAnalysis(
    geometry=flatten(gentestpts.mesh),
    context=flatten(brep_3),
    gridSize=number_slider_4,
    disFromBase=number_slider_4,
    sunVectors=flatten(sunpath.sunVectors),
    timeStep=1,
    runIt=Toggle(True))  # -> readMe, contextMesh, analysisMesh, testPts, testVec, port, sunlightHoursResult, sunlightHoursMesh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; plug-in component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
toggle = BooleanToggle(True)
python_9 = PythonScript(
    recipe=gridbased_2,
    HBObjs=[python_7.HBSrf, python_6.HBSrf],
    folder="c:\ladybug",
    name="untitled",
    write=toggle,
    run=toggle)  # -> readMe, results; inputs HBObjs: tree, write: Boolean, run: Boolean
# ---------- python_9: Python ----------
_HBObjs.Flatten()
_HBObjs = _HBObjs.Branch(0)

if _HBObjs and _recipe and _write:
    try:
        _HBObjs = [objs.unwrap() for objs in _HBObjs]
    except AttributeError:
        raise AttributeError(" At least one of the inputs in _HBObjs is not a valid Honeybee object.")
   
    try:
       _recipe= _recipe.unwrap()
    except AttributeError:
        raise AttributeError(" Can't read the analysis recipe.")

    if _write:
        # Add Honeybee objects to the recipe
        _recipe.hbObjects = _HBObjs
#        try:
        _recipe.writeToFile(_folder_, _name_)
#        except AttributeError:
#            raise ValueError(" Expected a recipe not a %s" % type(_recipe))

    if _write and run_:
        if _recipe.run(False):
            results = _recipe.results()
# ---------- end python_9 ----------
num = Number(python_9.results)
num_2 = Number(sunlighthoursanalysis.sunlightHoursResult)
filter = StreamFilter(Gate=Slider(1, range=0..1), Stream0=num_2, Stream1=num)

ladybug = Ladybug_Ladybug()  # -> Vviiiiiiiiiizzz; plug-in component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
recolormesh = Ladybug_RecolorMesh(analysisResult=filter, inputMesh=gentestpts.mesh, heightDomain="0 To 2")  # -> readMe, newMesh, newLegend, legendBasePt, meshColors, legendColors; plug-in component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

graph = QuickGraph([num_2, num])

# ---- group: test unit logger / This is an internalized copy of the component below.
txt = Text(flatten(["Uniform CIE sky [10000.00 lux]", "-aa 0.1 -ab 6 -ad 4096 -ar 128 -as 4096 -av 0 -dc 0.75 -dj 0.7 -dp 512 -dr 3 -ds 0.05 -dt 0.15 -lr 8 -lw 0.005 -pj 0.9 -ps 2 -pt 0.05 -st 0.15", """void plastic wall
0
0
5 0.550 0.550 0.550 0.000 0.000""", "HBSurface: 1", "HBSurface: 2", "HBSurface: 3", "HBSurface: 4", "HBSurface: 5", """void glass g_material
0
0
4 0.708 0.708 0.708 1.520""", "Radiance Properties > g_material", "HBSurface: glass_wall", "GridBasedAnalysisRecipe #PointGroup: 1 #Points: 117", "Number of total materials: 4", "Number of total surfaces: 6", "Files are written to: c:\ladybug\untitled\gridbased"]))

# ---- group: test unit logger
txt_2 = Text(flatten([sky, gridbased, radpar, python_3, python_7.HBSrf, python_2, python_4, python_6.HBSrf, python_9.readMe]))
python_10 = PythonScript(expected=txt, values=txt_2)  # inputs expected: list, values: list
# ---------- python_10: Python ----------
import os

fn = ghenv.Component.OnPingDocument().FilePath

logfn = "".join(fn.split(".")[:-1]) + ".log"

log = []

if len(expected)!=len(values):
    log.append("Failed! >> Number values are not as expected.")
else:
    log = ["Passed! >> %s" % (e.replace("\n", " ")) if e==v else "Failed! >> Expected %s NOT %s" % (e, v) for e, v in zip(expected, values)]

with open(logfn, "w") as outf:
    report = "\n".join(log)
    f = report.count("Failed!")
    p = report.count("Passed!")
    header = "%d Failed %d Passed\n" % (f, p)
    
    outf.write(header + report)

if f!=0:
    raise Exception("Test Failed!\nCheck %s for full report." % logfn)
# ---------- end python_10 ----------

# ----
panel_10 = Panel("C:\ladybug\untitled1\gridbased\untitled1.rad")
lookupfolder_daylighting = Honeybee_LookupDaylightingFolder(studyFolder="C:\ladybug\untitled1\gridbased")  # -> analysisType, resultsUnit, resultFiles, ptsFiles, hdrFiles, imageFiles, iesFiles, epwFile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; plug-in component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
importpts = Honeybee_ImportPtsFile(ptsFileAddress=lookupfolder_daylighting.ptsFiles)  # -> points, vectors; plug-in component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
path = FilePath(panel_10)
importrad = Honeybee_ImportRad(radianceFile=path)  # -> RADMaterials, RADSurfaces; plug-in component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
file = ReadFile(File=panel_10, PerLineParse=True)
readradresults = Honeybee_ReadRADResult(resultFiles=lookupfolder_daylighting.resultFiles, testPts=importpts.points, writeToFile=False)  # -> readMe, unit, values; plug-in component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
panel_11 = Panel(file)
bnd = Bounds(Numbers=readradresults.values)
gradientlibrary = Ladybug_GradientLibrary(gradIndex=Slider(2, range=0..10))  # -> customColors; plug-in component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
evalsrf = EvaluateSurface(Surface=reparameterize(importrad.RADSurfaces), Point="{0.5, 0.5, 0}")  # -> Point, Normal, Frame
dedomain = DeconstructDomain(Domain=bnd)  # -> Start, End
gradient = Gradient(
    LowerLimit=dedomain.End,
    UpperLimit=dedomain.Start,
    Parameter=readradresults.values,
    stops=[0: RGB(234, 38, 0), 0.25: RGB(234, 126, 0), 0.5: RGB(254, 244, 84), 0.75: RGB(173, 203, 249), 1: RGB(75, 107, 169)])
vdis = VectorDisplay(Anchor=evalsrf.Point, Vector=evalsrf.Normal)
preview_2 = CustomPreview(Geometry=importpts.points, Shader=gradient)
