# Dynamo graph gridbased_sample_REVIT.dyn (Dynamo 1.0.0.193)

code_block = CodeBlock()
# ---------- code_block.designscript (2 lines) ----------
{"C:\\Users\\Administrator\\AppData\\Roaming\\Dynamo\\Dynamo Revit\\1.0\\packages\\Honeybee\\extra\\honeybeex",
"C:\Program Files (x86)\IronPython 2.7\Lib"};
# ----------------------------------------
code_block_2 = CodeBlock { 0; }

# group: Radiance Parameters
python_script = Python(IN[0]=code_block, IN[1]=code_block_2)
# ---------- python_script.python (16 lines) ----------
import sys
sys.path.extend(IN[0])

try:
    from honeybeex.radiance import parameters
    from honeybeex import wrapper
except ImportError:
    raise ImportError("Failed to import Honeybee libraries.\n" + \
                      "Set-up path to Honeybee libraries in honeybee_honeybee component")

_quality = IN[1]
if _quality:
    radParameters = parameters.RadianceParameters(_quality)
 
    #wrap the object
    OUT = wrapper.Wrapper(radParameters)
# ----------------------------------------

watch = Watch(python_script)
code_block_3 = CodeBlock { "g_material"; 0.65; }

# group: Glass Materials
python_script_2 = Python(IN[0]=code_block, IN[1]=code_block_3.out0, IN[2]=code_block_3.out1)
# ---------- python_script_2.python (18 lines) ----------
import sys
sys.path.extend(IN[0])

try:
    from honeybeex.radiance.material.glass import GlassMaterial
    from honeybeex.wrapper import Wrapper
except ImportError:
    raise ImportError("Failed to import Honeybee libraries.\n" + \
                      "Set-up path to Honeybee libraries in honeybee_honeybee component")



_name, _TVis = IN[1:]

if _name and _TVis:
    material = GlassMaterial.bySingleTransValue(_name, _TVis)
    
    OUT = Wrapper(material)
# ----------------------------------------

watch_2 = Watch(python_script_2)
code_block_4 = CodeBlock { 10000; }

# group: generate sky
python_script_3 = Python(IN[0]=code_block, IN[1]=code_block_4)
# ---------- python_script_3.python (13 lines) ----------
import sys
sys.path.extend(IN[0])

try:
	from honeybeex.radiance.sky.certainIlluminance import SkyWithCertainIlluminanceLevel
	from honeybeex.wrapper import Wrapper
except ImportError as e:
    raise ImportError("Failed to import Honeybee libraries.\n" + \
                      "Set-up path to Honeybee libraries in honeybee_honeybee component:\n%s"%e)

_illuminanceValue = IN[1]
if _illuminanceValue:
    OUT = Wrapper(SkyWithCertainIlluminanceLevel(_illuminanceValue))
# ----------------------------------------

categories = Categories("Floors")
all_elements_of_category = ElementsOfCategory(categories)
solids = Element.Solids(all_elements_of_category)
floor = Flatten(solids)
floor_top_face = Python(IN[0]=floor)
# ---------- floor_top_face.python (1 lines) ----------
OUT = IN[0][0].Explode()[3]
# ----------------------------------------
floor_top_face_2 = CodeBlock(floorTopFace=floor_top_face) { floorTopFace; }
code_block_5 = CodeBlock { 0.5; }
# note: scale flloor to create test points
pointAtParameter = Surface.PointAtParameter(surface=floor_top_face_2, u=code_block_5, v=code_block_5)
byOriginNormal = Plane.ByOriginNormal(origin=pointAtParameter)
code_block_6 = CodeBlock { 0.98; }
scale = Geometry.Scale(floor_top_face_2, byOriginNormal, code_block_6, code_block_6, code_block_6)
code_block_7 = CodeBlock { 20; }
code_block_8 = CodeBlock { 1.2; }
generate_test_points = Custom[Generate Test Points](testSurfaces=scale, numOfSegments=code_block_7, disFromSurface=code_block_8)  # Generate test points from a surface based on number of segments and distance from the surface
code_block_9 = CodeBlock { 0; }

# group: analysis recipe
analysis_recipe = Python(IN[0]=code_block, IN[1]=python_script_3, IN[2]=generate_test_points.testPts, IN[3]=generate_test_points.ptsNormal, IN[4]=code_block_9, IN[5]=python_script)
# ---------- analysis_recipe.python (22 lines) ----------
import sys
sys.path.extend(IN[0])

try:
    from honeybeex.radiance.recipe.gridbased import GridBasedAnalysisRecipe
    from honeybeex import wrapper
except ImportError:
    raise ImportError("Failed to import Honeybee libraries.\n" + \
                      "Set-up path to Honeybee libraries in honeybee_honeybee component")


_HBSky, _testPoints, ptsVectors_, _simType, _radParameters_ = IN[1:]

if _HBSky and _testPoints and ptsVectors_:
    if _radParameters_:
        _radParameters_ = _radParameters_.unwrap()
    
    analysisRecipe = GridBasedAnalysisRecipe(
        _HBSky.unwrap(), _testPoints, ptsVectors_, _simType, _radParameters_
        )
    
    OUT = wrapper.Wrapper(analysisRecipe)
# ----------------------------------------

watch_3 = Watch(analysis_recipe)
watch_4 = Watch(python_script_3)
python_script_4 = Python(IN[0]=code_block, IN[1]=python_script_2)
# ---------- python_script_4.python (15 lines) ----------
import sys
sys.path.extend(IN[0])

try:
    from honeybeex.radiance.properties import RadianceProperties
    from honeybeex.wrapper import Wrapper
except ImportError:
    raise ImportError("Failed to import Honeybee libraries.\n" + \
                      "Set-up path to Honeybee libraries in honeybee_honeybee component")


_material_ = IN[1]
radProp = RadianceProperties(_material_.unwrap(), True) if _material_ else RadianceProperties()

OUT = Wrapper(radProp)
# ----------------------------------------
watch_5 = Watch(python_script_4)
categories_2 = Categories("Walls")
all_elements_of_category_2 = ElementsOfCategory(categories_2)
solids_2 = Element.Solids(all_elements_of_category_2)
walls = Flatten(solids_2)
walls_2 = CodeBlock(Walls=walls) { Walls; }
categories_3 = Categories("Windows")
all_elements_of_category_3 = ElementsOfCategory(categories_3)
solids_3 = Element.Solids(all_elements_of_category_3)
python_script_5 = Python(IN[0]=solids_3)
# ---------- python_script_5.python (2 lines) ----------
#Assign your output to the OUT variable.
OUT = [x[:3] + x[4:]  for x in IN[0]], [x[3].Explode()[1] for x in IN[0]]
# ----------------------------------------
frames = CodeBlock(x=python_script_5) { x[0]; }
frames_2 = Flatten(frames)
frames_3 = CodeBlock(Frames=frames_2) { Frames; }
floor_2 = CodeBlock(Floors=floor) { Floors; }
categories_4 = Categories("Roofs")
all_elements_of_category_4 = ElementsOfCategory(categories_4)
solids_4 = Element.Solids(all_elements_of_category_4)
roof = Flatten(solids_4)
roof_2 = CodeBlock(Roofs=roof) { Roofs; }
create = List.Create(walls_2, frames_3, floor_2, roof_2)
flatten = Flatten(create)
python_script_6 = Python(IN[0]=flatten)
# ---------- python_script_6.python (1 lines) ----------
OUT = [s.Explode() for s in IN[0]]
# ----------------------------------------
flatten_2 = Flatten(python_script_6)
code_block_10 = CodeBlock { "opaque"; }
python_script_7 = Python(IN[0]=code_block, IN[1]=flatten_2, IN[2]=code_block_10)
# ---------- python_script_7.python (68 lines) ----------
import sys
sys.path.extend(IN[0])

try:
    from honeybeex.hbsurface import HBSurface
    from honeybeex.wrapper import Wrapper
except ImportError:
    raise ImportError("Failed to import Honeybee libraries.\n" + \
                      "Set-up path to Honeybee libraries in honeybee_honeybee component")

from uuid import uuid4

# create list from inputs if it's not a list
_geo, name_, _type_, radProp_, epProp_ = IN[1:]

if _geo:
    
    # this is not good practice. I need to find a better generic solution for
    # dynamo inputs
    for count, inp in enumerate(IN):
        if not hasattr(inp, '__iter__'):
            IN[count] = [inp]
    
    _geos, names_, _types_, radProps_, epProps_ = IN[1:]
    
    HBSrfs = range(len(_geos))
    
    for count, _geo in enumerate(_geos):
        try:
            name_ = names_[count]
        except IndexError:
            name_ = names_[0] + "_{}".format(count)
        
        isNameSetByUser = True
        if not name_:
            name_ = "Surface_%s" % uuid4()
            isNameSetByUser = False
        
        try:
            _type_ = _types_[count]
        except IndexError:
            _type_ = _types_[0]
    
        isTypeSetByUser = True
        if not _type_:
            isTypeSetByUser = False

        try:
            radProp_ = radProps_[count]
        except IndexError:
            radProp_ = radProps_[0]
            
        radProp_ = radProp_.unwrap() if radProp_ else None

        try:
            epProp_ = epProps_[count]
        except IndexError:
            epProp_ = epProps_[0]
            
        epProp_ = epProp_.unwrap() if epProp_ else None
    
        HBSrf = HBSurface.fromGeometry(name_, _geo, _type_, isNameSetByUser, isTypeSetByUser,
                          radProp_, epProp_)
    
        HBSrfs[count] = Wrapper(HBSrf)

    
    OUT = HBSrfs
# ----------------------------------------
single_glazing = CodeBlock(x=python_script_5) { x[1]; }
single_glazing_2 = Flatten(single_glazing)
glazing = CodeBlock(Glazing=single_glazing_2) { Glazing; }
code_block_11 = CodeBlock { "glass_wall"; }

# group: Honeybee Surface
python_script_8 = Python(IN[0]=code_block, IN[1]=glazing, IN[2]=code_block_11, IN[4]=python_script_4)
# ---------- python_script_8.python (68 lines) ----------
import sys
sys.path.extend(IN[0])

try:
    from honeybeex.hbsurface import HBSurface
    from honeybeex.wrapper import Wrapper
except ImportError:
    raise ImportError("Failed to import Honeybee libraries.\n" + \
                      "Set-up path to Honeybee libraries in honeybee_honeybee component")

from uuid import uuid4

# create list from inputs if it's not a list
_geo, name_, _type_, radProp_, epProp_ = IN[1:]

if _geo:
    
    # this is not good practice. I need to find a better generic solution for
    # dynamo inputs
    for count, inp in enumerate(IN):
        if not hasattr(inp, '__iter__'):
            IN[count] = [inp]
    
    _geos, names_, _types_, radProps_, epProps_ = IN[1:]
    
    HBSrfs = range(len(_geos))
    
    for count, _geo in enumerate(_geos):
        try:
            name_ = names_[count]
        except IndexError:
            name_ = names_[0] + "_{}".format(count)
        
        isNameSetByUser = True
        if not name_:
            name_ = "Surface_%s" % uuid4()
            isNameSetByUser = False
        
        try:
            _type_ = _types_[count]
        except IndexError:
            _type_ = _types_[0]
    
        isTypeSetByUser = True
        if not _type_:
            isTypeSetByUser = False

        try:
            radProp_ = radProps_[count]
        except IndexError:
            radProp_ = radProps_[0]
            
        radProp_ = radProp_.unwrap() if radProp_ else None

        try:
            epProp_ = epProps_[count]
        except IndexError:
            epProp_ = epProps_[0]
            
        epProp_ = epProp_.unwrap() if epProp_ else None
    
        HBSrf = HBSurface(name_, _geo, _type_, isNameSetByUser, isTypeSetByUser,
                          radProp_, epProp_)
    
        HBSrfs[count] = Wrapper(HBSrf)

    
    OUT = HBSrfs
# ----------------------------------------

# group: I assume there is a better way to merge lists that I'm not aware of!
create_2 = List.Create(python_script_7, python_script_8)  # frozen
flatten_3 = Flatten(create_2)

translate = Geometry.Translate(geometry=scale, zTranslation=code_block_8)
code_block_12 = CodeBlock { "c:\ladybug"; "untitled1"; }
boolean = BoolSelector(true)

# group: runDaylightAnalysis
python_script_9 = Python(IN[0]=code_block, IN[1]=analysis_recipe, IN[2]=python_script_7, IN[3]=code_block_12.out0, IN[4]=code_block_12.out1, IN[5]=boolean, IN[6]=boolean)
# ---------- python_script_9.python (28 lines) ----------
import sys
sys.path.extend(IN[0])


_recipe, _HBObjs, _folder_, _name_, _write, run_ = IN[1:]

if _HBObjs and _recipe and _write:
    try:
        _HBObjs = [objs.unwrap() for objs in _HBObjs]
    except AttributeError:
        raise AttributeError(" At least one of the inputs in _HBObjs is not a valid Honeybee object.")
   
    try:
       _recipe= _recipe.unwrap()
    except AttributeError:
        raise AttributeError(" Can't read the analysis recipe.")

    if _write:
        # Add Honeybee objects to the recipe
        _recipe.hbObjects = _HBObjs
        try:
            _recipe.writeToFile(_folder_, _name_)
        except AttributeError, e:
            raise ValueError(" Expected a recipe not a %s:\n%s" % (type(_recipe), str(e)))

    if _write and run_:
        if _recipe.run(False):
        	OUT = _recipe.results()
# ----------------------------------------

unflattenList = Python(IN[0]=generate_test_points.testPts, IN[1]=python_script_9)
# ---------- unflattenList.python (18 lines) ----------
def unflatten(guide, flattenedInput):
    """Unflatten a falttened generator
        guide: A guide list to follow the structure
        falttenedInput: A flattened iterator object

        Usage:
            guide = [["a"], ["b","c","d"], [["e"]], ["f"]]
            inputList = [0, 1, 2, 3, 4, 5, 6, 7]
            unflatten(guide, iter(inputList))
            >> [[0], [1, 2, 3], [[4]], [5]]
    """
    if isinstance(flattenedInput, list):
    	flattenedInput = iter(flattenedInput)
    	
    return [unflatten(subList, flattenedInput) if isinstance(subList, list) else next(flattenedInput) for subList in guide]


OUT = unflatten(*IN)
# ----------------------------------------
code_block_13 = CodeBlock { {0, 900}; }
code_block_14 = CodeBlock { 6; }
lb_color_range = Custom[LB Color Range](index=code_block_14)  # A set of color ranges for coloring analysis results
legend_parameters = Custom[Legend Parameters](domain=code_block_13, colors=lb_color_range.colors)  # Use legend parameter to set up results visualization setting
color_surface = Custom[Color Surface](analysisSurfaces=translate, values=unflattenList, legendPar=legend_parameters.legendPar)  # Color a test surface based on the results of a study. The results structure should match the test points structure to be mapped correctly on the surface.
current = Document.Current()
activeView = Document.ActiveView(current)
flatten_4 = Flatten(generate_test_points.testPts)
code_block_15 = CodeBlock { "Daylight analysis"; "This is a daylight analysis right from inside REVIT."; }
unit_types = UnitTypes("Insolation")
byViewPointsAndValues = Revit.AnalysisDisplay.PointAnalysisDisplay.ByViewPointsAndValues(activeView, flatten_4, python_script_9, code_block_15.out0, code_block_15.out1, unit_types)
code_block_16 = CodeBlock { "{3D}"; }
all_elements_in_active_view = ElementsInView()
