# Grasshopper definition sunlighthours_sample.gh (Grasshopper 0.9.76)
# plug-ins: Python Interpreter

# ---- group: change the path to honeybeex folder
python = PythonScript(path_to_honeybee_libs="C:\Users\Administrator\Documents\GitHub\honeybeex")  # -> readMe
# ---------- python: Python ----------
from scriptcontext import sticky

sticky["hb_lib_path"] = path_to_honeybee_libs
# ---------- end python ----------

# ----
constructlocation = Ladybug_ConstructLocation(locationName="unknown_Location", latitude="36", longitude=0, timeZone=0, elevation=0)  # -> location; plug-in component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
analysisperiod = Ladybug_AnalysisPeriod()  # -> readMe, analysisPeriod; plug-in component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
series = Series(Start=0, Step="3", Count="10")
panel = Panel("""16
17
18""")
number_slider = Slider(16, range=0..100)
series_2 = Series(Start=0, Step=1, Count="12")
series_3 = Series(Start=0, Step=1, Count="24")
number_slider_2 = Slider(6, range=0..10)
number_slider_3 = Slider(1, range=0..10)
number_slider_4 = Slider(0.01, range=0..0.01)
brep = Brep(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)
panel_2 = Panel("""1
2
3
4
5""")
python_2 = PythonScript(name="g_material", TVis=".65")  # -> material
# ---------- python_2: Python ----------
import sys
from scriptcontext import sticky

if "hb_lib_path" in sticky:
    sys.path.append(sticky["hb_lib_path"])

try:
    from honeybeex.radiance.material.glass import GlassMaterial
    from honeybeex.wrapper import Wrapper
except ImportError:
    raise ImportError("Failed to import Honeybee libraries.\n" + \
                      "Set-up path to Honeybee libraries in honeybee_honeybee component")



if _name and _TVis:
    material = GlassMaterial.bySingleTransValue(_name, _TVis)
    
    material = Wrapper(material)
# ---------- end python_2 ----------
sunpath = Ladybug_SunPath(
    location=constructlocation,
    hour=series_3,
    day=series,
    month=series_2,
    timeStep=1,
    analysisPeriod=analysisperiod.analysisPeriod,
    sunPathScale=Slider(0.2, range=0..1),
    dailyOrAnnualSunPath=True)  # -> readMe, sunVectors, sunAltitudes, sunAzimuths, port, sunSpheresMesh, sunPathCrvs, legend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; plug-in component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
brep_2 = Brep(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)
gentestpts = Honeybee_GenerateTestPoints(testGeometry=brep, gridSize=".5", distBaseSrf=Slider(0.762, range=0..1), moveTestMesh=True)  # -> readMe, simplify(testPoints), simplify(ptsVectors), simplify(facesArea), simplify(mesh); plug-in component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
wires = BrepWireframe(Brep=brep, Density=-1)
python_3 = PythonScript(name="wall", reflect=".55", spec=0, rough=0)  # -> material
# ---------- python_3: Python ----------
import sys
from scriptcontext import sticky

if "hb_lib_path" in sticky:
    sys.path.append(sticky["hb_lib_path"])

try:
    from honeybeex.radiance.material.plastic import PlasticMaterial
    from honeybeex.wrapper import Wrapper
except ImportError:
    raise ImportError("Failed to import Honeybee libraries.\n" + \
                      "Set-up path to Honeybee libraries in honeybee_honeybee component")



if _name and _reflect:
    material = PlasticMaterial.bySingleReflectValue(_name, _reflect, _spec_, _rough_)
    
    material = Wrapper(material)
# ---------- end python_3 ----------
panel_3 = Panel(python_2)
wires_2 = BrepWireframe(Brep=brep_2, Density=-1)
brep_3 = Brep([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])
preview = CustomPreview(Geometry=brep_2, Shader=ColourSwatch(SwatchColor=RGBA(211, 208, 255, 64)))
panel_4 = Panel(python_3)
python_4 = PythonScript(material=python_2)  # -> radProp
# ---------- python_4: Python ----------
import sys
from scriptcontext import sticky

if "hb_lib_path" in sticky:
    sys.path.append(sticky["hb_lib_path"])

try:
    from honeybeex.radiance.properties import RadianceProperties
    from honeybeex.wrapper import Wrapper
except ImportError:
    raise ImportError("Failed to import Honeybee libraries.\n" + \
                      "Set-up path to Honeybee libraries in honeybee_honeybee component")


radProp = RadianceProperties(_material_.unwrap(), True) if _material_ else RadianceProperties()
radProp = Wrapper(radProp)
# ---------- end python_4 ----------
wires_3 = BrepWireframe(Brep=brep_3, Density=-1)
pt = Point(gentestpts.testPoints)
preview_2 = CustomPreview(
    Geometry=sunpath.sunPositions,
    Shader={ambient=RGB(0, 0, 0), diffuse=RGB(255, 105, 180), emission=RGB(76, 32, 54), shine=0.5, specular=RGB(255, 255, 255), transparency=0})

# ---- group: I'm not sure if we need this extra step
python_5 = PythonScript(material=python_3)  # -> radProp; same code as python_4

# ----
lng = ListLength(List=sunpath.sunVectors)
item = ListItem(List=sunpath.sunPositions, Index="1216", Wrap=True)
series_4 = Series(Start=0, Step=1, Count="241")
brep_4 = Brep(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)
panel_5 = Panel(python_4)
sph = Sphere(Base=item, Radius=Slider(0.3, range=0..1))
python_6 = PythonScript(geo=brep_2, name="glass_wall", radProp=python_4)  # -> readMe, HBSrf; inputs geo: GeometryBase, type: Int32
# ---------- python_6: Python ----------
import sys
from scriptcontext import sticky

if "hb_lib_path" in sticky:
    sys.path.append(sticky["hb_lib_path"])

try:
    from honeybeex.hbsurface import HBSurface
    from honeybeex.wrapper import Wrapper
except ImportError:
    raise ImportError("Failed to import Honeybee libraries.\n" + \
                      "Set-up path to Honeybee libraries in honeybee_honeybee component")

from uuid import uuid4

if _geo:
    
    isNameSetByUser = True
    if not name_:
        name_ = "Surface_%s" % uuid4()
        isNameSetByUser = False
        
    isTypeSetByUser = True
    if not _type_:
        isTypeSetByUser = False
    
    radProp_ = radProp_.unwrap() if radProp_ else None
    
    epProp_ = epProp_.unwrap() if epProp_ else None
    
    HBSrf = HBSurface(name_, _geo, _type_, isNameSetByUser,isTypeSetByUser,
                      radProp_, epProp_)

    HBSrf = Wrapper(HBSrf)
# ---------- end python_6 ----------
panel_6 = Panel(python_5)
panel_7 = Panel(lng)
item_2 = ListItem(List=sunpath.sunPositions, Index=series_4, Wrap=True)

# ---- group: HBHive is not implemented yet- the component outputs the surface itself
python_7 = PythonScript(geo=brep_3, name=panel_2, radProp=python_5)  # -> readMe, HBSrf; inputs geo: GeometryBase, type: Int32
# ---------- python_7: Python ----------
import sys
from scriptcontext import sticky

if "hb_lib_path" in sticky:
    sys.path.append(sticky["hb_lib_path"])

try:
    from honeybeex.hbsurface import HBSurface
    from honeybeex.wrapper import Wrapper
except ImportError:
    raise ImportError("Failed to import Honeybee libraries.\n" + \
                      "Set-up path to Honeybee libraries in honeybee_honeybee component")

from uuid import uuid4

if _geo:
    
    isNameSetByUser = True
    if not name_:
        name_ = "Surface_%s" % uuid4()
        isNameSetByUser = False
        
    isTypeSetByUser = True
    if not _type_:
        isTypeSetByUser = False
    
    radProp_ = radProp_.unwrap() if radProp_ else None
    
    epProp_ = epProp_.unwrap() if epProp_ else None
    
    HBSrf = HBSurface(name_, _geo, _type_, isNameSetByUser, isTypeSetByUser,
                      radProp_, epProp_)

    HBSrf = Wrapper(HBSrf)
# ---------- end python_7 ----------

# ----
item_3 = ListItem(List=pt, Index=0, Wrap=True)
item_4 = ListItem(List=sunpath.sunVectors, Index=series_4, Wrap=True)
panel_8 = Panel("10000")
python_8 = PythonScript(HBObjs=python_7.HBSrf)  # -> geo; inputs HBObjs: list
# ---------- python_8: Python ----------
geo = [hbo.unwrap().geometry for hbo in HBObjs if hasattr(hbo, 'unwrap')
    and hasattr(hbo.unwrap(), 'isHBObject')]
# ---------- end python_8 ----------
debrep = DeconstructBrep(Brep=brep_4)  # -> Faces, Edges, Vertices

# ---- group: visualizeGeometry
python_9 = PythonScript(HBObjs=python_6.HBSrf)  # -> geo; inputs HBObjs: list; same code as python_8

# ----
item_5 = ListItem(List=sunpath.sunVectors, Index="1216", Wrap=True)

# ---- group: analysis recipe
gridbased = PythonScript(sunVectors=item_4, testPoints=gentestpts.testPoints, timestep=Slider(1, range=0..1))  # -> analysisRecipe; inputs sunVectors: list of Vector3d, testPoints: tree of Point3d, ptsVectors: tree of Vector3d, timestep: Int32
# ---------- gridbased: Python ----------
import sys
from scriptcontext import sticky

if "hb_lib_path" in sticky:
    sys.path.append(sticky["hb_lib_path"])

try:
    from honeybeex.radiance.recipe.sunlighthours import SunlightHoursAnalysisRecipe
    from honeybeex import wrapper
except ImportError:
    raise ImportError("Failed to import Honeybee libraries.\n" + \
                      "Set-up path to Honeybee libraries in honeybee_honeybee component")

if _sunVectors and _testPoints and ptsVectors_:
    analysisRecipe = SunlightHoursAnalysisRecipe(_sunVectors,
        _testPoints, ptsVectors_, _timestep_
    )
    analysisRecipe = wrapper.Wrapper(analysisRecipe)
# ---------- end gridbased ----------

# ----
python_10 = PythonScript(geo=debrep.Faces)  # -> readMe, HBSrf; inputs geo: GeometryBase, type: Int32; same code as python_7
panel_9 = Panel(python_7.HBSrf)
item_6 = ListItem(List=python_8, Index="1", Wrap=True)
item_7 = ListItem(List=python_7.HBSrf, Index="1", Wrap=True)
sunlighthoursanalysis = Ladybug_SunlightHoursAnalysis(
    geometry=flatten(gentestpts.mesh),
    context=flatten([brep_3, brep_4]),
    gridSize="0.0001",
    disFromBase="0.0001",
    sunVectors=flatten(item_4),
    timeStep=1,
    runIt=Toggle(True))  # -> readMe, contextMesh, analysisMesh, testPts, testVec, port, sunlightHoursResult, sunlightHoursMesh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; plug-in component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
panel_10 = Panel("test room")
data = Data(flatten([python_10.HBSrf, python_7.HBSrf, python_6.HBSrf]))
panel_11 = Panel(gridbased)
toggle = BooleanToggle(True)

# ---- group: change to re-run the analysis
toggle_2 = BooleanToggle(False)

# ----
python_11 = PythonScript(recipe=gridbased, HBObjs=data, folder="c:\ladybug", name="untitled", write=toggle, run=toggle)  # -> readMe, results; inputs HBObjs: tree, write: Boolean, run: Boolean
# ---------- python_11: Python ----------
_HBObjs.Flatten()
_HBObjs = _HBObjs.Branch(0)

if _HBObjs and _recipe and _write:
    try:
        _HBObjs = [objs.unwrap() for objs in _HBObjs]
    except AttributeError:
        raise AttributeError(" At least one of the inputs in _HBObjs is not a valid Honeybee object.")
   
    try:
       _recipe= _recipe.unwrap()
    except AttributeError:
        raise AttributeError(" Can't read the analysis recipe.")

    if _write:
        # Add Honeybee objects to the recipe
        _recipe.hbObjects = _HBObjs
#        try:
        _recipe.writeToFile(_folder_, _name_)
#        except AttributeError:
#            raise ValueError(" Expected a recipe not a %s" % type(_recipe))

    if _write and run_:
        if _recipe.run(False):
            results = _recipe.results()
# ---------- end python_11 ----------
panel_12 = Panel(sunlighthoursanalysis.readMe)

# ---- group: this is here for re-running the bat file manually after changing the parameters
python_12 = PythonScript(x=gridbased, y=toggle_2)  # -> out, a; disabled
# ---------- python_12: Python ----------
import os
os.system(r"C:\ladybug\untitled\sunlighthour\untitled.bat")
a = x.unwrap().results()
# ---------- end python_12 ----------

# ----
ladybug = Ladybug_Ladybug()  # -> Vviiiiiiiiiizzz; plug-in component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
python_13 = PythonScript(resultFile="C:\ladybug\untitled\sunlighthour\untitled.dc", x="0")  # -> out, a; inputs x: Int32
# ---------- python_13: Python ----------
def __parseline(line):
    _values = line.strip().split("\t")
    _rgb = [_values[x:x + 3] for x in xrange(0, len(_values), 3)]

    return [1 if sum(map(float, v)) > 0 else 0 for v in _rgb]

with open(resultFile, 'rb', 10) as inf:
    for c, line in enumerate(inf):
        if c < 10:
            continue
        if c == 10 + x:
            # here is the results for the test poin
            a = __parseline(line)
            break
# ---------- end python_13 ----------
panel_13 = Panel(python_11.readMe)

# ---- group: results from Honeybee
num = Number(python_11.results)

# ---- group: results from Ladybug
num_2 = Number(sunlighthoursanalysis.sunlightHoursResult)

# ----
panel_14 = Panel(python_13.a)
larger = LargerThan(FirstNumber=python_13.a, SecondNumber=0)  # -> LargerThan, OrEqualTo
item_8 = ListItem(List=num_2, Index="18", Wrap=True)
python_14 = PythonScript(x=num_2, y=num)  # -> out, a, b; inputs x: list of Int32, y: list of Int32
# ---------- python_14: Python ----------
a = [i for i in range(len(x)) if x[i] != y[i]]

b = [x[i]-y[i] for i in range(len(x)) if x[i] != y[i]]
# ---------- end python_14 ----------
lng_2 = ListLength(List=num_2)
lng_3 = ListLength(List=python_14.a)
division = Division(A=lng_3, B=lng_2)
multiplication = Multiplication(A=division, B=100)

# ---- group: % of points with inaccurate results
panel_15 = Panel(multiplication)

# ----
panel_16 = Panel(python_14.a)
number_slider_5 = Slider(151, range=0..152)
# Compare results
item_9 = ListItem(List=panel_16, Index=Slider(4, range=0..10), Wrap=True)
item_10 = ListItem(List=sunlighthoursanalysis.testPts, Index=panel_16, Wrap=True)
panel_17 = Panel(item_9)
gradientlibrary = Ladybug_GradientLibrary(gradIndex=Slider(1, range=0..10))  # -> customColors; plug-in component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

# ---- group: points with different results
sph_2 = Sphere(Base=item_10, Radius=Slider(0.1, range=0..1))

# ----
tag = TextTag3D(Location=item_10, Text=python_14.b, Size=Slider(0.3, range=0..1), Justification=7)
item_11 = ListItem(List=sunlighthoursanalysis.testPts, Index=panel_17, Wrap=True)
filter = StreamFilter(Gate=Slider(1, range=0..1), Stream0=num_2, Stream1=num)
legendpar = Ladybug_LegendParameters(highBound=Slider(9, range=0..10), numSegments=Slider(10, range=0..10), customColors=flatten(gradientlibrary))  # -> legendPar; plug-in component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

ladybug_2 = Ladybug_Ladybug()  # -> Vviiiiiiiiiizzz; plug-in component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
recolormesh = Ladybug_RecolorMesh(analysisResult=filter, inputMesh=gentestpts.mesh, heightDomain="-1 To -0.1", legendTitle="hour")  # -> readMe, newMesh, newLegend, legendBasePt, meshColors, legendColors; plug-in component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

concat = Concatenate(FragmentA="{0;", FragmentB=panel_17, FragmentC="}")
branch = TreeBranch(Tree=sunlighthoursanalysis.sunIsVisible, Path=concat, MaintainPaths=True)
python_15 = PythonScript(x=branch, y=larger.LargerThan)  # -> out, a; inputs x: list of Int32, y: list of Int32
# ---------- python_15: Python ----------
for count, (a, b) in enumerate(zip(x, y)):
    if a != b:
        a = count
        break
# ---------- end python_15 ----------
panel_18 = Panel(python_15.a)
item_12 = ListItem(List=sunpath.sunVectors, Index=python_15.a, Wrap=True)
rev = Reverse(Vector=item_12)
meshray = MeshRay(Mesh=python_9, Point=item_11, Direction=rev)  # -> Point, Hit
panel_19 = Panel(item_12)
dispatch = Dispatch(List=sunpath.sunVectors, DispatchPattern=branch)  # -> ListA, ListB
number_slider_6 = Slider(100, range=0..100)
line = LineSDL(Start=graft(item_11), Direction=rev, Length=number_slider_6)
rev_2 = Reverse(Vector=dispatch.ListB)
rev_3 = Reverse(Vector=dispatch.ListA)
swatch = ColourSwatch(SwatchColor=RGB(0, 255, 0))
preview_3 = CustomPreview(Geometry=line, Shader=swatch)
line_2 = LineSDL(Start=graft(item_11), Direction=rev_3, Length=number_slider_6)
line_3 = LineSDL(Start=graft(item_11), Direction=rev_2, Length=number_slider_6)
preview_4 = CustomPreview(Geometry=line_2, Shader=swatch)

# ---- group: intersected based on Grasshopper
preview_5 = CustomPreview(Geometry=line_3, Shader=ColourSwatch(SwatchColor=RGB(255, 0, 0)))
